# Grasshopper definition 02_a_iaac_reassembly_design_genAI.ghx (Grasshopper 1.0.8)
# plug-ins: RhinoCodePluginGH

panel = Panel("""{
"objectName": "AlternatingBlockBondColumn",
"material": "Brick",
"parts": [
{"id": 1, "origin": [0.0, -0.0625, 0.026], "dimensions": [0.24, 0.115, 0.052], "rotation": [0.0, 0.0, 0.0], "connections": [2, 3, 4]},
{"id": 2, "origin": [0.0, 0.0625, 0.026], "dimensions": [0.24, 0.115, 0.052], "rotation": [0.0, 0.0, 0.0], "connections": [1, 3, 4]},
{"id": 3, "origin": [-0.0625, 0.0, 0.088], "dimensions": [0.24, 0.115, 0.052], "rotation": [0.0, 0.0, 1.5708], "connections": [4, 1, 2, 5, 6]},
{"id": 4, "origin": [0.0625, 0.0, 0.088], "dimensions": [0.24, 0.115, 0.052], "rotation": [0.0, 0.0, 1.5708], "connections": [3, 1, 2, 5, 6]},
{"id": 5, "origin": [0.0, -0.0625, 0.15], "dimensions": [0.24, 0.115, 0.052], "rotation": [0.0, 0.0, 0.0], "connections": [6, 3, 4, 7, 8]},
{"id": 6, "origin": [0.0, 0.0625, 0.15], "dimensions": [0.24, 0.115, 0.052], "rotation": [0.0, 0.0, 0.0], "connections": [5, 3, 4, 7, 8]},
{"id": 7, "origin": [-0.0625, 0.0, 0.212], "dimensions": [0.24, 0.115, 0.052], "rotation": [0.0, 0.0, 1.5708], "connections": [8, 5, 6, 9, 10]},
{"id": 8, "origin": [0.0625, 0.0, 0.212], "dimensions": [0.24, 0.115, 0.052], "rotation": [0.0, 0.0, 1.5708], "connections": [7, 5, 6, 9, 10]},
{"id": 9, "origin": [0.0, -0.0625, 0.274], "dimensions": [0.24, 0.115, 0.052], "rotation": [0.0, 0.0, 0.0], "connections": [10, 7, 8, 11, 12]},
{"id": 10, "origin": [0.0, 0.0625, 0.274], "dimensions": [0.24, 0.115, 0.052], "rotation": [0.0, 0.0, 0.0], "connections": [9, 7, 8, 11, 12]},
{"id": 11, "origin": [-0.0625, 0.0, 0.336], "dimensions": [0.24, 0.115, 0.052], "rotation": [0.0, 0.0, 1.5708], "connections": [12, 9, 10, 13, 14]},
{"id": 12, "origin": [0.0625, 0.0, 0.336], "dimensions": [0.24, 0.115, 0.052], "rotation": [0.0, 0.0, 1.5708], "connections": [11, 9, 10, 13, 14]},
{"id": 13, "origin": [0.0, -0.0625, 0.398], "dimensions": [0.24, 0.115, 0.052], "rotation": [0.0, 0.0, 0.0], "connections": [14, 11, 12, 15, 16]},
{"id": 14, "origin": [0.0, 0.0625, 0.398], "dimensions": [0.24, 0.115, 0.052], "rotation": [0.0, 0.0, 0.0], "connections": [13, 11, 12, 15, 16]},
{"id": 15, "origin": [-0.0625, 0.0, 0.46], "dimensions": [0.24, 0.115, 0.052], "rotation": [0.0, 0.0, 1.5708], "connections": [16, 13, 14, 17, 18]},
{"id": 16, "origin": [0.0625, 0.0, 0.46], "dimensions": [0.24, 0.115, 0.052], "rotation": [0.0, 0.0, 1.5708], "connections": [15, 13, 14, 17, 18]},
{"id": 17, "origin": [0.0, -0.0625, 0.522], "dimensions": [0.24, 0.115, 0.052], "rotation": [0.0, 0.0, 0.0], "connections": [18, 15, 16, 19, 20]},
{"id": 18, "origin": [0.0, 0.0625, 0.522], "dimensions": [0.24, 0.115, 0.052], "rotation": [0.0, 0.0, 0.0], "connections": [17, 15, 16, 19, 20]},
{"id": 19, "origin": [-0.0625, 0.0, 0.584], "dimensions": [0.24, 0.115, 0.052], "rotation": [0.0, 0.0, 1.5708], "connections": [20, 17, 18, 21, 22]},
{"id": 20, "origin": [0.0625, 0.0, 0.584], "dimensions": [0.24, 0.115, 0.052], "rotation": [0.0, 0.0, 1.5708], "connections": [19, 17, 18, 21, 22]},
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""")
panel_2 = Panel("""{
"objectName": "Kirkeby Gate",
"material": "brick_red",
"parts": [
{ "id": 1, "origin": [-0.2425, 0.0, 0.026], "dimensions": [0.24, 0.115, 0.052], "rotation": [0, 0, 1.570796], "connections": [] },
{ "id": 2, "origin": [-0.1175, 0.0, 0.026], "dimensions": [0.24, 0.115, 0.052], "rotation": [0, 0, 1.570796], "connections": [] },
{ "id": 3, "origin": [0.1175, 0.0, 0.026], "dimensions": [0.24, 0.115, 0.052], "rotation": [0, 0, 1.570796], "connections": [] },
{ "id": 4, "origin": [0.2425, 0.0, 0.026], "dimensions": [0.24, 0.115, 0.052], "rotation": [0, 0, 1.570796], "connections": [] },
{ "id": 5, "origin": [-0.18, -0.0625, 0.088], "dimensions": [0.24, 0.115, 0.052], "rotation": [0, 0, 0], "connections": [1, 2] },
{ "id": 6, "origin": [-0.18, 0.0625, 0.088], "dimensions": [0.24, 0.115, 0.052], "rotation": [0, 0, 0], "connections": [1, 2] },
{ "id": 7, "origin": [0.18, -0.0625, 0.088], "dimensions": [0.24, 0.115, 0.052], "rotation": [0, 0, 0], "connections": [3, 4] },
{ "id": 8, "origin": [0.18, 0.0625, 0.088], "dimensions": [0.24, 0.115, 0.052], "rotation": [0, 0, 0], "connections": [3, 4] },
{ "id": 9, "origin": [-0.2425, 0.0, 0.15], "dimensions": [0.24, 0.115, 0.052], "rotation": [0, 0, 1.570796], "connections": [5, 6] },
{ "id": 10, "origin": [-0.1175, 0.0, 0.15], "dimensions": [0.24, 0.115, 0.052], "rotation": [0, 0, 1.570796], "connections": [5, 6] },
{ "id": 11, "origin": [0.1175, 0.0, 0.15], "dimensions": [0.24, 0.115, 0.052], "rotation": [0, 0, 1.570796], "connections": [7, 8] },
{ "id": 12, "origin": [0.2425, 0.0, 0.15], "dimensions": [0.24, 0.115, 0.052], "rotation": [0, 0, 1.570796], "connections": [7, 8] },
{ "id": 13, "origin": [-0.18, -0.0625, 0.212], "dimensions": [0.24, 0.115, 0.052], "rotation": [0, 0, 0], "connections": [9, 10] },
{ "id": 14, "origin": [-0.18, 0.0625, 0.212], "dimensions": [0.24, 0.115, 0.052], "rotation": [0, 0, 0], "connections": [9, 10] },
{ "id": 15, "origin": [0.18, -0.0625, 0.212], "dimensions": [0.24, 0.115, 0.052], "rotation": [0, 0, 0], "connections": [11, 12] },
{ "id": 16, "origin": [0.18, 0.0625, 0.212], "dimensions": [0.24, 0.115, 0.052], "rotation": [0, 0, 0], "connections": [11, 12] },
{ "id": 17, "origin": [-0.2425, 0.0, 0.274], "dimensions": [0.24, 0.115, 0.052], "rotation": [0, 0, 1.570796], "connections": [13, 14] },
{ "id": 18, "origin": [-0.1175, 0.0, 0.274], "dimensions": [0.24, 0.115, 0.052], "rotation": [0, 0, 1.570796], "connections": [13, 14] },
{ "id": 19, "origin": [0.1175, 0.0, 0.274], "dimensions": [0.24, 0.115, 0.052], "rotation": [0, 0, 1.570796], "connections": [15, 16] },
{ "id": 20, "origin": [0.2425, 0.0, 0.274], "dimensions": [0.24, 0.115, 0.052], "rotation": [0, 0, 1.570796], "connections": [15, 16] },
{ "id": 21, "origin": [-0.18, -0.0625, 0.336], "dimensions": [0.24, 0.115, 0.052], "rotation": [0, 0, 0], "connections": [17, 18] },
{ "id": 22, "origin": [-0.18, 0.0625, 0.336], "dimensions": [0.24, 0.115, 0.052], "rotation": [0, 0, 0], "connections": [17, 18] },
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""")
panel_3 = Panel("""{
"objectName": "Kirkeby_Stepped_Wedge",
"material": "brick",
"parts": [
{ "id": 1, "origin": [-0.25, 0.1875, 0.026], "dimensions": [0.24, 0.115, 0.052], "rotation": [0, 0, 0], "connections": [2, 4, 25] },
{ "id": 2, "origin": [0.0, 0.1875, 0.026], "dimensions": [0.24, 0.115, 0.052], "rotation": [0, 0, 0], "connections": [1, 3, 5, 26] },
{ "id": 3, "origin": [0.25, 0.1875, 0.026], "dimensions": [0.24, 0.115, 0.052], "rotation": [0, 0, 0], "connections": [2, 6, 27] },
{ "id": 4, "origin": [-0.25, 0.0625, 0.026], "dimensions": [0.24, 0.115, 0.052], "rotation": [0, 0, 0], "connections": [1, 5, 7, 28] },
{ "id": 5, "origin": [0.0, 0.0625, 0.026], "dimensions": [0.24, 0.115, 0.052], "rotation": [0, 0, 0], "connections": [2, 4, 6, 8, 29] },
{ "id": 6, "origin": [0.25, 0.0625, 0.026], "dimensions": [0.24, 0.115, 0.052], "rotation": [0, 0, 0], "connections": [3, 5, 9, 30] },
{ "id": 7, "origin": [-0.25, -0.0625, 0.026], "dimensions": [0.24, 0.115, 0.052], "rotation": [0, 0, 0], "connections": [4, 8, 10, 31] },
{ "id": 8, "origin": [0.0, -0.0625, 0.026], "dimensions": [0.24, 0.115, 0.052], "rotation": [0, 0, 0], "connections": [5, 7, 9, 11, 32] },
{ "id": 9, "origin": [0.25, -0.0625, 0.026], "dimensions": [0.24, 0.115, 0.052], "rotation": [0, 0, 0], "connections": [6, 8, 12, 33] },
{ "id": 10, "origin": [-0.25, -0.1875, 0.026], "dimensions": [0.24, 0.115, 0.052], "rotation": [0, 0, 0], "connections": [7, 11, 34] },
{ "id": 11, "origin": [0.0, -0.1875, 0.026], "dimensions": [0.24, 0.115, 0.052], "rotation": [0, 0, 0], "connections": [8, 10, 12, 35] },
{ "id": 12, "origin": [0.25, -0.1875, 0.026], "dimensions": [0.24, 0.115, 0.052], "rotation": [0, 0, 0], "connections": [9, 11, 36] },
{ "id": 13, "origin": [-0.3125, 0.125, 0.088], "dimensions": [0.24, 0.115, 0.052], "rotation": [0, 0, 1.5708], "connections": [14, 19, 1] },
{ "id": 14, "origin": [-0.1875, 0.125, 0.088], "dimensions": [0.24, 0.115, 0.052], "rotation": [0, 0, 1.5708], "connections": [13, 15, 20, 1] },
{ "id": 15, "origin": [-0.0625, 0.125, 0.088], "dimensions": [0.24, 0.115, 0.052], "rotation": [0, 0, 1.5708], "connections": [14, 16, 21, 2] },
{ "id": 16, "origin": [0.0625, 0.125, 0.088], "dimensions": [0.24, 0.115, 0.052], "rotation": [0, 0, 1.5708], "connections": [15, 17, 22, 2] },
{ "id": 17, "origin": [0.1875, 0.125, 0.088], "dimensions": [0.24, 0.115, 0.052], "rotation": [0, 0, 1.5708], "connections": [16, 18, 23, 3] },
{ "id": 18, "origin": [0.3125, 0.125, 0.088], "dimensions": [0.24, 0.115, 0.052], "rotation": [0, 0, 1.5708], "connections": [17, 24, 3] },
{ "id": 19, "origin": [-0.3125, -0.125, 0.088], "dimensions": [0.24, 0.115, 0.052], "rotation": [0, 0, 1.5708], "connections": [13, 20, 7] },
{ "id": 20, "origin": [-0.1875, -0.125, 0.088], "dimensions": [0.24, 0.115, 0.052], "rotation": [0, 0, 1.5708], "connections": [14, 19, 21, 7] },
{ "id": 21, "origin": [-0.0625, -0.125, 0.088], "dimensions": [0.24, 0.115, 0.052], "rotation": [0, 0, 1.5708], "connections": [15, 20, 22, 8] },
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""")
panel_4 = Panel("""{
  "objectName": "1_meter_column",
  "material": "brick",
  "parts": [
    {
      "id": 1,
      "origin": [0, 0.13, 0.0325],
      "dimensions": [0.12, 0.25, 0.065],
      "connections": [2, 4, 8, 11, 12, 14, 15, 18, 19]
    },
    {
      "id": 2,
      "origin": [0, -0.13, 0.0325],
      "dimensions": [0.12, 0.25, 0.065],
      "connections": [1, 5, 9, 11, 12, 14, 15, 18, 19]
    },
    {
      "id": 3,
      "origin": [-0.1625, 0.195, 0.0325],
      "dimensions": [0.185, 0.12, 0.065],
      "connections": [4, 15, 16]
    },
    {
      "id": 4,
      "origin": [-0.1625, 0.065, 0.0325],
      "dimensions": [0.185, 0.12, 0.065],
      "connections": [3, 5, 1, 12, 15]
    },
    {
      "id": 5,
      "origin": [-0.1625, -0.065, 0.0325],
      "dimensions": [0.185, 0.12, 0.065],
      "connections": [4, 6, 2, 12, 19]
    },
    {
      "id": 6,
      "origin": [-0.1625, -0.195, 0.0325],
      "dimensions": [0.185, 0.12, 0.065],
      "connections": [5, 19, 20]
    },
    {
      "id": 7,
      "origin": [0.1625, 0.195, 0.0325],
      "dimensions": [0.185, 0.12, 0.065],
      "connections": [8, 13, 14]
    },
    {
      "id": 8,
      "origin": [0.1625, 0.065, 0.0325],
      "dimensions": [0.185, 0.12, 0.065],
      "connections": [7, 9, 1, 11, 14]
    },
    {
      "id": 9,
      "origin": [0.1625, -0.065, 0.0325],
      "dimensions": [0.185, 0.12, 0.065],
      "connections": [8, 10, 2, 11, 18]
    },
    {
      "id": 10,
      "origin": [0.1625, -0.195, 0.0325],
      "dimensions": [0.185, 0.12, 0.065],
      "connections": [9, 17, 18]
    },
    {
      "id": 11,
      "origin": [0.13, 0, 0.1075],
      "dimensions": [0.25, 0.12, 0.065],
      "connections": [12, 14, 18, 1, 2, 8, 9, 21, 22, 28, 29]
    },
    {
      "id": 12,
      "origin": [-0.13, 0, 0.1075],
      "dimensions": [0.25, 0.12, 0.065],
      "connections": [11, 15, 19, 1, 2, 4, 5, 21, 22, 24, 25]
    },
    {
      "id": 13,
      "origin": [0.195, 0.1625, 0.1075],
      "dimensions": [0.12, 0.185, 0.065],
      "connections": [14, 7, 27]
    },
    {
      "id": 14,
      "origin": [0.065, 0.1625, 0.1075],
      "dimensions": [0.12, 0.185, 0.065],
      "connections": [13, 15, 11, 1, 7, 8, 21, 27, 28]
    },
    {
      "id": 15,
      "origin": [-0.065, 0.1625, 0.1075],
      "dimensions": [0.12, 0.185, 0.065],
      "connections": [14, 16, 12, 1, 3, 4, 21, 23, 24]
    },
    {
      "id": 16,
      "origin": [-0.195, 0.1625, 0.1075],
      "dimensions": [0.12, 0.185, 0.065],
      "connections": [15, 3, 23]
    },
    {
      "id": 17,
      "origin": [0.195, -0.1625, 0.1075],
      "dimensions": [0.12, 0.185, 0.065],
      "connections": [18, 10, 30]
    },
    {
      "id": 18,
      "origin": [0.065, -0.1625, 0.1075],
      "dimensions": [0.12, 0.185, 0.065],
      "connections": [17, 19, 11, 2, 9, 10, 22, 29, 30]
    },
    {
      "id": 19,
      "origin": [-0.065, -0.1625, 0.1075],
      "dimensions": [0.12, 0.185, 0.065],
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""")
panel_5 = Panel("""{
"objectName": "Hollow Brick Column",
"material": "brick",
"parts": [
{
"id": 1,
"origin": [-0.0625, 0.125, 0.026],
"dimensions": [0.24, 0.115, 0.052],
"rotation": [0, 0, 0],
"connections": [2, 4, 5, 8]
},
{
"id": 2,
"origin": [0.125, 0.0625, 0.026],
"dimensions": [0.24, 0.115, 0.052],
"rotation": [0, 0, 1.5708],
"connections": [3, 1, 5, 6]
},
{
"id": 3,
"origin": [0.0625, -0.125, 0.026],
"dimensions": [0.24, 0.115, 0.052],
"rotation": [0, 0, 0],
"connections": [4, 2, 6, 7]
},
{
"id": 4,
"origin": [-0.125, -0.0625, 0.026],
"dimensions": [0.24, 0.115, 0.052],
"rotation": [0, 0, 1.5708],
"connections": [1, 3, 7, 8]
},
{
"id": 5,
"origin": [0.0625, 0.125, 0.088],
"dimensions": [0.24, 0.115, 0.052],
"rotation": [0, 0, 0],
"connections": [6, 8, 1, 2, 9, 10]
},
{
"id": 6,
"origin": [0.125, -0.0625, 0.088],
"dimensions": [0.24, 0.115, 0.052],
"rotation": [0, 0, 1.5708],
"connections": [7, 5, 2, 3, 10, 11]
},
{
"id": 7,
"origin": [-0.0625, -0.125, 0.088],
"dimensions": [0.24, 0.115, 0.052],
"rotation": [0, 0, 0],
"connections": [8, 6, 3, 4, 11, 12]
},
{
"id": 8,
"origin": [-0.125, 0.0625, 0.088],
"dimensions": [0.24, 0.115, 0.052],
"rotation": [0, 0, 1.5708],
"connections": [5, 7, 4, 1, 12, 9]
},
{
"id": 9,
"origin": [-0.0625, 0.125, 0.15],
"dimensions": [0.24, 0.115, 0.052],
"rotation": [0, 0, 0],
"connections": [10, 12, 5, 8, 13, 16]
},
{
"id": 10,
"origin": [0.125, 0.0625, 0.15],
"dimensions": [0.24, 0.115, 0.052],
"rotation": [0, 0, 1.5708],
"connections": [11, 9, 5, 6, 13, 14]
},
{
"id": 11,
"origin": [0.0625, -0.125, 0.15],
"dimensions": [0.24, 0.115, 0.052],
"rotation": [0, 0, 0],
"connections": [12, 10, 6, 7, 14, 15]
},
{
"id": 12,
"origin": [-0.125, -0.0625, 0.15],
"dimensions": [0.24, 0.115, 0.052],
"rotation": [0, 0, 1.5708],
"connections": [9, 11, 7, 8, 15, 16]
},
{
"id": 13,
"origin": [0.0625, 0.125, 0.212],
"dimensions": [0.24, 0.115, 0.052],
"rotation": [0, 0, 0],
"connections": [14, 16, 9, 10, 17, 18]
},
{
"id": 14,
"origin": [0.125, -0.0625, 0.212],
"dimensions": [0.24, 0.115, 0.052],
"rotation": [0, 0, 1.5708],
"connections": [15, 13, 10, 11, 18, 19]
},
{
"id": 15,
"origin": [-0.0625, -0.125, 0.212],
"dimensions": [0.24, 0.115, 0.052],
"rotation": [0, 0, 0],
"connections": [16, 14, 11, 12, 19, 20]
},
{
"id": 16,
"origin": [-0.125, 0.0625, 0.212],
"dimensions": [0.24, 0.115, 0.052],
"rotation": [0, 0, 1.5708],
"connections": [13, 15, 12, 9, 20, 17]
},
{
"id": 17,
"origin": [-0.0625, 0.125, 0.274],
"dimensions": [0.24, 0.115, 0.052],
"rotation": [0, 0, 0],
"connections": [18, 20, 13, 16, 21, 24]
},
{
"id": 18,
"origin": [0.125, 0.0625, 0.274],
"dimensions": [0.24, 0.115, 0.052],
"rotation": [0, 0, 1.5708],
"connections": [19, 17, 13, 14, 21, 22]
},
{
"id": 19,
"origin": [0.0625, -0.125, 0.274],
"dimensions": [0.24, 0.115, 0.052],
"rotation": [0, 0, 0],
"connections": [20, 18, 14, 15, 22, 23]
},
{
"id": 20,
"origin": [-0.125, -0.0625, 0.274],
"dimensions": [0.24, 0.115, 0.052],
"rotation": [0, 0, 1.5708],
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""")
panel_6 = Panel("""{
"objectName": "Circular Hollow Brick Column",
"material": "brick",
"parts": [
{
"id": 1,
"origin": [0.22, 0, 0.026],
"dimensions": [0.24, 0.115, 0.052],
"rotation": [0, 0, 1.5708],
"connections": [2, 5, 6, 10]
},
{
"id": 2,
"origin": [0.068, 0.2092, 0.026],
"dimensions": [0.24, 0.115, 0.052],
"rotation": [0, 0, 2.8274],
"connections": [3, 1, 6, 7]
},
{
"id": 3,
"origin": [-0.178, 0.1293, 0.026],
"dimensions": [0.24, 0.115, 0.052],
"rotation": [0, 0, 4.0841],
"connections": [4, 2, 7, 8]
},
{
"id": 4,
"origin": [-0.178, -0.1293, 0.026],
"dimensions": [0.24, 0.115, 0.052],
"rotation": [0, 0, 5.3407],
"connections": [5, 3, 8, 9]
},
{
"id": 5,
"origin": [0.068, -0.2092, 0.026],
"dimensions": [0.24, 0.115, 0.052],
"rotation": [0, 0, 0.3142],
"connections": [1, 4, 9, 10]
},
{
"id": 6,
"origin": [0.178, 0.1293, 0.088],
"dimensions": [0.24, 0.115, 0.052],
"rotation": [0, 0, 2.1991],
"connections": [7, 10, 1, 2, 11, 12]
},
{
"id": 7,
"origin": [-0.068, 0.2092, 0.088],
"dimensions": [0.24, 0.115, 0.052],
"rotation": [0, 0, 3.4558],
"connections": [8, 6, 2, 3, 12, 13]
},
{
"id": 8,
"origin": [-0.22, 0, 0.088],
"dimensions": [0.24, 0.115, 0.052],
"rotation": [0, 0, 4.7124],
"connections": [9, 7, 3, 4, 13, 14]
},
{
"id": 9,
"origin": [-0.068, -0.2092, 0.088],
"dimensions": [0.24, 0.115, 0.052],
"rotation": [0, 0, 5.969],
"connections": [10, 8, 4, 5, 14, 15]
},
{
"id": 10,
"origin": [0.178, -0.1293, 0.088],
"dimensions": [0.24, 0.115, 0.052],
"rotation": [0, 0, 0.9425],
"connections": [6, 9, 5, 1, 15, 11]
},
{
"id": 11,
"origin": [0.22, 0, 0.15],
"dimensions": [0.24, 0.115, 0.052],
"rotation": [0, 0, 1.5708],
"connections": [12, 15, 6, 10, 16, 20]
},
{
"id": 12,
"origin": [0.068, 0.2092, 0.15],
"dimensions": [0.24, 0.115, 0.052],
"rotation": [0, 0, 2.8274],
"connections": [13, 11, 6, 7, 16, 17]
},
{
"id": 13,
"origin": [-0.178, 0.1293, 0.15],
"dimensions": [0.24, 0.115, 0.052],
"rotation": [0, 0, 4.0841],
"connections": [14, 12, 7, 8, 17, 18]
},
{
"id": 14,
"origin": [-0.178, -0.1293, 0.15],
"dimensions": [0.24, 0.115, 0.052],
"rotation": [0, 0, 5.3407],
"connections": [15, 13, 8, 9, 18, 19]
},
{
"id": 15,
"origin": [0.068, -0.2092, 0.15],
"dimensions": [0.24, 0.115, 0.052],
"rotation": [0, 0, 0.3142],
"connections": [11, 14, 9, 10, 19, 20]
},
{
"id": 16,
"origin": [0.178, 0.1293, 0.212],
"dimensions": [0.24, 0.115, 0.052],
"rotation": [0, 0, 2.1991],
"connections": [17, 20, 11, 12, 21, 22]
},
{
"id": 17,
"origin": [-0.068, 0.2092, 0.212],
"dimensions": [0.24, 0.115, 0.052],
"rotation": [0, 0, 3.4558],
"connections": [18, 16, 12, 13, 22, 23]
},
{
"id": 18,
"origin": [-0.22, 0, 0.212],
"dimensions": [0.24, 0.115, 0.052],
"rotation": [0, 0, 4.7124],
"connections": [19, 17, 13, 14, 23, 24]
},
{
"id": 19,
"origin": [-0.068, -0.2092, 0.212],
"dimensions": [0.24, 0.115, 0.052],
"rotation": [0, 0, 5.969],
"connections": [20, 18, 14, 15, 24, 25]
},
{
"id": 20,
"origin": [0.178, -0.1293, 0.212],
"dimensions": [0.24, 0.115, 0.052],
"rotation": [0, 0, 0.9425],
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""")
panel_7 = Panel("""{
"objectName": "Corrected Star Column (No Overlaps)",
"material": "brick",
"parts": [
{
"id": 1,
"origin": [-0.0625, 0.125, 0.026],
"dimensions": [0.24, 0.115, 0.052],
"rotation": [0, 0, 0],
"connections": [2, 4, 5, 6, 7, 8]
},
{
"id": 2,
"origin": [0.125, 0.0625, 0.026],
"dimensions": [0.24, 0.115, 0.052],
"rotation": [0, 0, 1.5708],
"connections": [1, 3, 5, 6, 7, 8]
},
{
"id": 3,
"origin": [0.0625, -0.125, 0.026],
"dimensions": [0.24, 0.115, 0.052],
"rotation": [0, 0, 0],
"connections": [2, 4, 5, 6, 7, 8]
},
{
"id": 4,
"origin": [-0.125, -0.0625, 0.026],
"dimensions": [0.24, 0.115, 0.052],
"rotation": [0, 0, 1.5708],
"connections": [3, 1, 5, 6, 7, 8]
},
{
"id": 5,
"origin": [-0.1326, 0.0442, 0.088],
"dimensions": [0.24, 0.115, 0.052],
"rotation": [0, 0, 0.7854],
"connections": [1, 2, 3, 4, 6, 8, 9, 10, 11, 12]
},
{
"id": 6,
"origin": [0.0442, 0.1326, 0.088],
"dimensions": [0.24, 0.115, 0.052],
"rotation": [0, 0, 2.3562],
"connections": [1, 2, 3, 4, 5, 7, 9, 10, 11, 12]
},
{
"id": 7,
"origin": [0.1326, -0.0442, 0.088],
"dimensions": [0.24, 0.115, 0.052],
"rotation": [0, 0, 0.7854],
"connections": [1, 2, 3, 4, 6, 8, 9, 10, 11, 12]
},
{
"id": 8,
"origin": [-0.0442, -0.1326, 0.088],
"dimensions": [0.24, 0.115, 0.052],
"rotation": [0, 0, 2.3562],
"connections": [1, 2, 3, 4, 5, 7, 9, 10, 11, 12]
},
{
"id": 9,
"origin": [-0.125, -0.0625, 0.15],
"dimensions": [0.24, 0.115, 0.052],
"rotation": [0, 0, 1.5708],
"connections": [5, 6, 7, 8, 10, 12, 13, 14, 15, 16]
},
{
"id": 10,
"origin": [-0.0625, 0.125, 0.15],
"dimensions": [0.24, 0.115, 0.052],
"rotation": [0, 0, 3.1416],
"connections": [5, 6, 7, 8, 9, 11, 13, 14, 15, 16]
},
{
"id": 11,
"origin": [0.125, 0.0625, 0.15],
"dimensions": [0.24, 0.115, 0.052],
"rotation": [0, 0, 1.5708],
"connections": [5, 6, 7, 8, 10, 12, 13, 14, 15, 16]
},
{
"id": 12,
"origin": [0.0625, -0.125, 0.15],
"dimensions": [0.24, 0.115, 0.052],
"rotation": [0, 0, 3.1416],
"connections": [5, 6, 7, 8, 9, 11, 13, 14, 15, 16]
},
{
"id": 13,
"origin": [-0.0442, -0.1326, 0.212],
"dimensions": [0.24, 0.115, 0.052],
"rotation": [0, 0, 2.3562],
"connections": [9, 10, 11, 12, 14, 16, 17, 18, 19, 20]
},
{
"id": 14,
"origin": [-0.1326, 0.0442, 0.212],
"dimensions": [0.24, 0.115, 0.052],
"rotation": [0, 0, 3.927],
"connections": [9, 10, 11, 12, 13, 15, 17, 18, 19, 20]
},
{
"id": 15,
"origin": [0.0442, 0.1326, 0.212],
"dimensions": [0.24, 0.115, 0.052],
"rotation": [0, 0, 2.3562],
"connections": [9, 10, 11, 12, 14, 16, 17, 18, 19, 20]
},
{
"id": 16,
"origin": [0.1326, -0.0442, 0.212],
"dimensions": [0.24, 0.115, 0.052],
"rotation": [0, 0, 3.927],
"connections": [9, 10, 11, 12, 13, 15, 17, 18, 19, 20]
},
{
"id": 17,
"origin": [0.0625, -0.125, 0.274],
"dimensions": [0.24, 0.115, 0.052],
"rotation": [0, 0, 3.1416],
"connections": [13, 14, 15, 16, 18, 20, 21, 22, 23, 24]
},
{
"id": 18,
"origin": [-0.125, -0.0625, 0.274],
"dimensions": [0.24, 0.115, 0.052],
"rotation": [0, 0, 4.7124],
"connections": [13, 14, 15, 16, 17, 19, 21, 22, 23, 24]
},
{
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""")
panel_8 = Panel("""{
"objectName": "Kirkeby Capital",
"material": "brick_red",
"parts": [
{ "id": 1, "origin": [0.0, -0.0625, 0.026], "dimensions": [0.24, 0.115, 0.052], "rotation": [0, 0, 0], "connections": [2, 3, 4] },
{ "id": 2, "origin": [0.0, 0.0625, 0.026], "dimensions": [0.24, 0.115, 0.052], "rotation": [0, 0, 0], "connections": [1, 3, 4] },
{ "id": 3, "origin": [-0.0625, 0.0, 0.088], "dimensions": [0.24, 0.115, 0.052], "rotation": [0, 0, 1.5708], "connections": [1, 2, 5, 6] },
{ "id": 4, "origin": [0.0625, 0.0, 0.088], "dimensions": [0.24, 0.115, 0.052], "rotation": [0, 0, 1.5708], "connections": [1, 2, 5, 6] },
{ "id": 5, "origin": [0.0, -0.0625, 0.15], "dimensions": [0.24, 0.115, 0.052], "rotation": [0, 0, 0], "connections": [3, 4, 7, 8, 9, 10, 11, 12] },
{ "id": 6, "origin": [0.0, 0.0625, 0.15], "dimensions": [0.24, 0.115, 0.052], "rotation": [0, 0, 0], "connections": [3, 4, 7, 8, 9, 10, 11, 12] },
{ "id": 7, "origin": [-0.0625, -0.125, 0.212], "dimensions": [0.24, 0.115, 0.052], "rotation": [0, 0, 0], "connections": [5, 6, 10, 8, 19, 21] },
{ "id": 8, "origin": [0.125, -0.0625, 0.212], "dimensions": [0.24, 0.115, 0.052], "rotation": [0, 0, 1.5708], "connections": [5, 6, 7, 9, 21, 22] },
{ "id": 9, "origin": [0.0625, 0.125, 0.212], "dimensions": [0.24, 0.115, 0.052], "rotation": [0, 0, 0], "connections": [5, 6, 8, 10, 22, 20] },
{ "id": 10, "origin": [-0.125, 0.0625, 0.212], "dimensions": [0.24, 0.115, 0.052], "rotation": [0, 0, 1.5708], "connections": [5, 6, 9, 7, 20, 19] },
{ "id": 11, "origin": [-0.0625, 0.0, 0.274], "dimensions": [0.24, 0.115, 0.052], "rotation": [0, 0, 1.5708], "connections": [5, 6, 13, 14] },
{ "id": 12, "origin": [0.0625, 0.0, 0.274], "dimensions": [0.24, 0.115, 0.052], "rotation": [0, 0, 1.5708], "connections": [5, 6, 13, 14] },
{ "id": 13, "origin": [0.0, -0.0625, 0.336], "dimensions": [0.24, 0.115, 0.052], "rotation": [0, 0, 0], "connections": [11, 12, 15, 16] },
{ "id": 14, "origin": [0.0, 0.0625, 0.336], "dimensions": [0.24, 0.115, 0.052], "rotation": [0, 0, 0], "connections": [11, 12, 15, 16] },
{ "id": 15, "origin": [-0.0625, 0.0, 0.398], "dimensions": [0.24, 0.115, 0.052], "rotation": [0, 0, 1.5708], "connections": [13, 14, 17, 18] },
{ "id": 16, "origin": [0.0625, 0.0, 0.398], "dimensions": [0.24, 0.115, 0.052], "rotation": [0, 0, 1.5708], "connections": [13, 14, 17, 18] },
{ "id": 17, "origin": [0.0, -0.0625, 0.46], "dimensions": [0.24, 0.115, 0.052], "rotation": [0, 0, 0], "connections": [15, 16, 23, 24, 25, 26, 27, 28, 29, 30] },
{ "id": 18, "origin": [0.0, 0.0625, 0.46], "dimensions": [0.24, 0.115, 0.052], "rotation": [0, 0, 0], "connections": [15, 16, 23, 24, 25, 26, 27, 28, 29, 30] },
{ "id": 19, "origin": [-0.16, -0.16, 0.368], "dimensions": [0.24, 0.115, 0.052], "rotation": [0, 1.5708, 0.7854], "connections": [7, 10, 23, 29] },
{ "id": 20, "origin": [-0.16, 0.16, 0.368], "dimensions": [0.24, 0.115, 0.052], "rotation": [0, 1.5708, -0.7854], "connections": [9, 10, 24, 30] },
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""")
panel_9 = Panel("""{
"objectName": "Art Deco Star Column Fixed",
"material": "brick",
"parts": [
{
"id": 1,
"origin": [0, 0.19, 0.026],
"dimensions": [0.24, 0.115, 0.052],
"rotation": [0, 0, 0],
"connections": [2, 4, 5, 8]
},
{
"id": 2,
"origin": [0.19, 0, 0.026],
"dimensions": [0.24, 0.115, 0.052],
"rotation": [0, 0, 1.5708],
"connections": [1, 3, 5, 6]
},
{
"id": 3,
"origin": [0, -0.19, 0.026],
"dimensions": [0.24, 0.115, 0.052],
"rotation": [0, 0, 0],
"connections": [2, 4, 6, 7]
},
{
"id": 4,
"origin": [-0.19, 0, 0.026],
"dimensions": [0.24, 0.115, 0.052],
"rotation": [0, 0, 1.5708],
"connections": [3, 1, 7, 8]
},
{
"id": 5,
"origin": [0.1343, 0.1343, 0.088],
"dimensions": [0.24, 0.115, 0.052],
"rotation": [0, 0, 2.3562],
"connections": [1, 2, 6, 8, 9, 10]
},
{
"id": 6,
"origin": [0.1343, -0.1343, 0.088],
"dimensions": [0.24, 0.115, 0.052],
"rotation": [0, 0, 0.7854],
"connections": [2, 3, 5, 7, 10, 11]
},
{
"id": 7,
"origin": [-0.1343, -0.1343, 0.088],
"dimensions": [0.24, 0.115, 0.052],
"rotation": [0, 0, 2.3562],
"connections": [3, 4, 6, 8, 11, 12]
},
{
"id": 8,
"origin": [-0.1343, 0.1343, 0.088],
"dimensions": [0.24, 0.115, 0.052],
"rotation": [0, 0, 0.7854],
"connections": [4, 1, 7, 5, 12, 9]
},
{
"id": 9,
"origin": [0, 0.19, 0.15],
"dimensions": [0.24, 0.115, 0.052],
"rotation": [0, 0, 0],
"connections": [5, 8, 10, 12, 13, 16]
},
{
"id": 10,
"origin": [0.19, 0, 0.15],
"dimensions": [0.24, 0.115, 0.052],
"rotation": [0, 0, 1.5708],
"connections": [5, 6, 9, 11, 13, 14]
},
{
"id": 11,
"origin": [0, -0.19, 0.15],
"dimensions": [0.24, 0.115, 0.052],
"rotation": [0, 0, 0],
"connections": [6, 7, 10, 12, 14, 15]
},
{
"id": 12,
"origin": [-0.19, 0, 0.15],
"dimensions": [0.24, 0.115, 0.052],
"rotation": [0, 0, 1.5708],
"connections": [7, 8, 11, 9, 15, 16]
},
{
"id": 13,
"origin": [0.1343, 0.1343, 0.212],
"dimensions": [0.24, 0.115, 0.052],
"rotation": [0, 0, 2.3562],
"connections": [9, 10, 14, 16, 17, 18]
},
{
"id": 14,
"origin": [0.1343, -0.1343, 0.212],
"dimensions": [0.24, 0.115, 0.052],
"rotation": [0, 0, 0.7854],
"connections": [10, 11, 13, 15, 18, 19]
},
{
"id": 15,
"origin": [-0.1343, -0.1343, 0.212],
"dimensions": [0.24, 0.115, 0.052],
"rotation": [0, 0, 2.3562],
"connections": [11, 12, 14, 16, 19, 20]
},
{
"id": 16,
"origin": [-0.1343, 0.1343, 0.212],
"dimensions": [0.24, 0.115, 0.052],
"rotation": [0, 0, 0.7854],
"connections": [12, 9, 15, 13, 20, 17]
},
{
"id": 17,
"origin": [0, 0.19, 0.274],
"dimensions": [0.24, 0.115, 0.052],
"rotation": [0, 0, 0],
"connections": [13, 16, 18, 20, 21, 24]
},
{
"id": 18,
"origin": [0.19, 0, 0.274],
"dimensions": [0.24, 0.115, 0.052],
"rotation": [0, 0, 1.5708],
"connections": [13, 14, 17, 19, 21, 22]
},
{
"id": 19,
"origin": [0, -0.19, 0.274],
"dimensions": [0.24, 0.115, 0.052],
"rotation": [0, 0, 0],
"connections": [14, 15, 18, 20, 22, 23]
},
{
"id": 20,
"origin": [-0.19, 0, 0.274],
"dimensions": [0.24, 0.115, 0.052],
"rotation": [0, 0, 1.5708],
"connections": [15, 16, 19, 17, 23, 24]
},
{
"id": 21,
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""")
panel_10 = Panel("""{
"objectName": "HollowPinwheelColumn",
"material": "red clay brick",
"parts": [
{
"id": 1,
"origin": [0.0625, 0.125, 0.026],
"dimensions": [0.24, 0.115, 0.052],
"connections": [2, 4, 5, 8]
},
{
"id": 2,
"origin": [0.125, -0.0625, 0.026],
"dimensions": [0.115, 0.24, 0.052],
"connections": [1, 3, 6, 5]
},
{
"id": 3,
"origin": [-0.0625, -0.125, 0.026],
"dimensions": [0.24, 0.115, 0.052],
"connections": [2, 4, 7, 6]
},
{
"id": 4,
"origin": [-0.125, 0.0625, 0.026],
"dimensions": [0.115, 0.24, 0.052],
"connections": [3, 1, 8, 7]
},
{
"id": 5,
"origin": [-0.0625, 0.125, 0.088],
"dimensions": [0.24, 0.115, 0.052],
"connections": [6, 8, 1, 4, 9, 12]
},
{
"id": 6,
"origin": [-0.125, -0.0625, 0.088],
"dimensions": [0.115, 0.24, 0.052],
"connections": [5, 7, 2, 1, 10, 9]
},
{
"id": 7,
"origin": [0.0625, -0.125, 0.088],
"dimensions": [0.24, 0.115, 0.052],
"connections": [6, 8, 3, 2, 11, 10]
},
{
"id": 8,
"origin": [0.125, 0.0625, 0.088],
"dimensions": [0.115, 0.24, 0.052],
"connections": [7, 5, 4, 3, 12, 11]
},
{
"id": 9,
"origin": [0.0625, 0.125, 0.15],
"dimensions": [0.24, 0.115, 0.052],
"connections": [10, 12, 5, 8, 13, 16]
},
{
"id": 10,
"origin": [0.125, -0.0625, 0.15],
"dimensions": [0.115, 0.24, 0.052],
"connections": [9, 11, 6, 5, 14, 13]
},
{
"id": 11,
"origin": [-0.0625, -0.125, 0.15],
"dimensions": [0.24, 0.115, 0.052],
"connections": [10, 12, 7, 6, 15, 14]
},
{
"id": 12,
"origin": [-0.125, 0.0625, 0.15],
"dimensions": [0.115, 0.24, 0.052],
"connections": [11, 9, 8, 7, 16, 15]
},
{
"id": 13,
"origin": [-0.0625, 0.125, 0.212],
"dimensions": [0.24, 0.115, 0.052],
"connections": [14, 16, 9, 12, 17, 20]
},
{
"id": 14,
"origin": [-0.125, -0.0625, 0.212],
"dimensions": [0.115, 0.24, 0.052],
"connections": [13, 15, 10, 9, 18, 17]
},
{
"id": 15,
"origin": [0.0625, -0.125, 0.212],
"dimensions": [0.24, 0.115, 0.052],
"connections": [14, 16, 11, 10, 19, 18]
},
{
"id": 16,
"origin": [0.125, 0.0625, 0.212],
"dimensions": [0.115, 0.24, 0.052],
"connections": [15, 13, 12, 11, 20, 19]
},
{
"id": 17,
"origin": [0.0625, 0.125, 0.274],
"dimensions": [0.24, 0.115, 0.052],
"connections": [18, 20, 13, 16, 21, 24]
},
{
"id": 18,
"origin": [0.125, -0.0625, 0.274],
"dimensions": [0.115, 0.24, 0.052],
"connections": [17, 19, 14, 13, 22, 21]
},
{
"id": 19,
"origin": [-0.0625, -0.125, 0.274],
"dimensions": [0.24, 0.115, 0.052],
"connections": [18, 20, 15, 14, 23, 22]
},
{
"id": 20,
"origin": [-0.125, 0.0625, 0.274],
"dimensions": [0.115, 0.24, 0.052],
"connections": [19, 17, 16, 15, 24, 23]
},
{
"id": 21,
"origin": [-0.0625, 0.125, 0.336],
"dimensions": [0.24, 0.115, 0.052],
"connections": [22, 24, 17, 20, 25, 28]
},
{
"id": 22,
"origin": [-0.125, -0.0625, 0.336],
"dimensions": [0.115, 0.24, 0.052],
"connections": [21, 23, 18, 17, 26, 25]
},
{
"id": 23,
"origin": [0.0625, -0.125, 0.336],
"dimensions": [0.24, 0.115, 0.052],
"connections": [22, 24, 19, 18, 27, 26]
},
{
"id": 24,
"origin": [0.125, 0.0625, 0.336],
"dimensions": [0.115, 0.24, 0.052],
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""")
panel_11 = Panel("""{
"objectName": "TwistedAlternatingParametricColumn",
"material": "Brick",
"parts": [
{"id": 1, "origin": [0.0, -0.0625, 0.026], "dimensions": [0.24, 0.115, 0.052], "rotation": [0.0, 0.0, 0.0], "connections": [2, 3, 4]},
{"id": 2, "origin": [0.0, 0.0625, 0.026], "dimensions": [0.24, 0.115, 0.052], "rotation": [0.0, 0.0, 0.0], "connections": [1, 3, 4]},
{"id": 3, "origin": [0.0616, 0.0109, 0.088], "dimensions": [0.24, 0.115, 0.052], "rotation": [0.0, 0.0, 1.7453], "connections": [4, 1, 2, 5, 6]},
{"id": 4, "origin": [-0.0616, -0.0109, 0.088], "dimensions": [0.24, 0.115, 0.052], "rotation": [0.0, 0.0, 1.7453], "connections": [3, 1, 2, 5, 6]},
{"id": 5, "origin": [0.0214, -0.0587, 0.15], "dimensions": [0.24, 0.115, 0.052], "rotation": [0.0, 0.0, 0.3491], "connections": [6, 3, 4, 7, 8]},
{"id": 6, "origin": [-0.0214, 0.0587, 0.15], "dimensions": [0.24, 0.115, 0.052], "rotation": [0.0, 0.0, 0.3491], "connections": [5, 3, 4, 7, 8]},
{"id": 7, "origin": [0.0541, 0.0313, 0.212], "dimensions": [0.24, 0.115, 0.052], "rotation": [0.0, 0.0, 2.0944], "connections": [8, 5, 6, 9, 10]},
{"id": 8, "origin": [-0.0541, -0.0313, 0.212], "dimensions": [0.24, 0.115, 0.052], "rotation": [0.0, 0.0, 2.0944], "connections": [7, 5, 6, 9, 10]},
{"id": 9, "origin": [0.0402, -0.0479, 0.274], "dimensions": [0.24, 0.115, 0.052], "rotation": [0.0, 0.0, 0.6981], "connections": [10, 7, 8, 11, 12]},
{"id": 10, "origin": [-0.0402, 0.0479, 0.274], "dimensions": [0.24, 0.115, 0.052], "rotation": [0.0, 0.0, 0.6981], "connections": [9, 7, 8, 11, 12]},
{"id": 11, "origin": [0.0402, 0.0479, 0.336], "dimensions": [0.24, 0.115, 0.052], "rotation": [0.0, 0.0, 2.4435], "connections": [12, 9, 10, 13, 14]},
{"id": 12, "origin": [-0.0402, -0.0479, 0.336], "dimensions": [0.24, 0.115, 0.052], "rotation": [0.0, 0.0, 2.4435], "connections": [11, 9, 10, 13, 14]},
{"id": 13, "origin": [0.0541, -0.0313, 0.398], "dimensions": [0.24, 0.115, 0.052], "rotation": [0.0, 0.0, 1.0472], "connections": [14, 11, 12, 15, 16]},
{"id": 14, "origin": [-0.0541, 0.0313, 0.398], "dimensions": [0.24, 0.115, 0.052], "rotation": [0.0, 0.0, 1.0472], "connections": [13, 11, 12, 15, 16]},
{"id": 15, "origin": [0.0214, 0.0587, 0.46], "dimensions": [0.24, 0.115, 0.052], "rotation": [0.0, 0.0, 2.7925], "connections": [16, 13, 14, 17, 18]},
{"id": 16, "origin": [-0.0214, -0.0587, 0.46], "dimensions": [0.24, 0.115, 0.052], "rotation": [0.0, 0.0, 2.7925], "connections": [15, 13, 14, 17, 18]},
{"id": 17, "origin": [0.0616, -0.0109, 0.522], "dimensions": [0.24, 0.115, 0.052], "rotation": [0.0, 0.0, 1.3963], "connections": [18, 15, 16, 19, 20]},
{"id": 18, "origin": [-0.0616, 0.0109, 0.522], "dimensions": [0.24, 0.115, 0.052], "rotation": [0.0, 0.0, 1.3963], "connections": [17, 15, 16, 19, 20]},
{"id": 19, "origin": [0.0, 0.0625, 0.584], "dimensions": [0.24, 0.115, 0.052], "rotation": [0.0, 0.0, 3.1416], "connections": [20, 17, 18, 21, 22]},
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""")

panel_12 = Panel("""{
"objectName": "Hollow Brick Column Updated",
"material": "brick",
"parts": [
{
"id": 1,
"origin": [-0.0725, 0.135, 0.0225],
"dimensions": [0.24, 0.115, 0.045],
"rotation": [0.0, 0.0, 0.0],
"connections": [2, 4, 5, 8]
},
{
"id": 2,
"origin": [0.135, 0.0725, 0.0225],
"dimensions": [0.24, 0.115, 0.045],
"rotation": [0.0, 0.0, 1.5708],
"connections": [3, 1, 5, 6]
},
{
"id": 3,
"origin": [0.0725, -0.135, 0.0225],
"dimensions": [0.24, 0.115, 0.045],
"rotation": [0.0, 0.0, 0.0],
"connections": [4, 2, 6, 7]
},
{
"id": 4,
"origin": [-0.135, -0.0725, 0.0225],
"dimensions": [0.24, 0.115, 0.045],
"rotation": [0.0, 0.0, 1.5708],
"connections": [1, 3, 7, 8]
},
{
"id": 5,
"origin": [0.0725, 0.135, 0.0675],
"dimensions": [0.24, 0.115, 0.045],
"rotation": [0.0, 0.0, 0.0],
"connections": [6, 8, 1, 2, 9, 10]
},
{
"id": 6,
"origin": [0.135, -0.0725, 0.0675],
"dimensions": [0.24, 0.115, 0.045],
"rotation": [0.0, 0.0, 1.5708],
"connections": [7, 5, 2, 3, 10, 11]
},
{
"id": 7,
"origin": [-0.0725, -0.135, 0.0675],
"dimensions": [0.24, 0.115, 0.045],
"rotation": [0.0, 0.0, 0.0],
"connections": [8, 6, 3, 4, 11, 12]
},
{
"id": 8,
"origin": [-0.135, 0.0725, 0.0675],
"dimensions": [0.24, 0.115, 0.045],
"rotation": [0.0, 0.0, 1.5708],
"connections": [5, 7, 4, 1, 12, 9]
},
{
"id": 9,
"origin": [-0.0725, 0.135, 0.1125],
"dimensions": [0.24, 0.115, 0.045],
"rotation": [0.0, 0.0, 0.0],
"connections": [10, 12, 5, 8, 13, 16]
},
{
"id": 10,
"origin": [0.135, 0.0725, 0.1125],
"dimensions": [0.24, 0.115, 0.045],
"rotation": [0.0, 0.0, 1.5708],
"connections": [11, 9, 5, 6, 13, 14]
},
{
"id": 11,
"origin": [0.0725, -0.135, 0.1125],
"dimensions": [0.24, 0.115, 0.045],
"rotation": [0.0, 0.0, 0.0],
"connections": [12, 10, 6, 7, 14, 15]
},
{
"id": 12,
"origin": [-0.135, -0.0725, 0.1125],
"dimensions": [0.24, 0.115, 0.045],
"rotation": [0.0, 0.0, 1.5708],
"connections": [9, 11, 7, 8, 15, 16]
},
{
"id": 13,
"origin": [0.0725, 0.135, 0.1575],
"dimensions": [0.24, 0.115, 0.045],
"rotation": [0.0, 0.0, 0.0],
"connections": [14, 16, 9, 10, 17, 18]
},
{
"id": 14,
"origin": [0.135, -0.0725, 0.1575],
"dimensions": [0.24, 0.115, 0.045],
"rotation": [0.0, 0.0, 1.5708],
"connections": [15, 13, 10, 11, 18, 19]
},
{
"id": 15,
"origin": [-0.0725, -0.135, 0.1575],
"dimensions": [0.24, 0.115, 0.045],
"rotation": [0.0, 0.0, 0.0],
"connections": [16, 14, 11, 12, 19, 20]
},
{
"id": 16,
"origin": [-0.135, 0.0725, 0.1575],
"dimensions": [0.24, 0.115, 0.045],
"rotation": [0.0, 0.0, 1.5708],
"connections": [13, 15, 12, 9, 20, 17]
},
{
"id": 17,
"origin": [-0.0725, 0.135, 0.2025],
"dimensions": [0.24, 0.115, 0.045],
"rotation": [0.0, 0.0, 0.0],
"connections": [18, 20, 13, 16, 21, 24]
},
{
"id": 18,
"origin": [0.135, 0.0725, 0.2025],
"dimensions": [0.24, 0.115, 0.045],
"rotation": [0.0, 0.0, 1.5708],
"connections": [19, 17, 13, 14, 21, 22]
},
{
"id": 19,
"origin": [0.0725, -0.135, 0.2025],
"dimensions": [0.24, 0.115, 0.045],
"rotation": [0.0, 0.0, 0.0],
"connections": [20, 18, 14, 15, 22, 23]
},
{
"id": 20,
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""")
panel_13 = Panel("""{
"objectName": "Circular Hollow Brick Column Updated",
"material": "brick",
"parts": [
{
"id": 1,
"origin": [0.23, 0.0, 0.0225],
"dimensions": [0.24, 0.115, 0.045],
"rotation": [0.0, 0.0, 1.5708],
"connections": [2, 5, 6, 10]
},
{
"id": 2,
"origin": [0.0711, 0.2187, 0.0225],
"dimensions": [0.24, 0.115, 0.045],
"rotation": [0.0, 0.0, 2.8274],
"connections": [3, 1, 6, 7]
},
{
"id": 3,
"origin": [-0.1861, 0.1352, 0.0225],
"dimensions": [0.24, 0.115, 0.045],
"rotation": [0.0, 0.0, 4.0841],
"connections": [4, 2, 7, 8]
},
{
"id": 4,
"origin": [-0.1861, -0.1352, 0.0225],
"dimensions": [0.24, 0.115, 0.045],
"rotation": [0.0, 0.0, 5.3407],
"connections": [5, 3, 8, 9]
},
{
"id": 5,
"origin": [0.0711, -0.2187, 0.0225],
"dimensions": [0.24, 0.115, 0.045],
"rotation": [0.0, 0.0, 0.3142],
"connections": [1, 4, 9, 10]
},
{
"id": 6,
"origin": [0.1861, 0.1352, 0.0675],
"dimensions": [0.24, 0.115, 0.045],
"rotation": [0.0, 0.0, 2.1991],
"connections": [7, 10, 1, 2, 11, 12]
},
{
"id": 7,
"origin": [-0.0711, 0.2187, 0.0675],
"dimensions": [0.24, 0.115, 0.045],
"rotation": [0.0, 0.0, 3.4558],
"connections": [8, 6, 2, 3, 12, 13]
},
{
"id": 8,
"origin": [-0.23, 0.0, 0.0675],
"dimensions": [0.24, 0.115, 0.045],
"rotation": [0.0, 0.0, 4.7124],
"connections": [9, 7, 3, 4, 13, 14]
},
{
"id": 9,
"origin": [-0.0711, -0.2187, 0.0675],
"dimensions": [0.24, 0.115, 0.045],
"rotation": [0.0, 0.0, 5.969],
"connections": [10, 8, 4, 5, 14, 15]
},
{
"id": 10,
"origin": [0.1861, -0.1352, 0.0675],
"dimensions": [0.24, 0.115, 0.045],
"rotation": [0.0, 0.0, 0.9425],
"connections": [6, 9, 5, 1, 15, 11]
},
{
"id": 11,
"origin": [0.23, 0.0, 0.1125],
"dimensions": [0.24, 0.115, 0.045],
"rotation": [0.0, 0.0, 1.5708],
"connections": [12, 15, 6, 10, 16, 20]
},
{
"id": 12,
"origin": [0.0711, 0.2187, 0.1125],
"dimensions": [0.24, 0.115, 0.045],
"rotation": [0.0, 0.0, 2.8274],
"connections": [13, 11, 6, 7, 16, 17]
},
{
"id": 13,
"origin": [-0.1861, 0.1352, 0.1125],
"dimensions": [0.24, 0.115, 0.045],
"rotation": [0.0, 0.0, 4.0841],
"connections": [14, 12, 7, 8, 17, 18]
},
{
"id": 14,
"origin": [-0.1861, -0.1352, 0.1125],
"dimensions": [0.24, 0.115, 0.045],
"rotation": [0.0, 0.0, 5.3407],
"connections": [15, 13, 8, 9, 18, 19]
},
{
"id": 15,
"origin": [0.0711, -0.2187, 0.1125],
"dimensions": [0.24, 0.115, 0.045],
"rotation": [0.0, 0.0, 0.3142],
"connections": [11, 14, 9, 10, 19, 20]
},
{
"id": 16,
"origin": [0.1861, 0.1352, 0.1575],
"dimensions": [0.24, 0.115, 0.045],
"rotation": [0.0, 0.0, 2.1991],
"connections": [17, 20, 11, 12, 21, 22]
},
{
"id": 17,
"origin": [-0.0711, 0.2187, 0.1575],
"dimensions": [0.24, 0.115, 0.045],
"rotation": [0.0, 0.0, 3.4558],
"connections": [18, 16, 12, 13, 22, 23]
},
{
"id": 18,
"origin": [-0.23, 0.0, 0.1575],
"dimensions": [0.24, 0.115, 0.045],
"rotation": [0.0, 0.0, 4.7124],
"connections": [19, 17, 13, 14, 23, 24]
},
{
"id": 19,
"origin": [-0.0711, -0.2187, 0.1575],
"dimensions": [0.24, 0.115, 0.045],
"rotation": [0.0, 0.0, 5.969],
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""")
empty_dataset_generation = Python3Script()  # -> out, a
# ---------- empty_dataset_generation: Python ----------
# python 3
# Generates a trainingDataSet JSON from a folder with images named brick01a, brick01b, ...

import os
import re
import json

SUPPORTED_EXT = {".png", ".jpg", ".jpeg", ".webp", ".heic", ".heif"}

def find_pairs(folder):
    pat = re.compile(r"^brick(\d{2})([ab])$", re.IGNORECASE)
    buckets = {}

    for fn in os.listdir(folder):
        base, ext = os.path.splitext(fn)
        if ext.lower() not in SUPPORTED_EXT:
            continue

        m = pat.match(base)
        if not m:
            continue

        idx = m.group(1)
        side = m.group(2).lower()
        full_path = os.path.join(folder, fn)

        if idx not in buckets:
            buckets[idx] = {}
        buckets[idx][side] = full_path

    pairs = []
    for idx in sorted(buckets.keys()):
        entry = buckets[idx]
        if "a" in entry and "b" in entry:
            pairs.append((idx, entry["a"], entry["b"]))

    return pairs

def make_dataset(folder, ttl_seconds=21600):
    pairs = find_pairs(folder)
    if not pairs:
        raise ValueError("No brickNN a b pairs found in folder")

    examples = []
    for idx, a_path, b_path in pairs:
        examples.append({
            "id": "brick{}".format(idx),
            "imageAPath": a_path.replace("\\", "/"),
            "imageBPath": b_path.replace("\\", "/"),
            "expected": {
                "nodeKey": "0",
                "appendDamages": []
            }
        })

    return {
        "ttlSeconds": int(ttl_seconds),
        "examples": examples
    }

if __name__ == "__main__":
    folder = r"C:\Users\tizianrein\workspace\projects\workshop_iaac_2026\data\brick_images\trainingDataSet"
    out_path = os.path.join(folder, "trainingDataSet.json")

    dataset = make_dataset(folder, ttl_seconds=21600)

    with open(out_path, "w", encoding="utf-8") as f:
        json.dump(dataset, f, ensure_ascii=False, indent=2)

    print("Wrote:", out_path)
    print("Examples:", len(dataset["examples"]))
# ---------- end empty_dataset_generation ----------

# ----
# Import from JSON
value_list = ValueList({"0", "1", "2", "3", "4", "5", "6", "7", "8", "9", "10", "11", "12", "13"}, selected="2")
import = Button()
path = Python3Script()  # -> out, DATA
# ---------- path: Python ----------
import os
import getpass

username = getpass.getuser()
USER_FOLDER = os.path.abspath(os.path.join("C:/Users/", username))
DATA = os.path.abspath(os.path.join(USER_FOLDER,"workspace/projects/workshop_iaac_2026/data"))

print(USER_FOLDER)
print(DATA)
# ---------- end path ----------
import_2 = Python3Script(DATA=path.DATA, brick_key=value_list, import=import)  # -> out, assembly; inputs DATA: String
# ---------- import_2: Python ----------
import os
import json
from assembly_information_model.assembly import Assembly
from scriptcontext import sticky as st

if _import:
    filename = "single_RF_brick_w_damages_1.json"
    PATH = os.path.join(DATA, filename)
    print(PATH)
    assembly = Assembly.from_json(PATH)

    st['assembly'] = assembly

assembly = st.get('assembly')
# ---------- end import_2 ----------

# ----
# Reassembly Generation via VLMs
path_2 = Python3Script()  # -> out, DATA
# ---------- path_2: Python ----------
import os
import getpass

username = getpass.getuser()
USER_FOLDER = os.path.abspath(os.path.join("C:/Users/", username))
DATA = os.path.abspath(os.path.join(USER_FOLDER,"workspace/projects/workshop_iaac_2026/data/sketches"))

print(USER_FOLDER)
print(DATA)
# ---------- end path_2 ----------
# The most important Rules with API:
# 
# 1 Never embed API keys in GH files, scripts, screenshots, or recordings
# 
# 2 One person, one key - No shared master keys
# 
# 3 Never commit the key to Github
# 
# 4 Enforce hard daily and monthly spend caps per key
# 
# 5 Rate limit, use backoff, and cap retries. No infinite loops
# 
# 6 Cache static data in sc.sticky to avoid repeat calls
# 
# 7 Only call the API on an explicit button press, not on recompute
# 
# 8 Downscale and compress images. Send the minimum views needed
# 
# 9 Log timestamps, model, input size, output size. Never log keys
# 
# 10 Fail closed on missing key, invalid key, or quota reached
# User Prompt: Create a slightly twisted column
# User Prompt: Create a slightly twisted column with two bricks at each course
# User Prompt: Create a rectangular pillar with four bricks per course with slight rotation
user_prompt = Panel("Create a twisted column design, that uses four bricks on each course.")
panel_14 = Panel(path_2.out)

path_3 = Python3Script(filename="GeminiKey")  # -> out, DATA
# ---------- path_3: Python ----------
import os
import getpass

username = getpass.getuser()
USER_FOLDER = os.path.abspath(os.path.join("C:/Users/", username))
DATA = os.path.abspath(os.path.join(USER_FOLDER,"workspace/{}.txt".format(filename)))

print(USER_FOLDER)
print(DATA)
# ---------- end path_3 ----------

run_the_generative_model = Button()
ai_assembly_generation = Python3Script(
    userPrompt=user_prompt,
    maxBricks=Slider(50, range=0..100),
    brickWidthCm=Slider(24, range=0..100),
    brickDepthCm=Slider(11.5, range=0..100),
    brickHeightCm=Slider(4.5, range=0..100),
    gapCm=Slider(3, range=0..100),
    keyPath=path_3.DATA,
    run=run_the_generative_model)  # -> error, log, assemblyJson, MODEL_ID, executionTime; inputs keyPath: String
# ---------- ai_assembly_generation: Python ----------
#! python 3
# venv: ai_brick_eval
# r: google-genai

import scriptcontext as sc
import json
import os
import time
import threading
import Eto
import re
from google import genai

# ------------------------------------------------------------
# Model
# ------------------------------------------------------------
MODEL_ID = "gemini-2.5-pro"

# ------------------------------------------------------------
# Sticky keys
# ------------------------------------------------------------
KEY_RUNNING       = "gemini_assembly_is_running"
KEY_LAST_OUTPUT   = "gemini_assembly_last_output"
KEY_LAST_ERROR    = "gemini_assembly_last_error"
KEY_LAST_TIME     = "gemini_assembly_last_time"
KEY_RESULT        = "gemini_assembly_api_result"
KEY_API_ERROR     = "gemini_assembly_api_error"
KEY_START_TIME    = "gemini_assembly_start_time"
KEY_LAST_LOG      = "gemini_assembly_last_log"
KEY_POLICY_RAW    = "gemini_assembly_policy_raw"
KEY_LAST_RUN_EDGE = "gemini_assembly_last_run_edge"

_defaults = [
    (KEY_RUNNING, False),
    (KEY_LAST_OUTPUT, "Ready. Toggle run."),
    (KEY_LAST_ERROR, None),
    (KEY_LAST_TIME, None),
    (KEY_RESULT, None),
    (KEY_API_ERROR, None),
    (KEY_START_TIME, None),
    (KEY_LAST_LOG, []),
    (KEY_POLICY_RAW, ""),
    (KEY_LAST_RUN_EDGE, False),
]
for k, v in _defaults:
    if k not in sc.sticky:
        sc.sticky[k] = v

# ------------------------------------------------------------
# GH update helper
# ------------------------------------------------------------
def trigger_gh_update():
    gh_doc = ghenv.Component.OnPingDocument()
    if gh_doc:
        for obj in gh_doc.Objects:
            if obj.InstanceGuid == ghenv.Component.InstanceGuid:
                obj.ExpireSolution(True)
                return

# ------------------------------------------------------------
# Small helpers
# ------------------------------------------------------------
def _strip_code_fences(text):
    if not text:
        return text
    t = text.strip()
    if t.startswith("```json"):
        t = t[7:].strip()
        if t.endswith("```"):
            t = t[:-3].strip()
        return t
    if t.startswith("```"):
        t = t[3:].strip()
        if t.endswith("```"):
            t = t[:-3].strip()
        return t
    return t

def _is_valid_json(s):
    try:
        json.loads(s)
        return True
    except:
        return False

def _sanitize_key(raw):
    if raw is None:
        return ""
    k = raw
    if len(k) > 0 and ord(k[0]) == 65279:
        k = k[1:]
    k = k.strip()
    if (k.startswith('"') and k.endswith('"')) or (k.startswith("'") and k.endswith("'")):
        k = k[1:-1].strip()
    if "\n" in k or "\r" in k:
        parts = [p.strip() for p in k.replace("\r", "\n").split("\n") if p.strip()]
        k = parts[0] if parts else ""
    return k.strip()

def load_api_key_from_path(key_path):
    if not key_path or not str(key_path).strip():
        raise ValueError("keyPath input is missing.")
    kp = str(key_path).strip()
    if not os.path.exists(kp):
        raise ValueError("API key file not found at given path: {}".format(kp))
    with open(kp, "r") as f:
        raw = f.read()
    api_key = _sanitize_key(raw)
    if not api_key:
        raise ValueError("API key file is empty or contains only whitespace.")
    return api_key

def _get_optional_int(x, default):
    if x is None or str(x).strip() == "":
        return default
    try:
        return int(x)
    except:
        return default

def _get_optional_float(x, default):
    if x is None or str(x).strip() == "":
        return default
    try:
        return float(x)
    except:
        return default

def _try_parse_retry_seconds(err_text):
    if not err_text:
        return None
    m = re.search(r"retryDelay'\s*:\s*'(\d+)s'", err_text)
    if m:
        try:
            return int(m.group(1))
        except:
            pass
    m = re.search(r"Please retry in\s+([0-9]+(\.[0-9]+)?)s", err_text)
    if m:
        try:
            return float(m.group(1))
        except:
            pass
    return None

def _as_path_list(x):
    # Accept: None, string, list, tuple
    if x is None:
        return []
    if isinstance(x, (list, tuple)):
        out = []
        for v in x:
            if v is None:
                continue
            s = str(v).strip()
            if s:
                out.append(s)
        return out
    s = str(x).strip()
    if not s:
        return []
    # allow semicolon or newline separated
    if "\n" in s or ";" in s:
        parts = []
        for p in s.replace(";", "\n").split("\n"):
            p = p.strip()
            if p:
                parts.append(p)
        return parts
    return [s]

def cm_to_m(x_cm):
    return float(x_cm) / 100.0

# ------------------------------------------------------------
# Prompt builder
# ------------------------------------------------------------
def assembly_system_prompt(max_bricks, brick_cm, gap_cm):
    bw, bd, bh = brick_cm
    return (
        "You are a 3D brick assembly generator.\n\n"
        "You must generate a brick assembly based on the user prompt and optional sketch images.\n\n"
        "Brick constraints\n"
        "Max bricks available: {max_bricks}\n"
        "Brick size (cm): width={bw} depth={bd} height={bh}\n"
        "Horizontal gap (cm): {gap_cm}\n"
        "No vertical gap.\n\n"
        "CRITICAL OUTPUT INSTRUCTIONS\n"
        "Your entire output must be only raw JSON.\n"
        "No markdown.\n"
        "No extra text.\n\n"
        "JSON structure\n"
        "Root keys: objectName, material, parts\n"
        "parts is an array of part objects.\n\n"
        "Each part object keys in this exact order\n"
        "id\n"
        "origin\n"
        "dimensions\n"
        "rotation\n"
        "connections\n\n"
        "Coordinate system\n"
        "Ground plane is X Y.\n"
        "Z is up.\n"
        "X is right.\n"
        "Y is back.\n"
        "Global origin 0 0 0 is at the center of the entire assembly base on the ground.\n\n"
        "Rotation\n"
        "rotation is [x,y,z] radians.\n"
        "Use ZYX intrinsic order.\n"
        "For typical brick twisting, use only z rotation and keep x,y at 0 unless needed.\n\n"
        "Units\n"
        "All output numeric values are meters.\n"
        "Convert from cm to meters.\n\n"
        "Spacing rule\n"
        "Model a {gap_cm} cm gap between adjacent bricks on the same layer in X Y.\n"
        "Ensure bricks do not intersect.\n\n"
        "Connections\n"
        "connections lists ids of parts that are physically touching this part.\n"
        "Use symmetric connections.\n\n"
        "Robustness\n"
        "Make ids consecutive starting at 1.\n"
        "Use at most {max_bricks} parts.\n"
        "Use the exact dimensions for every brick.\n"
        "Ensure the lowest z of any brick is z = (brick_height_m / 2).\n"
        "Ensure the base footprint is centered so that the base geometric center is at x=0 y=0.\n"
    ).format(
        max_bricks=int(max_bricks),
        bw=bw, bd=bd, bh=bh,
        gap_cm=float(gap_cm)
    )

# ------------------------------------------------------------
# Validation and normalization
# ------------------------------------------------------------
def _validate_and_fix_assembly(obj, max_bricks, brick_cm):
    if not isinstance(obj, dict):
        raise ValueError("Output is not an object.")

    for k in ["objectName", "material", "parts"]:
        if k not in obj:
            raise ValueError("Missing root key: {}".format(k))

    parts = obj.get("parts", None)
    if not isinstance(parts, list):
        raise ValueError("parts is not a list.")

    if len(parts) > int(max_bricks):
        raise ValueError("Too many parts: {} > {}".format(len(parts), max_bricks))

    bw_m = cm_to_m(brick_cm[0])
    bd_m = cm_to_m(brick_cm[1])
    bh_m = cm_to_m(brick_cm[2])

    # Ensure ids consecutive and fields present
    ids = []
    for p in parts:
        if not isinstance(p, dict):
            raise ValueError("Part is not an object.")
        for k in ["id", "origin", "dimensions", "rotation", "connections"]:
            if k not in p:
                raise ValueError("Part missing key: {}".format(k))
        try:
            pid = int(p["id"])
        except:
            raise ValueError("Invalid id.")
        ids.append(pid)

        dims = p.get("dimensions", [])
        if not (isinstance(dims, list) and len(dims) == 3):
            raise ValueError("Invalid dimensions in part {}".format(pid))

        # Force exact brick dims if slightly off
        try:
            p["dimensions"] = [bw_m, bd_m, bh_m]
        except:
            p["dimensions"] = [bw_m, bd_m, bh_m]

        # sanitize arrays
        if not (isinstance(p["origin"], list) and len(p["origin"]) == 3):
            p["origin"] = [0.0, 0.0, bh_m / 2.0]
        if not (isinstance(p["rotation"], list) and len(p["rotation"]) == 3):
            p["rotation"] = [0.0, 0.0, 0.0]
        if not isinstance(p["connections"], list):
            p["connections"] = []

    ids_sorted = sorted(ids)
    expected = list(range(1, len(parts) + 1))
    if ids_sorted != expected:
        # Reindex parts by current order in array
        old_to_new = {}
        for i, p in enumerate(parts):
            old_to_new[int(p["id"])] = i + 1
            p["id"] = i + 1

        # remap connections
        for p in parts:
            new_conns = []
            for c in p.get("connections", []):
                try:
                    oc = int(c)
                    if oc in old_to_new:
                        nc = old_to_new[oc]
                        if nc != p["id"]:
                            new_conns.append(nc)
                except:
                    pass
            # unique
            p["connections"] = sorted(list(set(new_conns)))

    # enforce symmetric connections
    id_to_part = {int(p["id"]): p for p in parts}
    for p in parts:
        pid = int(p["id"])
        for cid in list(p.get("connections", [])):
            if cid in id_to_part:
                other = id_to_part[cid]
                oc = other.get("connections", [])
                if pid not in oc:
                    oc.append(pid)
                    other["connections"] = sorted(list(set(oc)))

    # normalize base: lowest brick bottom at z=0 and base center at x=0 y=0
    # Assume each brick is axis aligned in Z for height placement
    # bottom_z = origin_z - bh/2
    min_bottom = None
    for p in parts:
        try:
            oz = float(p["origin"][2])
        except:
            oz = bh_m / 2.0
            p["origin"][2] = oz
        bottom = oz - bh_m / 2.0
        if min_bottom is None or bottom < min_bottom:
            min_bottom = bottom
    if min_bottom is None:
        min_bottom = 0.0

    # shift up so min_bottom becomes 0
    dz = -min_bottom
    for p in parts:
        p["origin"][2] = float(p["origin"][2]) + dz

    # find base bricks: those with bottom very close to 0
    eps = 1e-4
    base_pts = []
    for p in parts:
        bottom = float(p["origin"][2]) - bh_m / 2.0
        if abs(bottom - 0.0) < eps:
            base_pts.append([float(p["origin"][0]), float(p["origin"][1])])

    # center by base centroid if possible, else all parts centroid in x y
    if base_pts:
        cx = sum([q[0] for q in base_pts]) / float(len(base_pts))
        cy = sum([q[1] for q in base_pts]) / float(len(base_pts))
    else:
        cx = sum([float(p["origin"][0]) for p in parts]) / float(len(parts))
        cy = sum([float(p["origin"][1]) for p in parts]) / float(len(parts))

    for p in parts:
        p["origin"][0] = float(p["origin"][0]) - cx
        p["origin"][1] = float(p["origin"][1]) - cy

    return obj

# ------------------------------------------------------------
# Gemini call with image support and retries
# ------------------------------------------------------------
def _build_multimodal_contents(system_prompt, user_prompt, image_paths, meta_json_str):
    contents = []
    contents.append("SYSTEM_RULES:\n" + str(system_prompt))
    if user_prompt and str(user_prompt).strip():
        contents.append("USER_PROMPT:\n" + str(user_prompt).strip())
    else:
        contents.append("USER_PROMPT:\nCreate an interesting stable brick assembly.")
    if meta_json_str:
        contents.append("CONSTRAINTS_JSON:\n" + meta_json_str)

    # Attach images
    # Works with google-genai Python client: provide bytes with mime type
    for p in image_paths:
        try:
            if os.path.exists(p):
                ext = os.path.splitext(p)[1].lower()
                mime = "image/png"
                if ext in [".jpg", ".jpeg"]:
                    mime = "image/jpeg"
                elif ext == ".webp":
                    mime = "image/webp"
                elif ext == ".png":
                    mime = "image/png"
                with open(p, "rb") as f:
                    b = f.read()
                contents.append(genai.types.Part.from_bytes(data=b, mime_type=mime))
        except:
            pass

    return contents

def _gemini_generate_assembly_json(client, system_prompt, user_prompt, image_paths, meta_json_str, log_list):
    def _call(extra=None):
        contents = _build_multimodal_contents(system_prompt, user_prompt, image_paths, meta_json_str)
        if extra:
            contents.append(extra)
        config = {"temperature": 0.1, "response_mime_type": "application/json"}
        return client.models.generate_content(model=MODEL_ID, contents=contents, config=config)

    backoff = 2.0
    for attempt in range(1, 4):
        try:
            return _call()
        except Exception as e:
            msg = str(e)
            if "429" in msg or "RESOURCE_EXHAUSTED" in msg:
                wait_s = _try_parse_retry_seconds(msg)
                if wait_s is None:
                    wait_s = backoff
                    backoff = min(backoff * 2.0, 30.0)
                log_list.append("429 rate limit. Waiting {}s then retry {}/3.".format(wait_s, attempt))
                try:
                    time.sleep(float(wait_s))
                except:
                    time.sleep(5.0)
                continue
            raise

    raise ValueError("Failed after repeated 429 retries.")

# ------------------------------------------------------------
# Background worker
# ------------------------------------------------------------
def call_gemini_assembly_in_background(api_key_real, user_prompt, image_paths, object_name, max_bricks, brick_cm, gap_cm, material_name):
    log_list = sc.sticky.get(KEY_LAST_LOG, [])
    if not isinstance(log_list, list):
        log_list = [str(log_list)]

    try:
        client = genai.Client(api_key=api_key_real)

        if not object_name or not str(object_name).strip():
            object_name = "BrickAssembly"

        # Build system prompt
        sp = assembly_system_prompt(max_bricks=max_bricks, brick_cm=brick_cm, gap_cm=gap_cm)

        # Provide a small machine readable constraints blob too
        meta = {
            "objectName": str(object_name),
            "material": str(material_name) if material_name else "Brick",
            "maxBricks": int(max_bricks),
            "brickSizeCm": [float(brick_cm[0]), float(brick_cm[1]), float(brick_cm[2])],
            "gapCm": float(gap_cm)
        }
        meta_json_str = json.dumps(meta, ensure_ascii=False, separators=(",", ":"))

        log_list.append("Calling Gemini for assembly generation.")
        if image_paths:
            log_list.append("Images attached: {}".format(len(image_paths)))

        response = _gemini_generate_assembly_json(
            client=client,
            system_prompt=sp,
            user_prompt=user_prompt,
            image_paths=image_paths,
            meta_json_str=meta_json_str,
            log_list=log_list
        )
        sc.sticky[KEY_POLICY_RAW] = response.text

        cleaned = _strip_code_fences(response.text)

        if not _is_valid_json(cleaned):
            log_list.append("Invalid JSON. Retrying once with stricter instruction.")
            extra = "LAST_INSTRUCTION: Output only raw JSON. Do not add any text."
            response2 = _gemini_generate_assembly_json(
                client=client,
                system_prompt=sp,
                user_prompt=user_prompt,
                image_paths=image_paths,
                meta_json_str=meta_json_str,
                log_list=log_list
            )
            sc.sticky[KEY_POLICY_RAW] = response2.text
            cleaned = _strip_code_fences(response2.text)

        if not _is_valid_json(cleaned):
            raise ValueError("Gemini response was not valid JSON.")

        obj = json.loads(cleaned)

        # Force root naming if missing or wrong types
        if not isinstance(obj, dict):
            raise ValueError("Output JSON root is not an object.")
        obj["objectName"] = str(obj.get("objectName", object_name) or object_name)
        obj["material"] = str(obj.get("material", material_name) or (material_name if material_name else "Brick"))

        fixed = _validate_and_fix_assembly(obj, max_bricks=max_bricks, brick_cm=brick_cm)

        out_str = json.dumps(fixed, ensure_ascii=False, separators=(",", ":"))
        sc.sticky[KEY_RESULT] = out_str
        sc.sticky[KEY_API_ERROR] = None
        log_list.append("Done. Assembly JSON created.")

    except Exception as e:
        sc.sticky[KEY_RESULT] = None
        sc.sticky[KEY_API_ERROR] = "An API or processing error occurred: {}".format(e)
        log_list.append("Failed: {}".format(e))
    finally:
        sc.sticky[KEY_LAST_LOG] = log_list
        sc.sticky[KEY_RUNNING] = False
        Eto.Forms.Application.Instance.AsyncInvoke(trigger_gh_update)

# ------------------------------------------------------------
# Outputs start from persisted values
# ------------------------------------------------------------
jsonOutput = sc.sticky[KEY_LAST_OUTPUT]
error = sc.sticky[KEY_LAST_ERROR]
executionTime = sc.sticky[KEY_LAST_TIME]
log_list = sc.sticky.get(KEY_LAST_LOG, [])
if not isinstance(log_list, list):
    log_list = [str(log_list)]
policyRaw = sc.sticky.get(KEY_POLICY_RAW, "")

# ------------------------------------------------------------
# GH Inputs expected
# run: bool
# keyPath: string
# userPrompt: string
# sketchImagePaths: string OR list (optional)  path or paths
#
# optional
# objectName: string
# materialName: string default "Brick"
# maxBricks: int default 24
# brickWidthCm: float default 24
# brickDepthCm: float default 11.5
# brickHeightCm: float default 4.5
# gapCm: float default 3
# ------------------------------------------------------------

prev_run = sc.sticky.get(KEY_LAST_RUN_EDGE, False)
sc.sticky[KEY_LAST_RUN_EDGE] = bool(run)

if (run and not prev_run) and not sc.sticky[KEY_RUNNING]:
    sc.sticky[KEY_RUNNING] = True
    sc.sticky[KEY_RESULT] = None
    sc.sticky[KEY_API_ERROR] = None
    sc.sticky[KEY_START_TIME] = time.time()

    jsonOutput = "Generating assembly JSON."
    error = None
    executionTime = None

    log_list = []
    log_list.append("Run triggered. Starting setup.")

    try:
        api_key_real = load_api_key_from_path(keyPath)
        log_list.append("API key loaded.")

        mb = _get_optional_int(locals().get("maxBricks", None), 24)
        bw = _get_optional_float(locals().get("brickWidthCm", None), 24.0)
        bd = _get_optional_float(locals().get("brickDepthCm", None), 11.5)
        bh = _get_optional_float(locals().get("brickHeightCm", None), 4.5)
        gap = _get_optional_float(locals().get("gapCm", None), 3.0)

        oname = locals().get("objectName", None)
        mname = locals().get("materialName", None)
        if not mname or not str(mname).strip():
            mname = "Brick"

        up = locals().get("userPrompt", "")
        img_in = locals().get("sketchImagePaths", None)
        img_paths = _as_path_list(img_in)

        # Filter invalid paths early
        img_paths_valid = []
        for p in img_paths:
            if os.path.exists(p):
                img_paths_valid.append(p)
            else:
                log_list.append("Image path not found: {}".format(p))
        img_paths = img_paths_valid

        log_list.append("Starting background thread call for assembly generation.")
        t = threading.Thread(
            target=call_gemini_assembly_in_background,
            args=(api_key_real, up, img_paths, oname, mb, [bw, bd, bh], gap, mname)
        )
        t.daemon = True
        t.start()

    except Exception as setup_e:
        error = "Error during setup: {}".format(setup_e)
        jsonOutput = "Setup error. See error output."
        sc.sticky[KEY_RUNNING] = False
        log_list.append("Setup failed: {}".format(setup_e))

    sc.sticky[KEY_LAST_LOG] = log_list

# Publish result once
if sc.sticky.get(KEY_RESULT) is not None:
    generated_text = sc.sticky[KEY_RESULT]
    cleaned = _strip_code_fences(generated_text)

    jsonOutput = cleaned
    error = None

    start_time = sc.sticky.get(KEY_START_TIME, time.time())
    executionTime = time.time() - start_time
    log_list.append("Result published to output.")

    sc.sticky[KEY_RESULT] = None
    sc.sticky[KEY_API_ERROR] = None

elif sc.sticky.get(KEY_API_ERROR) is not None:
    jsonOutput = "An error occurred. See error output."
    error = sc.sticky[KEY_API_ERROR]

    start_time = sc.sticky.get(KEY_START_TIME, time.time())
    executionTime = time.time() - start_time
    log_list.append("Error published to output.")

    sc.sticky[KEY_API_ERROR] = None

# Persist outputs
sc.sticky[KEY_LAST_OUTPUT] = jsonOutput
sc.sticky[KEY_LAST_ERROR] = error
sc.sticky[KEY_LAST_TIME] = executionTime
sc.sticky[KEY_LAST_LOG] = log_list

# GH outputs
assemblyJson = jsonOutput
log = "\n".join([str(x) for x in log_list])
policyDebug = policyRaw
# ---------- end ai_assembly_generation ----------
# ----
# Test the Connection by writing a Poem
run = Button()
connection_test_to_vlm = Python3Script(keyPath=path_3.DATA, run=run)  # -> log, haiku; inputs keyPath: String
# ---------- connection_test_to_vlm: Python ----------
# r: google-generativeai
import google.generativeai as genai
import time
import os
import scriptcontext as sc

KEY_TEXT = "gemini_last_text"
KEY_LOG = "gemini_last_log"
KEY_ERR = "gemini_last_error"
KEY_TIME = "gemini_last_time"

if KEY_TEXT not in sc.sticky:
    sc.sticky[KEY_TEXT] = ""
if KEY_LOG not in sc.sticky:
    sc.sticky[KEY_LOG] = []
if KEY_ERR not in sc.sticky:
    sc.sticky[KEY_ERR] = None
if KEY_TIME not in sc.sticky:
    sc.sticky[KEY_TIME] = None

# Read stored values first so outputs always show something
haiku = sc.sticky.get(KEY_TEXT, "")
log_list = sc.sticky.get(KEY_LOG, [])
error = sc.sticky.get(KEY_ERR, None)
executionTime = sc.sticky.get(KEY_TIME, None)

if not isinstance(log_list, list):
    log_list = [str(log_list)]

def _sanitize_key(raw):
    if raw is None:
        return ""
    k = raw

    # Remove UTF-8 BOM if present
    if len(k) > 0 and ord(k[0]) == 65279:
        k = k[1:]

    k = k.strip()

    # Remove wrapping quotes if file contains "AIza..." or 'AIza...'
    if (k.startswith('"') and k.endswith('"')) or (k.startswith("'") and k.endswith("'")):
        k = k[1:-1].strip()

    # If multiple lines, take first non-empty line
    if "\n" in k or "\r" in k:
        parts = [p.strip() for p in k.replace("\r", "\n").split("\n") if p.strip()]
        k = parts[0] if parts else ""

    return k.strip()

def mask_key(k):
    if not k:
        return ""
    if len(k) <= 8:
        return "*" * len(k)
    return k[:4] + "..." + k[-4:]

if run:
    startTime = time.time()
    log_list = []
    error = None
    executionTime = None

    log_list.append("Starting Gemini API connection test...")

    try:
        if not keyPath or not str(keyPath).strip():
            raise Exception("keyPath input is missing.")

        kp = str(keyPath).strip()
        log_list.append("Loading API key from: {}".format(kp))

        if not os.path.exists(kp):
            raise Exception("API key file not found at given path: {}".format(kp))

        with open(kp, "r") as file:
            raw = file.read()

        apiKey = _sanitize_key(raw)
        if not apiKey:
            log_list.append("API key file is empty or contains only whitespace.")

        log_list.append("API key loaded successfully.")
        log_list.append("API key preview: {}".format(mask_key(apiKey)))

        genai.configure(api_key=apiKey)
        log_list.append("API configured.")

        model = genai.GenerativeModel("gemini-2.5-flash-lite")
        log_list.append("Model initialized: gemini-2.5-flash-lite")

        prompt = "Write a haiku from the perspective of a robot."
        log_list.append('Sending prompt: "{}"'.format(prompt))

        response = model.generate_content(prompt)
        textOut = response.text or ""

        log_list.append("SUCCESS! Connection established.")
        log_list.append("Text received.")

    except Exception as e:
        error = "FAILED! Error: {}".format(e)
        log_list.append(error)

    executionTime = time.time() - startTime
    log_list.append("Execution finished in {:.3f}s".format(executionTime))

    # Store results so they remain after the button returns to False
    sc.sticky[KEY_TEXT] = textOut
    sc.sticky[KEY_LOG] = log_list
    sc.sticky[KEY_ERR] = error
    sc.sticky[KEY_TIME] = executionTime

# Output values every run
log = "\n".join(log_list)

# Suggested GH outputs:
# textOut -> panel
# error -> panel
# executionTime -> panel
# log -> panel
# ---------- end connection_test_to_vlm ----------
panel_15 = Panel(connection_test_to_vlm.log)
panel_16 = Panel(connection_test_to_vlm.haiku)

error = Panel(ai_assembly_generation.error)
jsonoutput = Panel(ai_assembly_generation.assemblyJson)
executiontime = Panel(ai_assembly_generation.executionTime)
log = Panel(ai_assembly_generation.log)
model = Panel(ai_assembly_generation.MODEL_ID)

# ----
# JSON Examples by Gemini
column_windmill = Panel("""{
"objectName": "Hollow Brick Column Updated",
"material": "brick",
"parts": [
{
"id": 1,
"origin": [-0.0725, 0.135, 0.0225],
"dimensions": [0.24, 0.115, 0.045],
"rotation": [0.0, 0.0, 0.0],
"connections": [2, 4, 5, 8]
},
{
"id": 2,
"origin": [0.135, 0.0725, 0.0225],
"dimensions": [0.24, 0.115, 0.045],
"rotation": [0.0, 0.0, 1.5708],
"connections": [3, 1, 5, 6]
},
{
"id": 3,
"origin": [0.0725, -0.135, 0.0225],
"dimensions": [0.24, 0.115, 0.045],
"rotation": [0.0, 0.0, 0.0],
"connections": [4, 2, 6, 7]
},
{
"id": 4,
"origin": [-0.135, -0.0725, 0.0225],
"dimensions": [0.24, 0.115, 0.045],
"rotation": [0.0, 0.0, 1.5708],
"connections": [1, 3, 7, 8]
},
{
"id": 5,
"origin": [0.0725, 0.135, 0.0675],
"dimensions": [0.24, 0.115, 0.045],
"rotation": [0.0, 0.0, 0.0],
"connections": [6, 8, 1, 2, 9, 10]
},
{
"id": 6,
"origin": [0.135, -0.0725, 0.0675],
"dimensions": [0.24, 0.115, 0.045],
"rotation": [0.0, 0.0, 1.5708],
"connections": [7, 5, 2, 3, 10, 11]
},
{
"id": 7,
"origin": [-0.0725, -0.135, 0.0675],
"dimensions": [0.24, 0.115, 0.045],
"rotation": [0.0, 0.0, 0.0],
"connections": [8, 6, 3, 4, 11, 12]
},
{
"id": 8,
"origin": [-0.135, 0.0725, 0.0675],
"dimensions": [0.24, 0.115, 0.045],
"rotation": [0.0, 0.0, 1.5708],
"connections": [5, 7, 4, 1, 12, 9]
},
{
"id": 9,
"origin": [-0.0725, 0.135, 0.1125],
"dimensions": [0.24, 0.115, 0.045],
"rotation": [0.0, 0.0, 0.0],
"connections": [10, 12, 5, 8, 13, 16]
},
{
"id": 10,
"origin": [0.135, 0.0725, 0.1125],
"dimensions": [0.24, 0.115, 0.045],
"rotation": [0.0, 0.0, 1.5708],
"connections": [11, 9, 5, 6, 13, 14]
},
{
"id": 11,
"origin": [0.0725, -0.135, 0.1125],
"dimensions": [0.24, 0.115, 0.045],
"rotation": [0.0, 0.0, 0.0],
"connections": [12, 10, 6, 7, 14, 15]
},
{
"id": 12,
"origin": [-0.135, -0.0725, 0.1125],
"dimensions": [0.24, 0.115, 0.045],
"rotation": [0.0, 0.0, 1.5708],
"connections": [9, 11, 7, 8, 15, 16]
},
{
"id": 13,
"origin": [0.0725, 0.135, 0.1575],
"dimensions": [0.24, 0.115, 0.045],
"rotation": [0.0, 0.0, 0.0],
"connections": [14, 16, 9, 10, 17, 18]
},
{
"id": 14,
"origin": [0.135, -0.0725, 0.1575],
"dimensions": [0.24, 0.115, 0.045],
"rotation": [0.0, 0.0, 1.5708],
"connections": [15, 13, 10, 11, 18, 19]
},
{
"id": 15,
"origin": [-0.0725, -0.135, 0.1575],
"dimensions": [0.24, 0.115, 0.045],
"rotation": [0.0, 0.0, 0.0],
"connections": [16, 14, 11, 12, 19, 20]
},
{
"id": 16,
"origin": [-0.135, 0.0725, 0.1575],
"dimensions": [0.24, 0.115, 0.045],
"rotation": [0.0, 0.0, 1.5708],
"connections": [13, 15, 12, 9, 20, 17]
},
{
"id": 17,
"origin": [-0.0725, 0.135, 0.2025],
"dimensions": [0.24, 0.115, 0.045],
"rotation": [0.0, 0.0, 0.0],
"connections": [18, 20, 13, 16, 21, 24]
},
{
"id": 18,
"origin": [0.135, 0.0725, 0.2025],
"dimensions": [0.24, 0.115, 0.045],
"rotation": [0.0, 0.0, 1.5708],
"connections": [19, 17, 13, 14, 21, 22]
},
{
"id": 19,
"origin": [0.0725, -0.135, 0.2025],
"dimensions": [0.24, 0.115, 0.045],
"rotation": [0.0, 0.0, 0.0],
"connections": [20, 18, 14, 15, 22, 23]
},
{
"id": 20,
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""")
column_circle = Panel("""{
"objectName": "Art Deco Star Column Fixed Updated",
"material": "brick",
"parts": [
{
"id": 1,
"origin": [0.0, 0.2075, 0.0225],
"dimensions": [0.24, 0.115, 0.045],
"rotation": [0.0, 0.0, 0.0],
"connections": [2, 4, 5, 8]
},
{
"id": 2,
"origin": [0.2075, 0.0, 0.0225],
"dimensions": [0.24, 0.115, 0.045],
"rotation": [0.0, 0.0, 1.5708],
"connections": [1, 3, 5, 6]
},
{
"id": 3,
"origin": [0.0, -0.2075, 0.0225],
"dimensions": [0.24, 0.115, 0.045],
"rotation": [0.0, 0.0, 0.0],
"connections": [2, 4, 6, 7]
},
{
"id": 4,
"origin": [-0.2075, 0.0, 0.0225],
"dimensions": [0.24, 0.115, 0.045],
"rotation": [0.0, 0.0, 1.5708],
"connections": [3, 1, 7, 8]
},
{
"id": 5,
"origin": [0.1467, 0.1467, 0.0675],
"dimensions": [0.24, 0.115, 0.045],
"rotation": [0.0, 0.0, 2.3562],
"connections": [1, 2, 6, 8, 9, 10]
},
{
"id": 6,
"origin": [0.1467, -0.1467, 0.0675],
"dimensions": [0.24, 0.115, 0.045],
"rotation": [0.0, 0.0, 0.7854],
"connections": [2, 3, 5, 7, 10, 11]
},
{
"id": 7,
"origin": [-0.1467, -0.1467, 0.0675],
"dimensions": [0.24, 0.115, 0.045],
"rotation": [0.0, 0.0, 2.3562],
"connections": [3, 4, 6, 8, 11, 12]
},
{
"id": 8,
"origin": [-0.1467, 0.1467, 0.0675],
"dimensions": [0.24, 0.115, 0.045],
"rotation": [0.0, 0.0, 0.7854],
"connections": [4, 1, 7, 5, 12, 9]
},
{
"id": 9,
"origin": [0.0, 0.2075, 0.1125],
"dimensions": [0.24, 0.115, 0.045],
"rotation": [0.0, 0.0, 0.0],
"connections": [5, 8, 10, 12, 13, 16]
},
{
"id": 10,
"origin": [0.2075, 0.0, 0.1125],
"dimensions": [0.24, 0.115, 0.045],
"rotation": [0.0, 0.0, 1.5708],
"connections": [5, 6, 9, 11, 13, 14]
},
{
"id": 11,
"origin": [0.0, -0.2075, 0.1125],
"dimensions": [0.24, 0.115, 0.045],
"rotation": [0.0, 0.0, 0.0],
"connections": [6, 7, 10, 12, 14, 15]
},
{
"id": 12,
"origin": [-0.2075, 0.0, 0.1125],
"dimensions": [0.24, 0.115, 0.045],
"rotation": [0.0, 0.0, 1.5708],
"connections": [7, 8, 11, 9, 15, 16]
},
{
"id": 13,
"origin": [0.1467, 0.1467, 0.1575],
"dimensions": [0.24, 0.115, 0.045],
"rotation": [0.0, 0.0, 2.3562],
"connections": [9, 10, 14, 16, 17, 18]
},
{
"id": 14,
"origin": [0.1467, -0.1467, 0.1575],
"dimensions": [0.24, 0.115, 0.045],
"rotation": [0.0, 0.0, 0.7854],
"connections": [10, 11, 13, 15, 18, 19]
},
{
"id": 15,
"origin": [-0.1467, -0.1467, 0.1575],
"dimensions": [0.24, 0.115, 0.045],
"rotation": [0.0, 0.0, 2.3562],
"connections": [11, 12, 14, 16, 19, 20]
},
{
"id": 16,
"origin": [-0.1467, 0.1467, 0.1575],
"dimensions": [0.24, 0.115, 0.045],
"rotation": [0.0, 0.0, 0.7854],
"connections": [12, 9, 15, 13, 20, 17]
},
{
"id": 17,
"origin": [0.0, 0.2075, 0.2025],
"dimensions": [0.24, 0.115, 0.045],
"rotation": [0.0, 0.0, 0.0],
"connections": [13, 16, 18, 20, 21, 24]
},
{
"id": 18,
"origin": [0.2075, 0.0, 0.2025],
"dimensions": [0.24, 0.115, 0.045],
"rotation": [0.0, 0.0, 1.5708],
"connections": [13, 14, 17, 19, 21, 22]
},
{
"id": 19,
"origin": [0.0, -0.2075, 0.2025],
"dimensions": [0.24, 0.115, 0.045],
"rotation": [0.0, 0.0, 0.0],
"connections": [14, 15, 18, 20, 22, 23]
},
{
"id": 20,
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""")
column_twisted = Panel("""{
"objectName": "TwistedAlternatingParametricColumn_NoGap_Updated",
"material": "Brick",
"parts": [
{"id": 1, "origin": [0.0, -0.0725, 0.0225], "dimensions": [0.24, 0.115, 0.045], "rotation": [0.0, 0.0, 0.0], "connections": [2, 3, 4]},
{"id": 2, "origin": [0.0, 0.0725, 0.0225], "dimensions": [0.24, 0.115, 0.045], "rotation": [0.0, 0.0, 0.0], "connections": [1, 3, 4]},
{"id": 3, "origin": [0.0714, 0.0126, 0.0675], "dimensions": [0.24, 0.115, 0.045], "rotation": [0.0, 0.0, 1.7453], "connections": [4, 1, 2, 5, 6]},
{"id": 4, "origin": [-0.0714, -0.0126, 0.0675], "dimensions": [0.24, 0.115, 0.045], "rotation": [0.0, 0.0, 1.7453], "connections": [3, 1, 2, 5, 6]},
{"id": 5, "origin": [0.0248, -0.0681, 0.1125], "dimensions": [0.24, 0.115, 0.045], "rotation": [0.0, 0.0, 0.3491], "connections": [6, 3, 4, 7, 8]},
{"id": 6, "origin": [-0.0248, 0.0681, 0.1125], "dimensions": [0.24, 0.115, 0.045], "rotation": [0.0, 0.0, 0.3491], "connections": [5, 3, 4, 7, 8]},
{"id": 7, "origin": [0.0628, 0.0363, 0.1575], "dimensions": [0.24, 0.115, 0.045], "rotation": [0.0, 0.0, 2.0944], "connections": [8, 5, 6, 9, 10]},
{"id": 8, "origin": [-0.0628, -0.0363, 0.1575], "dimensions": [0.24, 0.115, 0.045], "rotation": [0.0, 0.0, 2.0944], "connections": [7, 5, 6, 9, 10]},
{"id": 9, "origin": [0.0466, -0.0555, 0.2025], "dimensions": [0.24, 0.115, 0.045], "rotation": [0.0, 0.0, 0.6981], "connections": [10, 7, 8, 11, 12]},
{"id": 10, "origin": [-0.0466, 0.0555, 0.2025], "dimensions": [0.24, 0.115, 0.045], "rotation": [0.0, 0.0, 0.6981], "connections": [9, 7, 8, 11, 12]},
{"id": 11, "origin": [0.0466, 0.0555, 0.2475], "dimensions": [0.24, 0.115, 0.045], "rotation": [0.0, 0.0, 2.4435], "connections": [12, 9, 10, 13, 14]},
{"id": 12, "origin": [-0.0466, -0.0555, 0.2475], "dimensions": [0.24, 0.115, 0.045], "rotation": [0.0, 0.0, 2.4435], "connections": [11, 9, 10, 13, 14]},
{"id": 13, "origin": [0.0628, -0.0363, 0.2925], "dimensions": [0.24, 0.115, 0.045], "rotation": [0.0, 0.0, 1.0472], "connections": [14, 11, 12, 15, 16]},
{"id": 14, "origin": [-0.0628, 0.0363, 0.2925], "dimensions": [0.24, 0.115, 0.045], "rotation": [0.0, 0.0, 1.0472], "connections": [13, 11, 12, 15, 16]},
{"id": 15, "origin": [0.0248, 0.0681, 0.3375], "dimensions": [0.24, 0.115, 0.045], "rotation": [0.0, 0.0, 2.7925], "connections": [16, 13, 14, 17, 18]},
{"id": 16, "origin": [-0.0248, -0.0681, 0.3375], "dimensions": [0.24, 0.115, 0.045], "rotation": [0.0, 0.0, 2.7925], "connections": [15, 13, 14, 17, 18]},
{"id": 17, "origin": [0.0714, -0.0126, 0.3825], "dimensions": [0.24, 0.115, 0.045], "rotation": [0.0, 0.0, 1.3963], "connections": [18, 15, 16, 19, 20]},
{"id": 18, "origin": [-0.0714, 0.0126, 0.3825], "dimensions": [0.24, 0.115, 0.045], "rotation": [0.0, 0.0, 1.3963], "connections": [17, 15, 16, 19, 20]},
{"id": 19, "origin": [0.0, 0.0725, 0.4275], "dimensions": [0.24, 0.115, 0.045], "rotation": [0.0, 0.0, 3.1416], "connections": [20, 17, 18, 21, 22]},
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""")

# ----
# JSON CONVERTER
json_to_assembly = Python3Script(JSON_or_FilePath=jsonoutput)  # -> log, assembly, preview
# ---------- json_to_assembly: Python ----------
import Rhino.Geometry as rg
import json
import os
import math

from assembly_information_model import Part, Assembly
from compas.geometry import Point, Frame, Box
from compas.datastructures import Mesh


def _mat_mul(A, B):
    return [
        [
            A[0][0]*B[0][c] + A[0][1]*B[1][c] + A[0][2]*B[2][c]
            for c in range(3)
        ],
        [
            A[1][0]*B[0][c] + A[1][1]*B[1][c] + A[1][2]*B[2][c]
            for c in range(3)
        ],
        [
            A[2][0]*B[0][c] + A[2][1]*B[1][c] + A[2][2]*B[2][c]
            for c in range(3)
        ],
    ]


def _mat_vec(M, v):
    return [
        M[0][0]*v[0] + M[0][1]*v[1] + M[0][2]*v[2],
        M[1][0]*v[0] + M[1][1]*v[1] + M[1][2]*v[2],
        M[2][0]*v[0] + M[2][1]*v[1] + M[2][2]*v[2],
    ]


def _normalize(v):
    l = math.sqrt(v[0]*v[0] + v[1]*v[1] + v[2]*v[2])
    if l == 0:
        return [1.0, 0.0, 0.0]
    return [v[0]/l, v[1]/l, v[2]/l]


def frame_from_origin_rotation(origin_xyz, rotation_xyz):
    x, y, z = origin_xyz[0], origin_xyz[1], origin_xyz[2]
    rx = rotation_xyz[0] if rotation_xyz and len(rotation_xyz) > 0 else 0.0
    ry = rotation_xyz[1] if rotation_xyz and len(rotation_xyz) > 1 else 0.0
    rz = rotation_xyz[2] if rotation_xyz and len(rotation_xyz) > 2 else 0.0

    cx, sx = math.cos(rx), math.sin(rx)
    cy, sy = math.cos(ry), math.sin(ry)
    cz, sz = math.cos(rz), math.sin(rz)

    Rx = [
        [1.0, 0.0, 0.0],
        [0.0, cx, -sx],
        [0.0, sx, cx],
    ]
    Ry = [
        [cy, 0.0, sy],
        [0.0, 1.0, 0.0],
        [-sy, 0.0, cy],
    ]
    Rz = [
        [cz, -sz, 0.0],
        [sz, cz, 0.0],
        [0.0, 0.0, 1.0],
    ]

    # Apply rotations in X then Y then Z order
    R = _mat_mul(Rz, _mat_mul(Ry, Rx))

    xaxis = _normalize(_mat_vec(R, [1.0, 0.0, 0.0]))
    yaxis = _normalize(_mat_vec(R, [0.0, 1.0, 0.0]))

    origin = Point(x, y, z)
    return Frame(origin, xaxis, yaxis)


def make_local_shape_and_placement(p_data):
    origin_xyz = p_data.get("origin", [0.0, 0.0, 0.0])
    rot_xyz = p_data.get("rotation", [0.0, 0.0, 0.0])
    dims = p_data.get("dimensions", [0.1, 0.1, 0.1])

    placement = frame_from_origin_rotation(origin_xyz, rot_xyz)

    # local shape centered at origin
    local_frame = Frame(Point(0, 0, 0), [1, 0, 0], [0, 1, 0])
    shape = Box(dims[0], dims[1], dims[2], frame=local_frame)

    return shape, placement, origin_xyz, rot_xyz, dims


def compas_mesh_from_local_box(local_box):
    pts = local_box.points
    vertices = [[p.x, p.y, p.z] for p in pts]
    faces = [
        [0, 1, 3, 2],
        [4, 5, 7, 6],
        [0, 1, 5, 4],
        [1, 3, 7, 5],
        [3, 2, 6, 7],
        [2, 0, 4, 6],
    ]
    return Mesh.from_vertices_and_faces(vertices, faces)


def rhino_brep_from_placement(placement, dims):
    o = placement.point
    x = placement.xaxis
    y = placement.yaxis

    plane = rg.Plane(
        rg.Point3d(o.x, o.y, o.z),
        rg.Vector3d(x[0], x[1], x[2]),
        rg.Vector3d(y[0], y[1], y[2])
    )

    dx, dy, dz = dims[0], dims[1], dims[2]
    ix = rg.Interval(-dx * 0.5, dx * 0.5)
    iy = rg.Interval(-dy * 0.5, dy * 0.5)
    iz = rg.Interval(-dz * 0.5, dz * 0.5)

    return rg.Box(plane, ix, iy, iz).ToBrep()


def add_connection_by_key_best_effort(assembly_obj, u_key, v_key):
    if u_key is None or v_key is None:
        return False
    if hasattr(assembly_obj, "graph") and hasattr(assembly_obj.graph, "add_edge"):
        try:
            assembly_obj.graph.add_edge(u_key, v_key)
            return True
        except Exception:
            pass
    if hasattr(assembly_obj, "add_connection"):
        try:
            assembly_obj.add_connection(u_key, v_key)
            return True
        except Exception:
            pass
    if hasattr(assembly_obj, "add_edge"):
        try:
            assembly_obj.add_edge(u_key, v_key)
            return True
        except Exception:
            pass
    return False


assembly = None
parts = []
preview = []
log = ""
log_lines = []

if "JSON_or_FilePath" in globals() and JSON_or_FilePath:
    try:
        input_str = str(JSON_or_FilePath).strip()
        if os.path.exists(input_str):
            with open(input_str, "r") as f:
                data = json.load(f)
            log_lines.append("Read JSON from file path.")
        else:
            data = json.loads(input_str)
            log_lines.append("Read JSON from input string.")

        assembly = Assembly()
        try:
            assembly.name = data.get("objectName", "Assembly")
        except Exception:
            pass

        id_to_key = {}
        parts_data = data.get("parts", [])

        for p_data in parts_data:
            pid = p_data.get("id", None)
            if pid is None:
                continue

            shape, placement, origin_xyz, rot_xyz, dims = make_local_shape_and_placement(p_data)

            part = Part()
            try:
                part.name = str(pid)
            except Exception:
                pass

            try:
                part.shape = shape
            except Exception:
                pass

            try:
                part.frame = placement
            except Exception:
                pass

            try:
                part.mesh = compas_mesh_from_local_box(shape)
            except Exception:
                pass

            try:
                part.attributes["source_id"] = pid
                part.attributes["origin"] = origin_xyz
                part.attributes["rotation"] = rot_xyz
                part.attributes["dimensions"] = dims
            except Exception:
                pass

            key = None
            try:
                key = assembly.add_part(part)
            except Exception:
                assembly.add_part(part)

            if key is None:
                try:
                    key = assembly.part_keys()[-1]
                except Exception:
                    key = len(parts)

            id_to_key[pid] = key
            parts.append(part)

            brep = rhino_brep_from_placement(placement, dims)
            if brep:
                preview.append(brep)

        connection_count = 0
        for p_data in parts_data:
            u_id = p_data.get("id", None)
            if u_id is None or u_id not in id_to_key:
                continue
            u_key = id_to_key[u_id]
            for v_id in p_data.get("connections", []):
                if v_id not in id_to_key:
                    continue
                v_key = id_to_key[v_id]
                if add_connection_by_key_best_effort(assembly, u_key, v_key):
                    connection_count += 1

        if hasattr(assembly, "graph") and hasattr(assembly.graph, "node_attribute"):
            for pid, key in id_to_key.items():
                try:
                    assembly.graph.node_attribute(key, "damages", [])
                except Exception:
                    pass
                try:
                    assembly.graph.node_attribute(key, "image_paths", [])
                except Exception:
                    pass

        log_lines.append("Parts created: {}".format(len(parts)))
        log_lines.append("Connections attempted: {}".format(connection_count))
        log_lines.append("Preview breps: {}".format(len(preview)))

    except Exception as e:
        import traceback
        log_lines.append("Error: {}".format(e))
        log_lines.append(traceback.format_exc())
else:
    log_lines.append("No JSON_or_FilePath input connected.")

log = "\n".join(log_lines)
# ---------- end json_to_assembly ----------
panel_17 = Panel(json_to_assembly.log)

# ----
# Export to JSON
# Rhino Visualization of a JSON Assembly + Damages
# (With Rotations!)
# Gemini sometimes messes
# up the rotations. You may
# have to switch to inverted
# rotations...
# Assembly Model Generation with Gemini
# (Without Rotations!)
export = Button()
path_4 = Python3Script()  # -> out, DATA
# ---------- path_4: Python ----------
import os
import getpass

username = getpass.getuser()
USER_FOLDER = os.path.abspath(os.path.join("C:/Users/", username))
DATA = os.path.abspath(os.path.join(USER_FOLDER,"workspace/projects/workshop_iaac_2026/data/assembly"))

print(USER_FOLDER)
print(DATA)
# ---------- end path_4 ----------
export_2 = Python3Script(DATA=path_4.DATA, assembly=json_to_assembly.assembly, export=export)  # -> out
# ---------- export_2: Python ----------
import os

if export:
    
    filename = "circle_column.json"
    PATH = os.path.join(DATA, filename)
    
    # the assembly has to be serialized such that it can be called from CPython
    assembly.to_json(PATH)
# ---------- end export_2 ----------

value_list_2 = ValueList({"20", "50", "100", "500", "1000", "5000"}, selected="500")
reset = Button()
back = Button()
start = Button()
stop = Button()
step = Button()
full = Button()
counter = Python3Script(
    my_assembly=json_to_assembly.assembly,
    start=start,
    stop=stop,
    step=step,
    step_back=back,
    reset=reset,
    full=full,
    interval=value_list_2)  # -> out, counter
# ---------- counter: Python ----------
from scriptcontext import sticky as st
import Grasshopper

def update_component(ghenv, delay):
    """Schedule an update of the Grasshopper component.

    After the specified delay, the GH component will be automatically updated.

    Parameters
    ----------
    ghenv : :class:`GhPython.Component.PythonEnvironment`
        The current GHPython environment.
    delay : :obj:`int`
        Time in milliseconds until the update is performed.

    Raises
    ------
    ValueError
        If the delay is less than zero.

    """
    if delay <= 0:
        raise ValueError("Delay must be greater than zero")

    ghcomp = ghenv.Component
    ghdoc = ghcomp.OnPingDocument()

    def callback(ghdoc):
        if ghdoc.SolutionState != Grasshopper.Kernel.GH_ProcessStep.Process:
            ghcomp.ExpireSolution(False)

    ghdoc.ScheduleSolution(delay, Grasshopper.Kernel.GH_Document.GH_ScheduleDelegate(callback))

L = range(my_assembly.graph.number_of_nodes())

# store data in component
guid = str(ghenv.Component.InstanceGuid)
counter_key = "counter_" + guid
running_key = "running_" + guid

if counter_key not in st:
    st[counter_key] = 0

if running_key not in st:
    st[running_key] = False
    

if st[running_key]:
    if st[counter_key] < len(L) - 1:
        st[counter_key] += 1
        update_component(ghenv, interval)
    else:
        st[counter_key] = 0
        st[running_key] = False
    
if start:
    st[running_key] = True

if stop:
    st[running_key] = False

if step:
    if st[counter_key] < len(L) - 1:
        st[counter_key] += 1

if step_back:
    if st[counter_key] > 0:
        st[counter_key] -= 1

if reset:
    st[counter_key] = 0
    st[running_key] = False

if full:
    st[counter_key] = len(L)-1

if len(L):
    item = L[st[counter_key]]


#st["visualisation_counter"] = st[counter_key]
counter = st[counter_key]
# ---------- end counter ----------
panel_18 = Panel(counter.counter)

# ----
# Assembly Visualisation
value_list_3 = ValueList({"show all": "show_all", "show until key": "show_until_key"}, selected="show until key")
visualize = Python3Script(assembly=json_to_assembly.assembly, show=value_list_3, counter=counter.counter)  # -> out, parts, parts_frame, parts_keys, current_part_vertices, current_part_vertex_points, current_part, current_part_frame, current_key
# ---------- visualize: Python ----------
from compas_rhino.conversions import mesh_to_rhino, sphere_to_rhino, box_to_rhino, frame_to_rhino, line_to_rhino, point_to_rhino, box_to_rhino
from compas.geometry import Line, Transformation, Point, Vector, Frame, Sphere, Translation

#print assembly
print(assembly)

parts_keys = list(assembly.graph.nodes())
parts = []
parts_all = []
parts_built = []
parts_not_built = []
parts_frame = []
damages = []
current_key = counter

current_p = assembly.part(current_key)
current_p_frame = current_p.frame
T = Transformation.from_frame(current_p_frame)
current_part = box_to_rhino(current_p.shape.transformed(T))
current_part_frame = frame_to_rhino(current_p_frame)
current_part_vertices = list(current_p.mesh.vertices())
current_part_vertex_points = [
    point_to_rhino(current_p.mesh.vertex_point(v).transformed(T)) 
    for v in current_part_vertices
]

if show == "show_all":
    for key in parts_keys:
        p = assembly.part(key)
        p_frame = p.frame
        parts.append(box_to_rhino(p.shape.transformed(Transformation.from_frame((p_frame)))))
        parts_frame.append(frame_to_rhino(p_frame))

# Show until key in-place (no layout translation)
if show == "show_until_key":
    for key in parts_keys[0:counter + 1]:
        if key == current_key:
            continue
        p = assembly.part(key)
        p_frame = p.frame
        parts.append(box_to_rhino(p.shape.transformed(Transformation.from_frame(p_frame))))
        parts_frame.append(frame_to_rhino(p_frame))
# ---------- end visualize ----------
geometry = Geometry(visualize.current_part)
geometry_2 = Geometry(visualize.parts)
geometry_3 = Geometry(visualize.parts_frame)
panel_19 = Panel(visualize.out)
vertex = Slider(0, range=0..10)
custom_preview = CustomPreview(Geometry=geometry_2, Material=ColourSwatch(SwatchColor=RGBA(255, 138, 138, 137)))
custom_preview_2 = CustomPreview(Geometry=geometry, Material=ColourSwatch(SwatchColor=RGBA(252, 83, 83, 216)))
text_tag = TextTag(Location=visualize.current_part_frame, Text=visualize.current_key)
python_3_script = Python3Script(planes=visualize.current_part_frame, scale=Slider(0.2, range=0..1))  # -> P, V, C, W; inputs planes: list of Plane, scale: Double
# ---------- python_3_script: Python ----------
from Rhino.Display import ColorRGBA
from ghpythonlib.components import ColourRGBf


red = ColourRGBf(255, 255, 0, 0)
green = ColourRGBf(255, 0, 255, 0)
blue = ColourRGBf(255, 0, 0, 255)

P = []
V = []
C = []

# scale = float(scale)

for plane in planes:
    if not plane:
        continue
    P += [plane.Origin] * 3
    V.append(plane.XAxis * scale)
    V.append(plane.YAxis * scale)
    V.append(plane.ZAxis * scale)
    C += [red, green, blue]

W = 3
# ---------- end python_3_script ----------
list_item = ListItem(List=visualize.current_part_vertex_points, Index=vertex, Wrap=True)
panel_20 = Panel(list_item)
vector_display_ex = VectorDisplayEx(Point=python_3_script.P, Vector=python_3_script.V, Colour=python_3_script.C, Width=python_3_script.W)
text_tag_2 = TextTag(Location=visualize.current_part_vertex_points, Text=visualize.current_part_vertices)

# ----
# You have max. 50 bricks of the size 24x11,5x5,2 available.
# Create a hollow column with interesting brick pattern as JSON.
# You are an expert 3D modeler and data architect specializing in the interpretation of historical and technical masonry drawings. Your primary task is to convert these drawings into a precise JSON object representing a 3D assembly.
# CRITICAL OUTPUT INSTRUCTIONS:
# Your entire output MUST be ONLY the raw JSON content.
# Do NOT use any markdown formatting like ```json.
# Do NOT include any text, explanations, or greetings before or after the JSON block.
# JSON STRUCTURE REQUIREMENTS:
# Root Object:
# The root of the object MUST contain three keys:
# objectName (string): The name of the assembly (e.g., "Mauerwerksverband").
# material (string): The default material for all parts in the assembly (e.g., "brick").
# parts (array): An array of part objects, structured as defined below.
# Part Objects (within the parts array):
# Each object in the parts array represents a single component and MUST have the following keys in this specific order:
# id (integer): A unique integer identifier for the part, starting from 1.
# origin (array): A 3-element array of numbers [x, y, z] representing the part's center point in meters.
# dimensions (array): A 3-element array of numbers [width, depth, height] representing the part's size in meters along the X, Y, and Z axes, respectively.
# connections (array): An array of integers, where each integer is the id of another part to which this part is physically connected.
# INTERPRETATION RULES & DEFAULTS:
# Coordinate System: The ground is the X-Y plane. +Z is UP. The object's final origin (0,0,0) MUST be at the geometric center of its base on the ground.
# Units: The user will provide brick dimensions in centimeters (cm). You MUST convert all final output values in the JSON to meters (m).
# Mortar Joints: This is a strict rule. A standard, uniform 1cm mortar joint MUST be modeled between all adjacent bricks, both horizontally and vertically. All position calculations must account for this gap.
panel_21 = Panel("""{
"objectName": "TwistedAlternatingParametricColumn",
"material": "Brick",
"parts": [
{"id": 1, "origin": [0.0, -0.0625, 0.026], "dimensions": [0.24, 0.115, 0.052], "rotation": [0.0, 0.0, 0.0], "connections": [2, 3, 4]},
{"id": 2, "origin": [0.0, 0.0625, 0.026], "dimensions": [0.24, 0.115, 0.052], "rotation": [0.0, 0.0, 0.0], "connections": [1, 3, 4]},
{"id": 3, "origin": [0.0616, 0.0109, 0.088], "dimensions": [0.24, 0.115, 0.052], "rotation": [0.0, 0.0, 1.7453], "connections": [4, 1, 2, 5, 6]},
{"id": 4, "origin": [-0.0616, -0.0109, 0.088], "dimensions": [0.24, 0.115, 0.052], "rotation": [0.0, 0.0, 1.7453], "connections": [3, 1, 2, 5, 6]},
{"id": 5, "origin": [0.0214, -0.0587, 0.15], "dimensions": [0.24, 0.115, 0.052], "rotation": [0.0, 0.0, 0.3491], "connections": [6, 3, 4, 7, 8]},
{"id": 6, "origin": [-0.0214, 0.0587, 0.15], "dimensions": [0.24, 0.115, 0.052], "rotation": [0.0, 0.0, 0.3491], "connections": [5, 3, 4, 7, 8]},
{"id": 7, "origin": [0.0541, 0.0313, 0.212], "dimensions": [0.24, 0.115, 0.052], "rotation": [0.0, 0.0, 2.0944], "connections": [8, 5, 6, 9, 10]},
{"id": 8, "origin": [-0.0541, -0.0313, 0.212], "dimensions": [0.24, 0.115, 0.052], "rotation": [0.0, 0.0, 2.0944], "connections": [7, 5, 6, 9, 10]},
{"id": 9, "origin": [0.0402, -0.0479, 0.274], "dimensions": [0.24, 0.115, 0.052], "rotation": [0.0, 0.0, 0.6981], "connections": [10, 7, 8, 11, 12]},
{"id": 10, "origin": [-0.0402, 0.0479, 0.274], "dimensions": [0.24, 0.115, 0.052], "rotation": [0.0, 0.0, 0.6981], "connections": [9, 7, 8, 11, 12]},
{"id": 11, "origin": [0.0402, 0.0479, 0.336], "dimensions": [0.24, 0.115, 0.052], "rotation": [0.0, 0.0, 2.4435], "connections": [12, 9, 10, 13, 14]},
{"id": 12, "origin": [-0.0402, -0.0479, 0.336], "dimensions": [0.24, 0.115, 0.052], "rotation": [0.0, 0.0, 2.4435], "connections": [11, 9, 10, 13, 14]},
{"id": 13, "origin": [0.0541, -0.0313, 0.398], "dimensions": [0.24, 0.115, 0.052], "rotation": [0.0, 0.0, 1.0472], "connections": [14, 11, 12, 15, 16]},
{"id": 14, "origin": [-0.0541, 0.0313, 0.398], "dimensions": [0.24, 0.115, 0.052], "rotation": [0.0, 0.0, 1.0472], "connections": [13, 11, 12, 15, 16]},
{"id": 15, "origin": [0.0214, 0.0587, 0.46], "dimensions": [0.24, 0.115, 0.052], "rotation": [0.0, 0.0, 2.7925], "connections": [16, 13, 14, 17, 18]},
{"id": 16, "origin": [-0.0214, -0.0587, 0.46], "dimensions": [0.24, 0.115, 0.052], "rotation": [0.0, 0.0, 2.7925], "connections": [15, 13, 14, 17, 18]},
{"id": 17, "origin": [0.0616, -0.0109, 0.522], "dimensions": [0.24, 0.115, 0.052], "rotation": [0.0, 0.0, 1.3963], "connections": [18, 15, 16, 19, 20]},
{"id": 18, "origin": [-0.0616, 0.0109, 0.522], "dimensions": [0.24, 0.115, 0.052], "rotation": [0.0, 0.0, 1.3963], "connections": [17, 15, 16, 19, 20]},
{"id": 19, "origin": [0.0, 0.0625, 0.584], "dimensions": [0.24, 0.115, 0.052], "rotation": [0.0, 0.0, 3.1416], "connections": [20, 17, 18, 21, 22]},
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""")
json_to_assembly_2 = Python3Script(JSON_or_FilePath=panel_12)  # -> log, assembly, preview; same code as json_to_assembly
panel_24 = Panel(json_to_assembly_2.log)
value_list_4 = ValueList({"show all": "show_all", "show until key": "show_until_key"}, selected="show all")

# ----
# Export to JSON
export_3 = Button()
path_5 = Python3Script()  # -> out, DATA; same code as path_4
export_4 = Python3Script(DATA=path_5.DATA, assembly=json_to_assembly_2.assembly, export=export_3)  # -> out
# ---------- export_4: Python ----------
import os

if export:
    
    filename = "windmill_column.json"
    PATH = os.path.join(DATA, filename)
    
    # the assembly has to be serialized such that it can be called from CPython
    assembly.to_json(PATH)
# ---------- end export_4 ----------

value_list_5 = ValueList({"20", "50", "100", "500", "1000", "5000"}, selected="500")
reset_2 = Button()
back_2 = Button()
start_2 = Button()
stop_2 = Button()
step_2 = Button()
full_2 = Button()
counter_2 = Python3Script(
    my_assembly=json_to_assembly_2.assembly,
    start=start_2,
    stop=stop_2,
    step=step_2,
    step_back=back_2,
    reset=reset_2,
    full=full_2,
    interval=value_list_5)  # -> out, counter; same code as counter
panel_25 = Panel(counter_2.counter)

visualize_2 = Python3Script(assembly=json_to_assembly_2.assembly, show=value_list_4, show_connections=Toggle(False), counter=counter_2.counter)  # -> out, parts, parts_frame, parts_keys, current_part_vertices, current_part_vertex_points, connections, current_part, current_part_frame, current_key
# ---------- visualize_2: Python ----------
from compas_rhino.conversions import box_to_rhino, frame_to_rhino, line_to_rhino, point_to_rhino
from compas.geometry import Line, Transformation, Translation

print(assembly)
print(type(assembly))
print([name for name in dir(assembly) if "part" in name.lower()])
print("graph nodes", list(assembly.graph.nodes()) if hasattr(assembly, "graph") else None)

parts_keys = list(assembly.graph.nodes())
parts = []
parts_frame = []
damages = []
current_key = counter

# Safe node attributes
damages.append(assembly.graph.node_attribute(current_key, "damages"))
current_img_path = assembly.graph.node_attribute(current_key, "image_paths")

# Current part in-place (no layout translation)
current_p = assembly.part(current_key)
current_p_frame = current_p.frame
T = Transformation.from_frame(current_p_frame)

current_part = box_to_rhino(current_p.shape.transformed(T))
current_part_frame = frame_to_rhino(current_p_frame)

current_part_vertices = list(current_p.mesh.vertices())
current_part_vertex_points = [
    point_to_rhino(current_p.mesh.vertex_point(v).transformed(T))
    for v in current_part_vertices
]

# All other parts in-place (no layout translation)
if show == "show_all":
    for key in parts_keys:
        if key == current_key:
            continue
        p = assembly.part(key)
        p_frame = p.frame
        parts.append(box_to_rhino(p.shape.transformed(Transformation.from_frame(p_frame))))
        parts_frame.append(frame_to_rhino(p_frame))

# Show until key in-place (no layout translation)
if show == "show_until_key":
    for key in parts_keys[0:counter + 1]:
        if key == current_key:
            continue
        p = assembly.part(key)
        p_frame = p.frame
        parts.append(box_to_rhino(p.shape.transformed(Transformation.from_frame(p_frame))))
        parts_frame.append(frame_to_rhino(p_frame))

# Connections in-place
if show_connections:
    connections = []
    for start, end in assembly.graph.edges():
        ps = assembly.part(start).frame.point
        pe = assembly.part(end).frame.point
        connections.append(line_to_rhino(Line(ps, pe)))

    connection_types = [assembly.graph.edge_attribute(t, "type") for t in assembly.graph.edges()]
    parts_points = [point_to_rhino(p.frame.point) for p in assembly.parts()]
# ---------- end visualize_2 ----------
panel_26 = Panel(visualize_2.out)
python_3_script_2 = Python3Script(planes=visualize_2.current_part_frame, scale=Slider(0.2, range=0..1))  # -> P, V, C, W; inputs planes: list of Plane, scale: Double; same code as python_3_script
text_tag_3 = TextTag(Location=visualize_2.current_part_frame, Text=visualize_2.current_key)
vector_display_ex_2 = VectorDisplayEx(Point=python_3_script_2.P, Vector=python_3_script_2.V, Colour=python_3_script_2.C, Width=python_3_script_2.W)
line = Line(visualize_2.connections)
custom_curve_preview = CustomCurvePreview(Curve=line, Linetype="Continuous", Colour=ColourSwatch(SwatchColor=RGB(255, 125, 157)))

text_tag_4 = TextTag(
    Location=visualize_2.current_part_vertex_points,
    Text=visualize_2.current_part_vertices,
    Colour=ColourSwatch(SwatchColor=RGB(25, 0, 255)))

geometry_4 = Geometry(visualize_2.parts_frame)
custom_preview_3 = CustomPreview(Geometry=geometry_4, Material=ColourSwatch(SwatchColor=RGB(214, 166, 71)))

geometry_5 = Geometry(visualize_2.parts)
custom_preview_4 = CustomPreview(Geometry=geometry_5, Material=ColourSwatch(SwatchColor=RGBA(255, 138, 138, 137)))

geometry_6 = Geometry(visualize_2.current_part)
custom_preview_5 = CustomPreview(Geometry=geometry_6, Material=ColourSwatch(SwatchColor=RGBA(252, 83, 83, 216)))
