# Grasshopper definition 02_b_reassembly_design_algorithmic.ghx (Grasshopper 1.0.8)

# ----
# Brickwork-Control
layer_count = Slider(12, range=0..15)
rotation_angle = Slider(7.7, range=0..90)
list = ValueList({"Design 1": 0, "Design 2": 1}, selected="Design 2")

# ----
# Design 2
pt = ConstructPoint(XCoordinate=0, YCoordinate=0, ZCoordinate=0)
brick_width = Panel(".115")
gap = Panel(".015")
expression = Expression(x=brick_width, y=gap, Expression="(x+y)/2")
Y = UnitY(Factor=expr("-x", expression))
Y_2 = UnitY(Factor=expression)
merge = Merge(Data1=Y_2, Data2=Y)
move = Move(Geometry=pt, Motion=merge)  # -> Geometry, Transform
xy = XYPlane(Origin=move.Geometry)
pflip = FlipPlane(Plane=xy, ReverseX=True, ReverseY=False, SwapAxes=False)

# ----
# Design 1
gap_2 = Slider(0.219, range=0..1)
dom = ConstructDomain(DomainStart=expr("-x/2", gap_2), DomainEnd=expr("x/2", gap_2))
rectangle = Rectangle(Plane=PlaneXY(0, 0, 0), XSize=dom, YSize=dom, Radius=0)  # -> Rectangle, Length
disc = Discontinuity(Curve=rectangle.Rectangle, Level=1)  # -> Points, Parameters
xy_2 = XYPlane(Origin=disc.Points)
lng = ListLength(List=xy_2)
series = Series(Start=0, Step=1, Count=lng)
pi = Pi(Factor=expr("x/2", series))
rotate = Rotate(Geometry=xy_2, Angle=pi, Plane=xy_2)  # -> Geometry, Transform
pflip_2 = FlipPlane(Plane=rotate.Geometry, ReverseX=True, ReverseY=False, SwapAxes=False)

filter = StreamFilter(Gate=list, Stream0=pflip_2, Stream1=pflip)

# ----
# Create a brick part
part = Python3Script()  # -> out, brick_full
# ---------- part: Python ----------
from compas.geometry import Frame
from compas.geometry import Vector
from compas.geometry import Box

from assembly_information_model import Part

# dimensions full brick
width = 0.115
length = 0.240
height = 0.045

# create bricks
tool_frame = Frame([0, 0, 0], [1, 0, 0], [0, -1, 0])
brick_full_geometry = Box(length, width, height, tool_frame, 'box')
brick_full = Part.from_shape(brick_full_geometry, name="brick_full", frame=tool_frame)
# ---------- end part ----------

# ----
# Generate a brickwall assembly
generate_assembly = Python3Script(brick_full=part.brick_full, planes=filter, angle=rotation_angle, course=layer_count)  # -> out, assembly, course; inputs planes: list of Plane, course: Int32
# ---------- generate_assembly: Python ----------
import math

from compas.geometry import Frame, Point, Vector
from compas.geometry import Transformation, Rotation, Translation
from compas.geometry import distance_point_point
from compas_rhino.conversions import plane_to_compas_frame, frame_to_rhino_plane, point_to_compas

from assembly_information_model.assembly import Assembly

#create empty assembly
assembly = Assembly()

qcode = "Q40089"
brick_shape = brick_full.shape
length, width, height = [brick_shape.xsize, brick_shape.ysize, brick_shape.zsize]

for c in range(course): 
    for plane in planes:
        frame = plane_to_compas_frame(plane).transformed(Translation.from_vector(Vector.Zaxis()*height*c))
        frame = frame.transformed(Rotation.from_axis_and_angle(Vector.Zaxis(), math.radians(angle*c)))
        part = brick_full.copy()
        part.frame = frame
        assembly.add_part(part, course=c, built=False, available=True, qcode=qcode)
# ---------- end generate_assembly ----------

# ----
# Export the brickwall assembly
path = Python3Script()  # -> out, DATA
# ---------- path: Python ----------
import os
import getpass

username = getpass.getuser()
USER_FOLDER = os.path.abspath(os.path.join("C:/Users/", username))
DATA = os.path.abspath(os.path.join(USER_FOLDER,"workspace/projects/workshop_iaac_2026/data/assembly"))

print(USER_FOLDER)
print(DATA)
# ---------- end path ----------
export = Button()
date = Python3Script()  # -> date
# ---------- date: Python ----------
import time
date = (
    str(time.localtime().tm_year)[2:] +
    f"{time.localtime().tm_mon:02d}" +
    f"{time.localtime().tm_mday:02d}"
)

print(date)
# ---------- end date ----------
panel = Panel(date)
export_2 = Python3Script(DATA=path.DATA, material_stack=generate_assembly.assembly, export=export, name="_new_assembly_design_2", date=panel)  # -> out; inputs name: String, date: String
# ---------- export_2: Python ----------
import os

if export: 
    stack_filename = date + name + ".json"
    PATH = os.path.join(DATA, stack_filename)
    print(PATH)

    # the assembly has to be serialized such that it can be called from CPython
    material_stack.to_json(PATH)
# ---------- end export_2 ----------

start = Button()
stop = Button()
step = Button()
back = Button()
reset = Button()
full = Button()
list_2 = ValueList({"20", "50", "100", "500", "1000", "5000"}, selected="500")
counter = Python3Script(
    my_assembly=generate_assembly.assembly,
    start=start,
    stop=stop,
    step=step,
    step_back=back,
    reset=reset,
    full=full,
    interval=list_2)  # -> out, counter
# ---------- counter: Python ----------
from scriptcontext import sticky as st
import Grasshopper

def update_component(ghenv, delay):
    """Schedule an update of the Grasshopper component.

    After the specified delay, the GH component will be automatically updated.

    Parameters
    ----------
    ghenv : :class:`GhPython.Component.PythonEnvironment`
        The current GHPython environment.
    delay : :obj:`int`
        Time in milliseconds until the update is performed.

    Raises
    ------
    ValueError
        If the delay is less than zero.

    """
    if delay <= 0:
        raise ValueError("Delay must be greater than zero")

    ghcomp = ghenv.Component
    ghdoc = ghcomp.OnPingDocument()

    def callback(ghdoc):
        if ghdoc.SolutionState != Grasshopper.Kernel.GH_ProcessStep.Process:
            ghcomp.ExpireSolution(False)

    ghdoc.ScheduleSolution(delay, Grasshopper.Kernel.GH_Document.GH_ScheduleDelegate(callback))

L = range(my_assembly.graph.number_of_nodes())

# store data in component
guid = str(ghenv.Component.InstanceGuid)
counter_key = "counter_" + guid
running_key = "running_" + guid

if counter_key not in st:
    st[counter_key] = 0

if running_key not in st:
    st[running_key] = False
    

if st[running_key]:
    if st[counter_key] < len(L) - 1:
        st[counter_key] += 1
        update_component(ghenv, interval)
    else:
        st[counter_key] = 0
        st[running_key] = False
    
if start:
    st[running_key] = True

if stop:
    st[running_key] = False

if step:
    if st[counter_key] < len(L) - 1:
        st[counter_key] += 1

if step_back:
    if st[counter_key] < len(L) - 1:
        st[counter_key] -= 1

if reset:
    st[counter_key] = 0
    st[running_key] = False

if full:
    st[counter_key] = len(L)-1

if len(L):
    item = L[st[counter_key]]


#st["visualisation_counter"] = st[counter_key]
counter = st[counter_key]+1
# ---------- end counter ----------
panel_2 = Panel(counter.counter)

# ----
# Visualize the Assembly
list_3 = ValueList({"show all": "show_all", "show until key": "show_until_key"}, selected="show all")

visualize = Python3Script(
    assembly=generate_assembly.assembly,
    show=list_3,
    highlight_current_part=Toggle(False),
    show_connections=Toggle(True),
    counter=counter.counter)  # -> out, parts_built, parts_not_built, parts_frame, parts_keys, connections, connection_types, current_part_geometry, current_part_frame
# ---------- visualize: Python ----------
from compas_rhino.conversions import mesh_to_rhino, box_to_rhino, frame_to_rhino, line_to_rhino, point_to_rhino
from compas.geometry import Line, Transformation, Point, Vector, Frame, Translation

#print assembly
print(assembly)
#for p in assembly.parts():
#    layer = round(robot.from_RCF_to_BCF(p.frame).point.z/0.08)-1
#    assembly.graph.node_attribute(p.key, "layer", layer)


#get parts datastructure
parts_keys = [p for p in assembly.part_keys()]
parts = [assembly.part(p) for p in parts_keys]
parts_all = []
parts_built = []
parts_not_built = []
parts_frame = []

if show == "show_all":
    for p in parts:
        p_frame = p.frame

        if assembly.graph.node_attribute(p.key, "built"):
            parts_built.append(mesh_to_rhino(p.mesh.transformed(Transformation.from_frame((p_frame)))))
        else:
            parts_not_built.append(mesh_to_rhino(p.mesh.transformed(Transformation.from_frame((p_frame)))))

        parts_frame.append(frame_to_rhino(p_frame))
   
if show == "show_until_key":
    for p in parts[0:counter]:
        p_frame = p.frame
        
        if assembly.graph.node_attribute(p.key, "built"):
            parts_built.append(mesh_to_rhino(p.mesh.transformed(Transformation.from_frame((p_frame)))))
        else:
            parts_not_built.append(mesh_to_rhino(p.mesh.transformed(Transformation.from_frame((p_frame)))))

        parts_frame.append(frame_to_rhino(p_frame))

key = counter

if highlight_current_part:
    current_part = assembly.part(key)
    print(current_part.shape)
    current_part_geometry = mesh_to_rhino(current_part.mesh)
    current_part_frame = frame_to_rhino(current_part.frame)

if show_connections:
    connections = [line_to_rhino(Line(assembly.part(start).frame.point, assembly.part(end).frame.point)) for start, end in assembly.graph.edges()]

    print(connections)
    #connections = [line_to_rhino(Line(assembly.find_by_key(start).frame).point, robot.from_RCF_to_BCF(assembly.find_by_key(end).frame).point) for start, end in assembly.graph.edges()]
    connection_types = [assembly.graph.edge_attribute(t, "type") for t in assembly.graph.edges()]
    #extract points of the frame of the parts for visulization (+ converted to rhino point)
    parts_points = [point_to_rhino(p.frame.point) for p in assembly.parts()]
# ---------- end visualize ----------

panel_3 = Panel(visualize.out)

geo = Geometry(visualize.parts_built)
geo_2 = Geometry(visualize.parts_not_built)
geo_3 = Geometry(visualize.parts_frame)
line = Line(visualize.connections)
pln = Plane(visualize.current_part_frame)
py3 = Python3Script(planes=visualize.parts_frame, scale=Slider(0.2, range=0..1))  # -> P, V, C, W; inputs planes: list of Plane, scale: Double
# ---------- py3: Python ----------
from Rhino.Display import ColorRGBA
from ghpythonlib.components import ColourRGBf


red = ColourRGBf(255, 255, 0, 0)
green = ColourRGBf(255, 0, 255, 0)
blue = ColourRGBf(255, 0, 0, 255)

P = []
V = []
C = []

# scale = float(scale)

for plane in planes:
    if not plane:
        continue
    P += [plane.Origin] * 3
    V.append(plane.XAxis * scale)
    V.append(plane.YAxis * scale)
    V.append(plane.ZAxis * scale)
    C += [red, green, blue]

W = 3
# ---------- end py3 ----------
preview = CustomPreview(Geometry=geo, Material=ColourSwatch(SwatchColor=RGBA(252, 83, 83, 216)))
preview_2 = CustomPreview(Geometry=geo_2, Material=ColourSwatch(SwatchColor=RGBA(255, 138, 138, 210)))
preview_3 = CustomPreview(Geometry=geo_3, Material=ColourSwatch(SwatchColor=RGB(214, 166, 71)))
tag = TextTag(Location=visualize.parts_frame, Text=visualize.parts_keys)
curve_preview = CustomCurvePreview(Curve=line, Linetype="Continuous", Colour=ColourSwatch(SwatchColor=RGB(38, 14, 20)))
vdisex = VectorDisplayEx(Point=py3.P, Vector=py3.V, Colour=py3.C, Width=py3.W)
