# Grasshopper definition 03-b-material-population-genAI.ghx (Grasshopper 1.0.8)

path = Python3Script(filename="GeminiKey")  # -> out, DATA
# ---------- path: Python ----------
import os
import getpass

username = getpass.getuser()
USER_FOLDER = os.path.abspath(os.path.join("C:/Users/", username))
DATA = os.path.abspath(os.path.join(USER_FOLDER,"workspace/{}.txt".format(filename)))

print(USER_FOLDER)
print(DATA)
# ---------- end path ----------

# ----
# Test the Connection by writing a Poem
run = Button()
connection_test_to_vlm = Python3Script(keyPath=path.DATA, run=run)  # -> log, haiku; inputs keyPath: String
# ---------- connection_test_to_vlm: Python ----------
# r: google-generativeai
import google.generativeai as genai
import time
import os
import scriptcontext as sc

KEY_TEXT = "gemini_last_text"
KEY_LOG = "gemini_last_log"
KEY_ERR = "gemini_last_error"
KEY_TIME = "gemini_last_time"

if KEY_TEXT not in sc.sticky:
    sc.sticky[KEY_TEXT] = ""
if KEY_LOG not in sc.sticky:
    sc.sticky[KEY_LOG] = []
if KEY_ERR not in sc.sticky:
    sc.sticky[KEY_ERR] = None
if KEY_TIME not in sc.sticky:
    sc.sticky[KEY_TIME] = None

# Read stored values first so outputs always show something
haiku = sc.sticky.get(KEY_TEXT, "")
log_list = sc.sticky.get(KEY_LOG, [])
error = sc.sticky.get(KEY_ERR, None)
executionTime = sc.sticky.get(KEY_TIME, None)

if not isinstance(log_list, list):
    log_list = [str(log_list)]

def _sanitize_key(raw):
    if raw is None:
        return ""
    k = raw

    # Remove UTF-8 BOM if present
    if len(k) > 0 and ord(k[0]) == 65279:
        k = k[1:]

    k = k.strip()

    # Remove wrapping quotes if file contains "AIza..." or 'AIza...'
    if (k.startswith('"') and k.endswith('"')) or (k.startswith("'") and k.endswith("'")):
        k = k[1:-1].strip()

    # If multiple lines, take first non-empty line
    if "\n" in k or "\r" in k:
        parts = [p.strip() for p in k.replace("\r", "\n").split("\n") if p.strip()]
        k = parts[0] if parts else ""

    return k.strip()

def mask_key(k):
    if not k:
        return ""
    if len(k) <= 8:
        return "*" * len(k)
    return k[:4] + "..." + k[-4:]

if run:
    startTime = time.time()
    log_list = []
    error = None
    executionTime = None

    log_list.append("Starting Gemini API connection test...")

    try:
        if not keyPath or not str(keyPath).strip():
            raise Exception("keyPath input is missing.")

        kp = str(keyPath).strip()
        log_list.append("Loading API key from: {}".format(kp))

        if not os.path.exists(kp):
            raise Exception("API key file not found at given path: {}".format(kp))

        with open(kp, "r") as file:
            raw = file.read()

        apiKey = _sanitize_key(raw)
        if not apiKey:
            log_list.append("API key file is empty or contains only whitespace.")

        log_list.append("API key loaded successfully.")
        log_list.append("API key preview: {}".format(mask_key(apiKey)))

        genai.configure(api_key=apiKey)
        log_list.append("API configured.")

        model = genai.GenerativeModel("gemini-2.5-flash-lite")
        log_list.append("Model initialized: gemini-2.5-flash-lite")

        prompt = "Write a haiku from the perspective of a robot."
        log_list.append('Sending prompt: "{}"'.format(prompt))

        response = model.generate_content(prompt)
        textOut = response.text or ""

        log_list.append("SUCCESS! Connection established.")
        log_list.append("Text received.")

    except Exception as e:
        error = "FAILED! Error: {}".format(e)
        log_list.append(error)

    executionTime = time.time() - startTime
    log_list.append("Execution finished in {:.3f}s".format(executionTime))

    # Store results so they remain after the button returns to False
    sc.sticky[KEY_TEXT] = textOut
    sc.sticky[KEY_LOG] = log_list
    sc.sticky[KEY_ERR] = error
    sc.sticky[KEY_TIME] = executionTime

# Output values every run
log = "\n".join(log_list)

# Suggested GH outputs:
# textOut -> panel
# error -> panel
# executionTime -> panel
# log -> panel
# ---------- end connection_test_to_vlm ----------
panel = Panel(connection_test_to_vlm.haiku)
panel_2 = Panel(connection_test_to_vlm.log)

# ----
# User Prompt: Assign bricks to the column so damages are not visible on the outside of the column. Choose the best bricks you can find, and if damages are on the brick, try to assign the brick in way that the damage is not to be seen from the outside.
# To be made in one single file
# 
# Brick Damage Visualitzation is not yet finished
path_2 = Python3Script()  # -> out, DATA
# ---------- path_2: Python ----------
import os
import getpass

username = getpass.getuser()
USER_FOLDER = os.path.abspath(os.path.join("C:/Users/", username))
DATA = os.path.abspath(os.path.join(USER_FOLDER,"workspace/projects/workshop_iaac_2026/data/stacked_brick_dataset_for_testing/brick_dataset"))

print(USER_FOLDER)
print(DATA)
# ---------- end path_2 ----------
path_3 = Python3Script()  # -> out, DATA
# ---------- path_3: Python ----------
import os
import getpass

username = getpass.getuser()
USER_FOLDER = os.path.abspath(os.path.join("C:/Users/", username))
DATA = os.path.abspath(os.path.join(USER_FOLDER,"workspace/projects/workshop_iaac_2026/data/assembly/column_twisted.json"))

print(USER_FOLDER)
print(DATA)
# ---------- end path_3 ----------
user_prompt = Panel("""Assign bricks to the column so damage severity forms a clear vertical gradient with high polarity between the start and end.

Top region must use the most damaged bricks available in the set.
Bottom region must use only bricks with zero or only little damages.

Between top and bottom, choose bricks so that severity decreases smoothly with height.""")
panel_3 = Panel(path_2.out)
panel_4 = Panel(path_3.out)
ai_brick_evaluation = Python3Script()  # -> error, log, assignmentJson, MODEL_ID, executionTime; inputs keyPath: String; disabled
# ---------- ai_brick_evaluation: Python ----------
#! python 3
# venv: ai_brick_eval
# r: google-genai

import scriptcontext as sc
import json
import os
import time
import threading
import Eto
from google import genai

# ------------------------------------------------------------
# Model
# ------------------------------------------------------------
MODEL_ID = "gemini-2.5-flash"

# ------------------------------------------------------------
# Sticky keys
# ------------------------------------------------------------
KEY_RUNNING       = "gemini_assign_is_running"
KEY_LAST_OUTPUT   = "gemini_assign_last_output"
KEY_LAST_ERROR    = "gemini_assign_last_error"
KEY_LAST_TIME     = "gemini_assign_last_time"
KEY_RESULT        = "gemini_assign_api_result"
KEY_API_ERROR     = "gemini_assign_api_error"
KEY_START_TIME    = "gemini_assign_start_time"
KEY_LAST_LOG      = "gemini_assign_last_log"
KEY_POLICY_RAW    = "gemini_assign_policy_raw"
KEY_LAST_RUN_EDGE = "gemini_assign_last_run_edge"

_defaults = [
    (KEY_RUNNING, False),
    (KEY_LAST_OUTPUT, "Ready. Toggle run."),
    (KEY_LAST_ERROR, None),
    (KEY_LAST_TIME, None),
    (KEY_RESULT, None),
    (KEY_API_ERROR, None),
    (KEY_START_TIME, None),
    (KEY_LAST_LOG, []),
    (KEY_POLICY_RAW, ""),
    (KEY_LAST_RUN_EDGE, False),
]
for k, v in _defaults:
    if k not in sc.sticky:
        sc.sticky[k] = v


# ------------------------------------------------------------
# GH update helper
# ------------------------------------------------------------
def trigger_gh_update():
    gh_doc = ghenv.Component.OnPingDocument()
    if gh_doc:
        for obj in gh_doc.Objects:
            if obj.InstanceGuid == ghenv.Component.InstanceGuid:
                obj.ExpireSolution(True)
                return


# ------------------------------------------------------------
# Small helpers
# ------------------------------------------------------------
def _strip_code_fences(text):
    if not text:
        return text
    t = text.strip()
    if t.startswith("```json"):
        t = t[7:].strip()
        if t.endswith("```"):
            t = t[:-3].strip()
        return t
    if t.startswith("```"):
        t = t[3:].strip()
        if t.endswith("```"):
            t = t[:-3].strip()
        return t
    return t


def _is_valid_json(s):
    try:
        json.loads(s)
        return True
    except:
        return False


def _sanitize_key(raw):
    if raw is None:
        return ""
    k = raw
    if len(k) > 0 and ord(k[0]) == 65279:
        k = k[1:]
    k = k.strip()
    if (k.startswith('"') and k.endswith('"')) or (k.startswith("'") and k.endswith("'")):
        k = k[1:-1].strip()
    if "\n" in k or "\r" in k:
        parts = [p.strip() for p in k.replace("\r", "\n").split("\n") if p.strip()]
        k = parts[0] if parts else ""
    return k.strip()


def load_api_key_from_path(key_path):
    if not key_path or not str(key_path).strip():
        raise ValueError("keyPath input is missing.")
    kp = str(key_path).strip()
    if not os.path.exists(kp):
        raise ValueError("API key file not found at given path: {}".format(kp))
    with open(kp, "r") as f:
        raw = f.read()
    api_key = _sanitize_key(raw)
    if not api_key:
        raise ValueError("API key file is empty or contains only whitespace.")
    return api_key


def _get_optional_int(x, default):
    if x is None or str(x).strip() == "":
        return default
    try:
        return int(x)
    except:
        return default


# ------------------------------------------------------------
# Pack bricks raw (no scoring, no filtering)
# ------------------------------------------------------------
def pack_brick_damage_folder_raw(folder_path, limit=500, max_damages_per_brick=None):
    if not folder_path or not os.path.isdir(folder_path):
        raise ValueError("damagesFolderPath is not a valid folder: {}".format(folder_path))

    files = [f for f in os.listdir(folder_path) if f.lower().endswith(".json")]
    files.sort()
    files = files[:int(limit)]

    bricks = {}
    skipped = []

    for fn in files:
        fp = os.path.join(folder_path, fn)
        brick_id = os.path.splitext(fn)[0]

        try:
            with open(fp, "r") as f:
                obj = json.load(f)
        except Exception as e:
            skipped.append({"file": fn, "reason": "json_load_failed", "error": str(e)})
            continue

        append = obj.get("appendDamages", None)
        if append is None or not isinstance(append, list):
            # normalize, but keep the file content otherwise untouched
            obj["appendDamages"] = []
            skipped.append({"file": fn, "reason": "missing_appendDamages"})

        if max_damages_per_brick is not None and str(max_damages_per_brick).strip() != "":
            try:
                md = int(max_damages_per_brick)
                if md >= 0:
                    obj = dict(obj)
                    obj["appendDamages"] = list(obj.get("appendDamages", []))[:md]
            except:
                pass

        bricks[brick_id] = obj

    packed = {
        "version": 1,
        "bricks": bricks,
        "stats": {
            "brickCount": len(bricks),
            "inputFileCount": len(files),
            "skippedCount": len(skipped),
            "maxDamagesPerBrick": max_damages_per_brick
        },
        "skipped": skipped
    }
    return packed


# ------------------------------------------------------------
# Neutral brick index (helps the model navigate without chunking)
# ------------------------------------------------------------
def _damage_signature(d):
    # Keep tiny and neutral
    t = str(d.get("type", ""))
    status = str(d.get("status", ""))
    val = d.get("value", None)
    side = d.get("side", None) or d.get("face", None) or d.get("faceLabel", None)
    coords = d.get("coordinates", {})
    p = coords.get("point", None)

    p_hint = None
    if isinstance(p, (list, tuple)) and len(p) >= 3:
        try:
            p_hint = [round(float(p[0]), 3), round(float(p[1]), 3), round(float(p[2]), 3)]
        except:
            p_hint = None

    out = {"type": t, "status": status}
    if val is not None:
        out["value"] = val
    if side is not None:
        out["side"] = str(side)
    if p_hint is not None:
        out["p"] = p_hint
    return out


def build_brick_index(packed_obj, max_sig=3):
    bricks = packed_obj.get("bricks", {})
    idx = {}
    for bid, obj in bricks.items():
        append = obj.get("appendDamages", [])
        if not isinstance(append, list):
            append = []
        sigs = []
        for i, d in enumerate(append[:max_sig]):
            if isinstance(d, dict):
                sigs.append({"i": i, "sig": _damage_signature(d)})
        idx[bid] = {"damageCount": len(append), "sample": sigs}
    return idx


# ------------------------------------------------------------
# Assembly extraction: neutral spatial context
# nodeKey, point(x,y,z), optional axes, plus edges
# ------------------------------------------------------------
def extract_assembly_context(assembly_obj):
    data = assembly_obj.get("data", {}) if isinstance(assembly_obj, dict) else {}
    graph = data.get("graph", {}) if isinstance(data, dict) else {}

    node_dict = graph.get("node", {}) if isinstance(graph, dict) else {}
    edge_dict = graph.get("edge", {}) if isinstance(graph, dict) else {}

    nodes = []
    node_keys = []

    for nk, ndata in node_dict.items():
        nk_str = str(nk)
        node_keys.append(nk_str)

        # Try to get frame point from AIM-style structure
        pt = [0.0, 0.0, 0.0]
        xaxis = None
        yaxis = None

        if isinstance(ndata, dict):
            # sometimes direct "z"
            if "z" in ndata:
                try:
                    pt[2] = float(ndata.get("z", 0.0))
                except:
                    pass

            try:
                part = ndata.get("part", {}).get("data", {})
                frame = part.get("frame", None)
                if isinstance(frame, dict):
                    p = frame.get("point", None)
                    if isinstance(p, (list, tuple)) and len(p) >= 3:
                        pt = [float(p[0]), float(p[1]), float(p[2])]
                    xa = frame.get("xaxis", None)
                    ya = frame.get("yaxis", None)
                    if isinstance(xa, (list, tuple)) and len(xa) >= 3:
                        xaxis = [float(xa[0]), float(xa[1]), float(xa[2])]
                    if isinstance(ya, (list, tuple)) and len(ya) >= 3:
                        yaxis = [float(ya[0]), float(ya[1]), float(ya[2])]
            except:
                pass

        node_item = {"nodeKey": nk_str, "point": pt}
        if xaxis is not None:
            node_item["xaxis"] = xaxis
        if yaxis is not None:
            node_item["yaxis"] = yaxis
        nodes.append(node_item)

    # Build edges as list of pairs (start,end)
    edges = []
    if isinstance(edge_dict, dict):
        for u, nbrs in edge_dict.items():
            if not isinstance(nbrs, dict):
                continue
            for v in nbrs.keys():
                edges.append([str(u), str(v)])

    # If edges list empty, try an alternative representation
    if not edges and "adjacency" in graph and isinstance(graph["adjacency"], dict):
        try:
            for u, nbrs in graph["adjacency"].items():
                for v in nbrs.keys():
                    edges.append([str(u), str(v)])
        except:
            pass

    # Stable order for payload
    nodes.sort(key=lambda x: x["nodeKey"])
    edges.sort(key=lambda e: (e[0], e[1]))

    return {"nodes": nodes, "edges": edges}


# ------------------------------------------------------------
# System prompt: generic, no hidden objectives
# ------------------------------------------------------------
def assignment_system_prompt_generic():
    return (
        "You are an assignment engine.\n\n"
        "Inputs\n"
        "PAYLOAD_JSON contains:\n"
        "1) assembly: nodes with nodeKey and 3D point (and maybe axes), plus edges\n"
        "2) bricks: brick_damage_library.bricks[brickId].appendDamages (raw)\n"
        "3) brick_index: neutral summary (damageCount + small samples)\n"
        "4) user_prompt: the objective\n\n"
        "Task\n"
        "Assign exactly one brickId to every nodeKey according to user_prompt.\n\n"
        "Rules\n"
        "1) Use each brickId at most once.\n"
        "2) Return only valid JSON, no markdown and no extra text.\n"
        "3) You must decide per node (do not group into chunks). Every assignment item must have its own note.\n"
        "4) usedDamageIdx must be 0-3 indices into that brick's appendDamages that you relied on.\n"
        "   If you relied on none, use an empty list.\n\n"
        "Output format\n"
        "{\n"
        "  \"assignment\": [\n"
        "    {\"nodeKey\":\"...\",\"brickId\":\"...\",\"usedDamageIdx\":[0,1],\"note\":\"...\"}\n"
        "  ],\n"
        "  \"notes\": \"...\"\n"
        "}\n"
        "Constraints\n"
        "note must be short (<= 80 chars).\n"
        "notes must be short (<= 400 chars).\n"
    )


# ------------------------------------------------------------
# Minimal schema (keeps output small but strict)
# ------------------------------------------------------------
def assignment_response_json_schema(node_keys, brick_ids):
    return {
        "type": "object",
        "additionalProperties": False,
        "required": ["assignment", "notes"],
        "properties": {
            "assignment": {
                "type": "array",
                "minItems": len(node_keys),
                "maxItems": len(node_keys),
                "items": {
                    "type": "object",
                    "additionalProperties": False,
                    "required": ["nodeKey", "brickId", "usedDamageIdx", "note"],
                    "properties": {
                        "nodeKey": {"type": "string", "enum": node_keys},
                        "brickId": {"type": "string", "enum": brick_ids},
                        "usedDamageIdx": {
                            "type": "array",
                            "minItems": 0,
                            "maxItems": 3,
                            "items": {"type": "integer", "minimum": 0, "maximum": 100000}
                        },
                        "note": {"type": "string", "maxLength": 80}
                    }
                }
            },
            "notes": {"type": "string", "maxLength": 400}
        }
    }


# ------------------------------------------------------------
# Validate output strictly (uniqueness + completeness)
# ------------------------------------------------------------
def _parse_and_validate(data, node_keys, brick_ids):
    if not isinstance(data, dict):
        return None, "not an object"

    a = data.get("assignment", None)
    if not isinstance(a, list):
        return None, "missing assignment list"

    node_set = set([str(k) for k in node_keys])
    brick_set = set([str(b) for b in brick_ids])

    seen_nodes = set()
    used_bricks = set()
    out = []

    for item in a:
        if not isinstance(item, dict):
            return None, "assignment item not object"
        nk = str(item.get("nodeKey", ""))
        bid = str(item.get("brickId", ""))
        used = item.get("usedDamageIdx", [])
        note = str(item.get("note", ""))

        if nk not in node_set:
            return None, "invalid nodeKey {}".format(nk)
        if bid not in brick_set:
            return None, "invalid brickId {}".format(bid)
        if nk in seen_nodes:
            return None, "duplicate nodeKey {}".format(nk)
        if bid in used_bricks:
            return None, "duplicate brickId {}".format(bid)

        if not isinstance(used, list):
            used = []
        used_clean = []
        for x in used[:3]:
            try:
                used_clean.append(int(x))
            except:
                pass

        if len(note) > 80:
            note = note[:80]

        out.append({"nodeKey": nk, "brickId": bid, "usedDamageIdx": used_clean, "note": note})
        seen_nodes.add(nk)
        used_bricks.add(bid)

    if len(seen_nodes) != len(node_set):
        return None, "missing nodes in assignment"
    return out, None


# ------------------------------------------------------------
# Background worker
# ------------------------------------------------------------
def call_gemini_assign_in_background(api_key_real, system_prompt, user_prompt, assembly_json_str, damages_folder, limit_files, max_damages_per_brick):
    log_list = sc.sticky.get(KEY_LAST_LOG, [])
    if not isinstance(log_list, list):
        log_list = [str(log_list)]

    try:
        client = genai.Client(api_key=api_key_real)

        log_list.append("Packing brick damage JSONs (RAW)...")
        packed_obj = pack_brick_damage_folder_raw(
            folder_path=damages_folder,
            limit=int(limit_files),
            max_damages_per_brick=max_damages_per_brick
        )
        bricks_dict = packed_obj.get("bricks", {})
        if not bricks_dict:
            raise ValueError("No valid brick JSONs found in folder.")

        log_list.append("Parsing assembly JSON...")
        assembly_obj = json.loads(assembly_json_str) if isinstance(assembly_json_str, str) else assembly_json_str
        assembly_ctx = extract_assembly_context(assembly_obj)
        nodes = assembly_ctx.get("nodes", [])
        if not nodes:
            raise ValueError("No nodes found in assembly JSON.")

        node_keys = [n["nodeKey"] for n in nodes]
        brick_ids = list(bricks_dict.keys())

        # ------------------------------------------------------------
        # ADD LOGGING HERE (we now have nodes + packed_obj)
        # ------------------------------------------------------------
        total_damages = 0
        max_damages = 0
        zero_damage_bricks = 0
        for bid, b in bricks_dict.items():
            app = b.get("appendDamages", []) if isinstance(b, dict) else []
            if not isinstance(app, list):
                app = []
            c = len(app)
            total_damages += c
            if c > max_damages:
                max_damages = c
            if c == 0:
                zero_damage_bricks += 1

        stats_preview = {
            "nodes": len(node_keys),
            "bricks": len(brick_ids),
            "zero_damage_bricks": zero_damage_bricks,
            "total_damages": total_damages,
            "max_damages_in_one_brick": max_damages
        }
        stats_str = json.dumps(stats_preview, ensure_ascii=False)
        log_list.append("STATS: " + stats_str)
        print("STATS:", stats_str)
        # ------------------------------------------------------------

        brick_index = build_brick_index(packed_obj, max_sig=3)

        if not system_prompt or not str(system_prompt).strip():
            system_prompt = assignment_system_prompt_generic()

        payload = {
            "assembly": assembly_ctx,
            "brick_index": brick_index,
            "brick_damage_library": packed_obj,
            "user_prompt": (str(user_prompt) if user_prompt is not None else "")
        }
        payload_str = json.dumps(payload, ensure_ascii=False, separators=(",", ":"))

        # ------------------------------------------------------------
        # ADD LOGGING HERE (payload size)
        # ------------------------------------------------------------
        log_list.append("PAYLOAD_CHARS: {}".format(len(payload_str)))
        print("PAYLOAD_CHARS:", len(payload_str))
        # ------------------------------------------------------------

        schema = assignment_response_json_schema(node_keys=node_keys, brick_ids=brick_ids)

        def _call_once(extra=None):
            contents = []
            contents.append("SYSTEM_RULES:\n" + str(system_prompt))
            if extra:
                contents.append(extra)
            contents.append("PAYLOAD_JSON:\n" + payload_str)
            config = {
                "temperature": 0.0,
                "response_mime_type": "application/json",
                "response_json_schema": schema
            }
            return client.models.generate_content(model=MODEL_ID, contents=contents, config=config)

        log_list.append("Calling Gemini for assignment...")
        response = _call_once()
        sc.sticky[KEY_POLICY_RAW] = response.text

        cleaned = _strip_code_fences(response.text)
        if not _is_valid_json(cleaned):
            log_list.append("Invalid JSON. Retrying once...")
            response = _call_once("LAST_INSTRUCTION:\nReturn only JSON (assignment, notes).")
            sc.sticky[KEY_POLICY_RAW] = response.text
            cleaned = _strip_code_fences(response.text)

        if not _is_valid_json(cleaned):
            raise ValueError("Gemini response was not valid JSON.")

        data = json.loads(cleaned)
        fixed, reason = _parse_and_validate(data, node_keys, brick_ids)
        if fixed is None:
            raise ValueError("Assignment invalid: {}".format(reason))

        result = {"assignment": fixed, "notes": str(data.get("notes", ""))[:400]}

        sc.sticky[KEY_RESULT] = json.dumps(result, ensure_ascii=False, separators=(",", ":"))
        sc.sticky[KEY_API_ERROR] = None
        log_list.append("Done. Assignment created.")

    except Exception as e:
        sc.sticky[KEY_RESULT] = None
        sc.sticky[KEY_API_ERROR] = "An API or processing error occurred: {}".format(e)
        log_list.append("Failed: {}".format(e))
    finally:
        sc.sticky[KEY_LAST_LOG] = log_list
        sc.sticky[KEY_RUNNING] = False
        Eto.Forms.Application.Instance.AsyncInvoke(trigger_gh_update)

# ------------------------------------------------------------
# Outputs start from persisted values
# ------------------------------------------------------------
jsonOutput = sc.sticky[KEY_LAST_OUTPUT]
error = sc.sticky[KEY_LAST_ERROR]
executionTime = sc.sticky[KEY_LAST_TIME]
log_list = sc.sticky.get(KEY_LAST_LOG, [])
if not isinstance(log_list, list):
    log_list = [str(log_list)]
policyRaw = sc.sticky.get(KEY_POLICY_RAW, "")

# ------------------------------------------------------------
# GH Inputs expected:
# run: bool
# keyPath: string
# damagesFolderPath: string
# assemblyJson: string OR assemblyJsonPath: string
# userPrompt: string
# systemPrompt: string (optional)
#
# optional:
# limitFiles: int default 200
# maxDamagesPerBrick: int or None
# ------------------------------------------------------------

prev_run = sc.sticky.get(KEY_LAST_RUN_EDGE, False)
sc.sticky[KEY_LAST_RUN_EDGE] = bool(run)

if (run and not prev_run) and not sc.sticky[KEY_RUNNING]:
    sc.sticky[KEY_RUNNING] = True
    sc.sticky[KEY_RESULT] = None
    sc.sticky[KEY_API_ERROR] = None
    sc.sticky[KEY_START_TIME] = time.time()

    jsonOutput = "Generating assignment..."
    error = None
    executionTime = None

    log_list = []
    log_list.append("Run triggered. Starting setup.")

    try:
        api_key_real = load_api_key_from_path(keyPath)
        log_list.append("API key loaded.")

        lf = _get_optional_int(locals().get("limitFiles", None), 200)
        md = locals().get("maxDamagesPerBrick", None)
        if md is not None and str(md).strip() != "":
            md = _get_optional_int(md, None)

        assembly_json_str = None
        if "assemblyJson" in locals() and assemblyJson and str(assemblyJson).strip():
            assembly_json_str = str(assemblyJson)
            log_list.append("Using assemblyJson input string.")
        elif "assemblyJsonPath" in locals() and assemblyJsonPath and str(assemblyJsonPath).strip():
            ap = str(assemblyJsonPath).strip()
            if not os.path.exists(ap):
                raise ValueError("assemblyJsonPath not found: {}".format(ap))
            with open(ap, "r") as f:
                assembly_json_str = f.read()
            log_list.append("Loaded assembly JSON from path.")
        else:
            raise ValueError("Provide assemblyJson (string) or assemblyJsonPath (path).")

        if not damagesFolderPath or not os.path.isdir(str(damagesFolderPath)):
            raise ValueError("damagesFolderPath is invalid: {}".format(damagesFolderPath))

        sp = locals().get("systemPrompt", None)
        up = locals().get("userPrompt", "")

        log_list.append("Starting background thread call (generic assignment).")

        t = threading.Thread(
            target=call_gemini_assign_in_background,
            args=(api_key_real, sp, up, assembly_json_str, str(damagesFolderPath), lf, md)
        )
        t.daemon = True
        t.start()

    except Exception as setup_e:
        error = "Error during setup: {}".format(setup_e)
        jsonOutput = "Setup error. See error output."
        sc.sticky[KEY_RUNNING] = False
        log_list.append("Setup failed: {}".format(setup_e))

    sc.sticky[KEY_LAST_LOG] = log_list


# Publish result once
if sc.sticky.get(KEY_RESULT) is not None:
    generated_text = sc.sticky[KEY_RESULT]
    cleaned = _strip_code_fences(generated_text)

    jsonOutput = cleaned
    error = None

    start_time = sc.sticky.get(KEY_START_TIME, time.time())
    executionTime = time.time() - start_time
    log_list.append("Result published to output.")

    sc.sticky[KEY_RESULT] = None
    sc.sticky[KEY_API_ERROR] = None

elif sc.sticky.get(KEY_API_ERROR) is not None:
    jsonOutput = "An error occurred. See error output."
    error = sc.sticky[KEY_API_ERROR]

    start_time = sc.sticky.get(KEY_START_TIME, time.time())
    executionTime = time.time() - start_time
    log_list.append("Error published to output.")

    sc.sticky[KEY_API_ERROR] = None


# Persist outputs
sc.sticky[KEY_LAST_OUTPUT] = jsonOutput
sc.sticky[KEY_LAST_ERROR] = error
sc.sticky[KEY_LAST_TIME] = executionTime
sc.sticky[KEY_LAST_LOG] = log_list

# GH outputs
assignmentJson = jsonOutput
log = "\n".join([str(x) for x in log_list])
policyDebug = policyRaw
# ---------- end ai_brick_evaluation ----------
import = Python3Script(path=path_3.DATA)  # -> out, assembly; inputs path: String
# ---------- import: Python ----------
import json
from compas.data import DataDecoder
from assembly_information_model.assembly import Assembly

def load_assembly(json_path: str) -> Assembly:
    with open(json_path, "r", encoding="utf-8") as f:
        obj = json.load(f, cls=DataDecoder)  # recreates the Assembly from dtype + data

    if not isinstance(obj, Assembly):
        raise TypeError(f"Loaded object is {type(obj)}, expected Assembly.")
    return obj

# Grasshopper usage: set `path` as an input (string)
assembly = load_assembly(path)

# optional debug
nodes = list(assembly.graph.nodes())
print("Nodes:", len(nodes))
# ---------- end import ----------
panel_5 = Panel(import.out)

run_the_generative_model = Button()
ai_brick_assignment = Python3Script(
    userPrompt=user_prompt,
    damagesFolderPath=path_2.DATA,
    assemblyJsonPath=path_3.DATA,
    keyPath=path.DATA,
    run=run_the_generative_model)  # -> error, log, assignmentJson, MODEL_ID, executionTime; inputs keyPath: String
# ---------- ai_brick_assignment: Python ----------
#! python 3
# venv: ai_brick_eval
# r: google-genai

import scriptcontext as sc
import json
import os
import time
import threading
import Eto
import re
from google import genai

# ------------------------------------------------------------
# Model
# ------------------------------------------------------------
MODEL_ID = "gemini-2.5-pro"

# ------------------------------------------------------------
# Sticky keys
# ------------------------------------------------------------
KEY_RUNNING       = "gemini_assign_is_running"
KEY_LAST_OUTPUT   = "gemini_assign_last_output"
KEY_LAST_ERROR    = "gemini_assign_last_error"
KEY_LAST_TIME     = "gemini_assign_last_time"
KEY_RESULT        = "gemini_assign_api_result"
KEY_API_ERROR     = "gemini_assign_api_error"
KEY_START_TIME    = "gemini_assign_start_time"
KEY_LAST_LOG      = "gemini_assign_last_log"
KEY_POLICY_RAW    = "gemini_assign_policy_raw"
KEY_LAST_RUN_EDGE = "gemini_assign_last_run_edge"

_defaults = [
    (KEY_RUNNING, False),
    (KEY_LAST_OUTPUT, "Ready. Toggle run."),
    (KEY_LAST_ERROR, None),
    (KEY_LAST_TIME, None),
    (KEY_RESULT, None),
    (KEY_API_ERROR, None),
    (KEY_START_TIME, None),
    (KEY_LAST_LOG, []),
    (KEY_POLICY_RAW, ""),
    (KEY_LAST_RUN_EDGE, False),
]
for k, v in _defaults:
    if k not in sc.sticky:
        sc.sticky[k] = v


# ------------------------------------------------------------
# GH update helper
# ------------------------------------------------------------
def trigger_gh_update():
    gh_doc = ghenv.Component.OnPingDocument()
    if gh_doc:
        for obj in gh_doc.Objects:
            if obj.InstanceGuid == ghenv.Component.InstanceGuid:
                obj.ExpireSolution(True)
                return


# ------------------------------------------------------------
# Small helpers
# ------------------------------------------------------------
def _strip_code_fences(text):
    if not text:
        return text
    t = text.strip()
    if t.startswith("```json"):
        t = t[7:].strip()
        if t.endswith("```"):
            t = t[:-3].strip()
        return t
    if t.startswith("```"):
        t = t[3:].strip()
        if t.endswith("```"):
            t = t[:-3].strip()
        return t
    return t


def _is_valid_json(s):
    try:
        json.loads(s)
        return True
    except:
        return False


def _sanitize_key(raw):
    if raw is None:
        return ""
    k = raw
    if len(k) > 0 and ord(k[0]) == 65279:
        k = k[1:]
    k = k.strip()
    if (k.startswith('"') and k.endswith('"')) or (k.startswith("'") and k.endswith("'")):
        k = k[1:-1].strip()
    if "\n" in k or "\r" in k:
        parts = [p.strip() for p in k.replace("\r", "\n").split("\n") if p.strip()]
        k = parts[0] if parts else ""
    return k.strip()


def load_api_key_from_path(key_path):
    if not key_path or not str(key_path).strip():
        raise ValueError("keyPath input is missing.")
    kp = str(key_path).strip()
    if not os.path.exists(kp):
        raise ValueError("API key file not found at given path: {}".format(kp))
    with open(kp, "r") as f:
        raw = f.read()
    api_key = _sanitize_key(raw)
    if not api_key:
        raise ValueError("API key file is empty or contains only whitespace.")
    return api_key


def _get_optional_int(x, default):
    if x is None or str(x).strip() == "":
        return default
    try:
        return int(x)
    except:
        return default


def _try_parse_retry_seconds(err_text):
    """
    Tries to extract retry delay seconds from Gemini error text
    Handles patterns like:
    retryDelay': '23s'
    or
    Please retry in 23.284886265s.
    """
    if not err_text:
        return None

    m = re.search(r"retryDelay'\s*:\s*'(\d+)s'", err_text)
    if m:
        try:
            return int(m.group(1))
        except:
            pass

    m = re.search(r"Please retry in\s+([0-9]+(\.[0-9]+)?)s", err_text)
    if m:
        try:
            return float(m.group(1))
        except:
            pass

    return None


# ------------------------------------------------------------
# Pack bricks raw (no scoring, no filtering)
# ------------------------------------------------------------
def pack_brick_damage_folder_raw(folder_path, limit=500, max_damages_per_brick=None):
    if not folder_path or not os.path.isdir(folder_path):
        raise ValueError("damagesFolderPath is not a valid folder: {}".format(folder_path))

    files = [f for f in os.listdir(folder_path) if f.lower().endswith(".json")]
    files.sort()
    files = files[:int(limit)]

    bricks = {}
    skipped = []

    for fn in files:
        fp = os.path.join(folder_path, fn)
        brick_id = os.path.splitext(fn)[0]

        try:
            with open(fp, "r") as f:
                obj = json.load(f)
        except Exception as e:
            skipped.append({"file": fn, "reason": "json_load_failed", "error": str(e)})
            continue

        append = obj.get("appendDamages", None)
        if append is None or not isinstance(append, list):
            obj["appendDamages"] = []
            skipped.append({"file": fn, "reason": "missing_appendDamages"})

        if max_damages_per_brick is not None and str(max_damages_per_brick).strip() != "":
            try:
                md = int(max_damages_per_brick)
                if md >= 0:
                    obj = dict(obj)
                    obj["appendDamages"] = list(obj.get("appendDamages", []))[:md]
            except:
                pass

        bricks[brick_id] = obj

    packed = {
        "version": 1,
        "bricks": bricks,
        "stats": {
            "brickCount": len(bricks),
            "inputFileCount": len(files),
            "skippedCount": len(skipped),
            "maxDamagesPerBrick": max_damages_per_brick
        },
        "skipped": skipped
    }
    return packed


# ------------------------------------------------------------
# Neutral brick index (helps the model navigate without chunking)
# ------------------------------------------------------------
def _damage_signature(d):
    t = str(d.get("type", ""))
    status = str(d.get("status", ""))
    val = d.get("value", None)
    side = d.get("side", None) or d.get("face", None) or d.get("faceLabel", None)
    coords = d.get("coordinates", {})
    p = coords.get("point", None)

    p_hint = None
    if isinstance(p, (list, tuple)) and len(p) >= 3:
        try:
            p_hint = [round(float(p[0]), 3), round(float(p[1]), 3), round(float(p[2]), 3)]
        except:
            p_hint = None

    out = {"type": t, "status": status}
    if val is not None:
        out["value"] = val
    if side is not None:
        out["side"] = str(side)
    if p_hint is not None:
        out["p"] = p_hint
    return out


def build_brick_index(packed_obj, max_sig=3):
    bricks = packed_obj.get("bricks", {})
    idx = {}
    for bid, obj in bricks.items():
        append = obj.get("appendDamages", [])
        if not isinstance(append, list):
            append = []
        sigs = []
        for i, d in enumerate(append[:max_sig]):
            if isinstance(d, dict):
                sigs.append({"i": i, "sig": _damage_signature(d)})
        idx[bid] = {"damageCount": len(append), "sample": sigs}
    return idx


# ------------------------------------------------------------
# Assembly extraction: neutral spatial context
# ------------------------------------------------------------
def extract_assembly_context(assembly_obj):
    data = assembly_obj.get("data", {}) if isinstance(assembly_obj, dict) else {}
    graph = data.get("graph", {}) if isinstance(data, dict) else {}

    node_dict = graph.get("node", {}) if isinstance(graph, dict) else {}
    edge_dict = graph.get("edge", {}) if isinstance(graph, dict) else {}

    nodes = []

    for nk, ndata in node_dict.items():
        nk_str = str(nk)

        pt = [0.0, 0.0, 0.0]
        xaxis = None
        yaxis = None

        if isinstance(ndata, dict):
            if "z" in ndata:
                try:
                    pt[2] = float(ndata.get("z", 0.0))
                except:
                    pass

            try:
                part = ndata.get("part", {}).get("data", {})
                frame = part.get("frame", None)
                if isinstance(frame, dict):
                    p = frame.get("point", None)
                    if isinstance(p, (list, tuple)) and len(p) >= 3:
                        pt = [float(p[0]), float(p[1]), float(p[2])]
                    xa = frame.get("xaxis", None)
                    ya = frame.get("yaxis", None)
                    if isinstance(xa, (list, tuple)) and len(xa) >= 3:
                        xaxis = [float(xa[0]), float(xa[1]), float(xa[2])]
                    if isinstance(ya, (list, tuple)) and len(ya) >= 3:
                        yaxis = [float(ya[0]), float(ya[1]), float(ya[2])]
            except:
                pass

        node_item = {"nodeKey": nk_str, "point": pt}
        if xaxis is not None:
            node_item["xaxis"] = xaxis
        if yaxis is not None:
            node_item["yaxis"] = yaxis
        nodes.append(node_item)

    edges = []
    if isinstance(edge_dict, dict):
        for u, nbrs in edge_dict.items():
            if not isinstance(nbrs, dict):
                continue
            for v in nbrs.keys():
                edges.append([str(u), str(v)])

    if not edges and "adjacency" in graph and isinstance(graph["adjacency"], dict):
        try:
            for u, nbrs in graph["adjacency"].items():
                for v in nbrs.keys():
                    edges.append([str(u), str(v)])
        except:
            pass

    nodes.sort(key=lambda x: x["nodeKey"])
    edges.sort(key=lambda e: (e[0], e[1]))

    return {"nodes": nodes, "edges": edges}


# ------------------------------------------------------------
# System prompt: generic, no hidden objectives
# ------------------------------------------------------------
def assignment_system_prompt_generic():
    return (
        "You are an assignment engine.\n\n"
        "Inputs\n"
        "PAYLOAD_JSON contains:\n"
        "1) assembly: nodes with nodeKey and 3D point (and maybe axes), plus edges\n"
        "2) bricks: brick_damage_library.bricks[brickId].appendDamages (raw)\n"
        "3) brick_index: neutral summary (damageCount + small samples)\n"
        "4) user_prompt: the objective\n\n"
        "Task\n"
        "Assign exactly one brickId to every nodeKey according to user_prompt.\n\n"
        "Rules\n"
        "1) Use each brickId at most once.\n"
        "2) Return only valid JSON, no markdown and no extra text.\n"
        "3) Decide per node. Do not group into chunks.\n"
        "4) usedDamageIdx must be 0-3 indices into that brick's appendDamages that you relied on.\n"
        "   If you relied on none, use an empty list.\n\n"
        "Output format\n"
        "{\n"
        "  \"assignment\": [\n"
        "    {\"nodeKey\":\"...\",\"brickId\":\"...\",\"usedDamageIdx\":[0,1],\"note\":\"...\"}\n"
        "  ],\n"
        "  \"notes\": \"...\"\n"
        "}\n"
        "Constraints\n"
        "note must be short (<= 80 chars).\n"
        "notes must be short (<= 400 chars).\n"
    )


# ------------------------------------------------------------
# Validate output strictly (uniqueness + completeness)
# ------------------------------------------------------------
def _parse_and_validate(data, node_keys, brick_ids):
    if not isinstance(data, dict):
        return None, "not an object"

    a = data.get("assignment", None)
    if not isinstance(a, list):
        return None, "missing assignment list"

    node_set = set([str(k) for k in node_keys])
    brick_set = set([str(b) for b in brick_ids])

    seen_nodes = set()
    used_bricks = set()
    out = []

    for item in a:
        if not isinstance(item, dict):
            return None, "assignment item not object"

        nk = str(item.get("nodeKey", ""))
        bid = str(item.get("brickId", ""))
        used = item.get("usedDamageIdx", [])
        note = str(item.get("note", ""))

        if nk not in node_set:
            return None, "invalid nodeKey {}".format(nk)
        if bid not in brick_set:
            return None, "invalid brickId {}".format(bid)
        if nk in seen_nodes:
            return None, "duplicate nodeKey {}".format(nk)
        if bid in used_bricks:
            return None, "duplicate brickId {}".format(bid)

        if not isinstance(used, list):
            used = []
        used_clean = []
        for x in used[:3]:
            try:
                used_clean.append(int(x))
            except:
                pass

        if len(note) > 80:
            note = note[:80]

        out.append({"nodeKey": nk, "brickId": bid, "usedDamageIdx": used_clean, "note": note})
        seen_nodes.add(nk)
        used_bricks.add(bid)

    if len(seen_nodes) != len(node_set):
        return None, "missing nodes in assignment"

    return out, None


# ------------------------------------------------------------
# Gemini call with robust retries
# ------------------------------------------------------------
def _gemini_generate_json(client, system_prompt, payload_str, log_list):
    """
    Strategy:
    1) One normal call
    2) If response not JSON, one correction call
    3) If 429, wait and retry up to 3 times (with delay extraction or exponential fallback)
    """
    def _call(extra=None):
        contents = []
        contents.append("SYSTEM_RULES:\n" + str(system_prompt))
        if extra:
            contents.append(extra)
        contents.append("PAYLOAD_JSON:\n" + payload_str)
        config = {"temperature": 0.0, "response_mime_type": "application/json"}
        return client.models.generate_content(model=MODEL_ID, contents=contents, config=config)

    # 429 retry loop for the first call
    backoff = 2.0
    for attempt in range(1, 4):
        try:
            resp = _call()
            return resp
        except Exception as e:
            msg = str(e)
            if "429" in msg or "RESOURCE_EXHAUSTED" in msg:
                wait_s = _try_parse_retry_seconds(msg)
                if wait_s is None:
                    wait_s = backoff
                    backoff = min(backoff * 2.0, 30.0)
                log_list.append("429 rate limit. Waiting {}s then retry {}/3...".format(wait_s, attempt))
                try:
                    time.sleep(float(wait_s))
                except:
                    time.sleep(5.0)
                continue
            raise

    raise ValueError("Failed after repeated 429 retries.")

# ------------------------------------------------------------
# Background worker
# ------------------------------------------------------------
def call_gemini_assign_in_background(api_key_real, system_prompt, user_prompt, assembly_json_str, damages_folder, limit_files, max_damages_per_brick):
    log_list = sc.sticky.get(KEY_LAST_LOG, [])
    if not isinstance(log_list, list):
        log_list = [str(log_list)]

    try:
        client = genai.Client(api_key=api_key_real)

        log_list.append("Packing brick damage JSONs (RAW)...")
        packed_obj = pack_brick_damage_folder_raw(
            folder_path=damages_folder,
            limit=int(limit_files),
            max_damages_per_brick=max_damages_per_brick
        )
        bricks_dict = packed_obj.get("bricks", {})
        if not bricks_dict:
            raise ValueError("No valid brick JSONs found in folder.")

        log_list.append("Parsing assembly JSON...")
        assembly_obj = json.loads(assembly_json_str) if isinstance(assembly_json_str, str) else assembly_json_str
        assembly_ctx = extract_assembly_context(assembly_obj)
        nodes = assembly_ctx.get("nodes", [])
        if not nodes:
            raise ValueError("No nodes found in assembly JSON.")

        node_keys = [n["nodeKey"] for n in nodes]
        brick_ids = list(bricks_dict.keys())

        # Logging stats
        total_damages = 0
        max_damages = 0
        zero_damage_bricks = 0
        for _, b in bricks_dict.items():
            app = b.get("appendDamages", []) if isinstance(b, dict) else []
            if not isinstance(app, list):
                app = []
            c = len(app)
            total_damages += c
            if c > max_damages:
                max_damages = c
            if c == 0:
                zero_damage_bricks += 1

        stats_preview = {
            "nodes": len(node_keys),
            "bricks": len(brick_ids),
            "zero_damage_bricks": zero_damage_bricks,
            "total_damages": total_damages,
            "max_damages_in_one_brick": max_damages
        }
        stats_str = json.dumps(stats_preview, ensure_ascii=False, separators=(",", ":"))
        log_list.append("STATS: " + stats_str)
        print("STATS:", stats_str)

        brick_index = build_brick_index(packed_obj, max_sig=3)

        if not system_prompt or not str(system_prompt).strip():
            system_prompt = assignment_system_prompt_generic()

        payload = {
            "assembly": assembly_ctx,
            "brick_index": brick_index,
            "brick_damage_library": packed_obj,
            "user_prompt": (str(user_prompt) if user_prompt is not None else "")
        }
        payload_str = json.dumps(payload, ensure_ascii=False, separators=(",", ":"))

        log_list.append("PAYLOAD_CHARS: {}".format(len(payload_str)))
        print("PAYLOAD_CHARS:", len(payload_str))

        # Call Gemini
        log_list.append("Calling Gemini for assignment...")
        response = _gemini_generate_json(client, system_prompt, payload_str, log_list)
        sc.sticky[KEY_POLICY_RAW] = response.text

        cleaned = _strip_code_fences(response.text)

        # If not JSON, one correction call (also with 429 handling)
        if not _is_valid_json(cleaned):
            log_list.append("Invalid JSON. Retrying once with stricter instruction...")
            extra = "LAST_INSTRUCTION:\nReturn only JSON with keys assignment and notes. No extra text."
            # reuse internal call approach
            def _call_fix():
                contents = []
                contents.append("SYSTEM_RULES:\n" + str(system_prompt))
                contents.append(extra)
                contents.append("PAYLOAD_JSON:\n" + payload_str)
                config = {"temperature": 0.0, "response_mime_type": "application/json"}
                return client.models.generate_content(model=MODEL_ID, contents=contents, config=config)

            backoff = 2.0
            fixed_resp = None
            for attempt in range(1, 4):
                try:
                    fixed_resp = _call_fix()
                    break
                except Exception as e:
                    msg = str(e)
                    if "429" in msg or "RESOURCE_EXHAUSTED" in msg:
                        wait_s = _try_parse_retry_seconds(msg)
                        if wait_s is None:
                            wait_s = backoff
                            backoff = min(backoff * 2.0, 30.0)
                        log_list.append("429 rate limit on retry. Waiting {}s...".format(wait_s))
                        try:
                            time.sleep(float(wait_s))
                        except:
                            time.sleep(5.0)
                        continue
                    raise
            if fixed_resp is None:
                raise ValueError("Retry failed due to repeated 429.")
            sc.sticky[KEY_POLICY_RAW] = fixed_resp.text
            cleaned = _strip_code_fences(fixed_resp.text)

        if not _is_valid_json(cleaned):
            raise ValueError("Gemini response was not valid JSON.")

        data = json.loads(cleaned)
        fixed, reason = _parse_and_validate(data, node_keys, brick_ids)
        if fixed is None:
            raise ValueError("Assignment invalid: {}".format(reason))

        result = {"assignment": fixed, "notes": str(data.get("notes", ""))[:400]}
        sc.sticky[KEY_RESULT] = json.dumps(result, ensure_ascii=False, separators=(",", ":"))
        sc.sticky[KEY_API_ERROR] = None
        log_list.append("Done. Assignment created.")

    except Exception as e:
        sc.sticky[KEY_RESULT] = None
        sc.sticky[KEY_API_ERROR] = "An API or processing error occurred: {}".format(e)
        log_list.append("Failed: {}".format(e))
    finally:
        sc.sticky[KEY_LAST_LOG] = log_list
        sc.sticky[KEY_RUNNING] = False
        Eto.Forms.Application.Instance.AsyncInvoke(trigger_gh_update)


# ------------------------------------------------------------
# Outputs start from persisted values
# ------------------------------------------------------------
jsonOutput = sc.sticky[KEY_LAST_OUTPUT]
error = sc.sticky[KEY_LAST_ERROR]
executionTime = sc.sticky[KEY_LAST_TIME]
log_list = sc.sticky.get(KEY_LAST_LOG, [])
if not isinstance(log_list, list):
    log_list = [str(log_list)]
policyRaw = sc.sticky.get(KEY_POLICY_RAW, "")

# ------------------------------------------------------------
# GH Inputs expected:
# run: bool
# keyPath: string
# damagesFolderPath: string
# assemblyJson: string OR assemblyJsonPath: string
# userPrompt: string
# systemPrompt: string (optional)
#
# optional:
# limitFiles: int default 200
# maxDamagesPerBrick: int or None
# ------------------------------------------------------------

prev_run = sc.sticky.get(KEY_LAST_RUN_EDGE, False)
sc.sticky[KEY_LAST_RUN_EDGE] = bool(run)

if (run and not prev_run) and not sc.sticky[KEY_RUNNING]:
    sc.sticky[KEY_RUNNING] = True
    sc.sticky[KEY_RESULT] = None
    sc.sticky[KEY_API_ERROR] = None
    sc.sticky[KEY_START_TIME] = time.time()

    jsonOutput = "Generating assignment..."
    error = None
    executionTime = None

    log_list = []
    log_list.append("Run triggered. Starting setup.")

    try:
        api_key_real = load_api_key_from_path(keyPath)
        log_list.append("API key loaded.")

        lf = _get_optional_int(locals().get("limitFiles", None), 200)
        md = locals().get("maxDamagesPerBrick", None)
        if md is not None and str(md).strip() != "":
            md = _get_optional_int(md, None)

        assembly_json_str = None
        if "assemblyJson" in locals() and assemblyJson and str(assemblyJson).strip():
            assembly_json_str = str(assemblyJson)
            log_list.append("Using assemblyJson input string.")
        elif "assemblyJsonPath" in locals() and assemblyJsonPath and str(assemblyJsonPath).strip():
            ap = str(assemblyJsonPath).strip()
            if not os.path.exists(ap):
                raise ValueError("assemblyJsonPath not found: {}".format(ap))
            with open(ap, "r") as f:
                assembly_json_str = f.read()
            log_list.append("Loaded assembly JSON from path.")
        else:
            raise ValueError("Provide assemblyJson (string) or assemblyJsonPath (path).")

        if not damagesFolderPath or not os.path.isdir(str(damagesFolderPath)):
            raise ValueError("damagesFolderPath is invalid: {}".format(damagesFolderPath))

        sp = locals().get("systemPrompt", None)
        up = locals().get("userPrompt", "")

        log_list.append("Starting background thread call (generic assignment).")

        t = threading.Thread(
            target=call_gemini_assign_in_background,
            args=(api_key_real, sp, up, assembly_json_str, str(damagesFolderPath), lf, md)
        )
        t.daemon = True
        t.start()

    except Exception as setup_e:
        error = "Error during setup: {}".format(setup_e)
        jsonOutput = "Setup error. See error output."
        sc.sticky[KEY_RUNNING] = False
        log_list.append("Setup failed: {}".format(setup_e))

    sc.sticky[KEY_LAST_LOG] = log_list


# Publish result once
if sc.sticky.get(KEY_RESULT) is not None:
    generated_text = sc.sticky[KEY_RESULT]
    cleaned = _strip_code_fences(generated_text)

    jsonOutput = cleaned
    error = None

    start_time = sc.sticky.get(KEY_START_TIME, time.time())
    executionTime = time.time() - start_time
    log_list.append("Result published to output.")

    sc.sticky[KEY_RESULT] = None
    sc.sticky[KEY_API_ERROR] = None

elif sc.sticky.get(KEY_API_ERROR) is not None:
    jsonOutput = "An error occurred. See error output."
    error = sc.sticky[KEY_API_ERROR]

    start_time = sc.sticky.get(KEY_START_TIME, time.time())
    executionTime = time.time() - start_time
    log_list.append("Error published to output.")

    sc.sticky[KEY_API_ERROR] = None


# Persist outputs
sc.sticky[KEY_LAST_OUTPUT] = jsonOutput
sc.sticky[KEY_LAST_ERROR] = error
sc.sticky[KEY_LAST_TIME] = executionTime
sc.sticky[KEY_LAST_LOG] = log_list

# GH outputs
assignmentJson = jsonOutput
log = "\n".join([str(x) for x in log_list])
policyDebug = policyRaw
# ---------- end ai_brick_assignment ----------

error = Panel(ai_brick_assignment.error)
log = Panel(ai_brick_assignment.log)
jsonoutput = Panel(ai_brick_assignment.assignmentJson)
executiontime = Panel(ai_brick_assignment.executionTime)
model = Panel(ai_brick_assignment.MODEL_ID)

# ---- group: Not working yet
damage = ControlKnob(Decimals=0, Limit=True, Maximum=10, Minimum=0, Range=10, Value=0)

# ----
value_list = ValueList({"20", "50", "100", "500", "1000", "5000"}, selected="500")
reset = Button()
back = Button()
start = Button()
stop = Button()
step = Button()
full = Button()
counter = Python3Script(
    my_assembly=import.assembly,
    start=start,
    stop=stop,
    step=step,
    step_back=back,
    reset=reset,
    full=full,
    interval=value_list)  # -> out, counter
# ---------- counter: Python ----------
from scriptcontext import sticky as st
import Grasshopper

def update_component(ghenv, delay):
    """Schedule an update of the Grasshopper component.

    After the specified delay, the GH component will be automatically updated.

    Parameters
    ----------
    ghenv : :class:`GhPython.Component.PythonEnvironment`
        The current GHPython environment.
    delay : :obj:`int`
        Time in milliseconds until the update is performed.

    Raises
    ------
    ValueError
        If the delay is less than zero.

    """
    if delay <= 0:
        raise ValueError("Delay must be greater than zero")

    ghcomp = ghenv.Component
    ghdoc = ghcomp.OnPingDocument()

    def callback(ghdoc):
        if ghdoc.SolutionState != Grasshopper.Kernel.GH_ProcessStep.Process:
            ghcomp.ExpireSolution(False)

    ghdoc.ScheduleSolution(delay, Grasshopper.Kernel.GH_Document.GH_ScheduleDelegate(callback))

L = range(my_assembly.graph.number_of_nodes())

# store data in component
guid = str(ghenv.Component.InstanceGuid)
counter_key = "counter_" + guid
running_key = "running_" + guid

if counter_key not in st:
    st[counter_key] = 0

if running_key not in st:
    st[running_key] = False
    

if st[running_key]:
    if st[counter_key] < len(L) - 1:
        st[counter_key] += 1
        update_component(ghenv, interval)
    else:
        st[counter_key] = 0
        st[running_key] = False
    
if start:
    st[running_key] = True

if stop:
    st[running_key] = False

if step:
    if st[counter_key] < len(L) - 1:
        st[counter_key] += 1

if step_back:
    if st[counter_key] > 0:
        st[counter_key] -= 1

if reset:
    st[counter_key] = 0
    st[running_key] = False

if full:
    st[counter_key] = len(L)-1

if len(L):
    item = L[st[counter_key]]


#st["visualisation_counter"] = st[counter_key]
counter = st[counter_key]
# ---------- end counter ----------
panel_6 = Panel(counter.counter)

value_list_2 = ValueList({"show all": "show_all", "show until key": "show_until_key", "show all damages": "show_all_damages"}, selected="show all damages")
visualize = Python3Script(
    assembly=import.assembly,
    assignmentJson=jsonoutput,
    damagesFolderPath=path_2.DATA,
    show=value_list_2,
    show_connections=Toggle(True),
    counter=counter.counter,
    select=damage)  # -> out, log, brick_IDs, parts, parts_frame, parts_keys, current_part_vertices, current_part_vertex_points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
# ---------- visualize: Python ----------
from compas_rhino.conversions import (
    sphere_to_rhino, box_to_rhino, frame_to_rhino, line_to_rhino, point_to_rhino
)
from compas.geometry import Line, Transformation, Frame, Sphere, Translation, Point
import json
import os

# ------------------------------------------------------------
# Expected GH Inputs (same conventions + 2 additions)
# assembly : COMPAS Assembly
# counter  : int (current node key)
# show     : "show_all" or "show_until_key" or anything else
# show_connections : bool
# select   : int (index of selected damage in the current brick list)

# NEW:
# assignmentJson : string {"assignment":[{"nodeKey":"0","brickId":"brick_012"},...]}
# damagesFolderPath : string folder containing brick_XXX.json
#
# ------------------------------------------------------------
# Expected GH Outputs (keep old style)
# current_part
# current_part_frame
# current_img_path  (kept, but may be None)
# current_part_vertex_points
# parts
# parts_frame
# connections
# connection_types
# parts_points
# damages
# all_damages
# selected_damage
# damage_f
# damage_t
# damage_d
# damage_s
# ------------------------------------------------------------

brick_IDs = []

def parse_assignment_map(assignment_json_str):
    if not assignment_json_str or not str(assignment_json_str).strip():
        return {}
    obj = json.loads(str(assignment_json_str))
    # expects either {"assignment":[...]} or just [...]
    items = obj.get("assignment", obj) if isinstance(obj, dict) else obj
    m = {}
    if isinstance(items, list):
        for a in items:
            if isinstance(a, dict) and "nodeKey" in a and "brickId" in a:
                m[str(a["nodeKey"])] = str(a["brickId"])
    return m

def load_brick_damage_file(folder_path, brick_id):
    fp = os.path.join(folder_path, "{}.json".format(brick_id))
    if not os.path.exists(fp):
        return []
    with open(fp, "r") as f:
        obj = json.load(f)
    append = obj.get("appendDamages", [])
    if not isinstance(append, list):
        return []
    return append

def get_node_key_list(assembly):
    return list(assembly.graph.nodes())

def get_part_by_key(assembly, key):
    # Try int then str, because assemblies vary
    try:
        return assembly.part(int(key))
    except:
        return assembly.part(str(key))

def safe_int(x, default=0):
    try:
        return int(x)
    except:
        return default

# ------------------------------------------------------------
# Init outputs
parts_keys = get_node_key_list(assembly) if assembly else []
parts = []
parts_frame = []
connections = []
connection_types = []
parts_points = []
damages = []          # keep as list like old script
all_damages = []
selected_damage = None
damage_f = None
damage_t = None
damage_d = None
damage_s = None

current_part = None
current_part_frame = None
current_img_path = None
current_part_vertex_points = []

# ------------------------------------------------------------
# Validate required inputs
if assembly is None:
    raise ValueError("assembly is None")

if not assignmentJson or not str(assignmentJson).strip():
    raise ValueError("assignmentJson input is empty")

if not damagesFolderPath or not os.path.isdir(str(damagesFolderPath)):
    raise ValueError("damagesFolderPath invalid: {}".format(damagesFolderPath))

assign_map = parse_assignment_map(assignmentJson)

# ------------------------------------------------------------

def get_assigned_brick_id(assign_map, key):
    ks = str(key)
    bid = assign_map.get(ks, None)
    if bid is None and ks.isdigit():
        bid = assign_map.get(str(int(ks)), None)
    return bid or "unassigned"

# ------------------------------------------------------------


# Current key and current part
current_key = counter
current_key_str = str(current_key)

# Determine which brick is assigned to this node
brick_id = assign_map.get(current_key_str, None)
if brick_id is None:
    # fallback: try if node keys are ints in assignment but you pass int
    brick_id = assign_map.get(str(int(current_key)), None) if str(current_key).isdigit() else None

# Get current part
current_p = get_part_by_key(assembly, current_key)

# Keep your old spacing in Y for visualization
current_p_frame = current_p.frame
T = Transformation.from_frame(current_p_frame)

# Draw current brick
current_part = box_to_rhino(current_p.shape.transformed(T))
current_part_frame = frame_to_rhino(current_p_frame)

# Preserve old fields, even if you do not use them
try:
    current_img_path = assembly.graph.node_attribute(current_key, "image_paths")
except:
    current_img_path = None

# Vertex points, like before
try:
    current_part_vertices = list(current_p.mesh.vertices())
    current_part_vertex_points = [
        point_to_rhino(current_p.mesh.vertex_point(v).transformed(T))
        for v in current_part_vertices
    ]
except:
    current_part_vertex_points = []

# ------------------------------------------------------------
# Show other parts, like your original script
if show == "show_all" or show == "show_all_damages":
    for key in parts_keys:
        if key != current_key:
            p = get_part_by_key(assembly, key)
            p_frame = p.frame
            parts.append(box_to_rhino(p.shape.transformed(Transformation.from_frame(p_frame))))
            parts_frame.append(frame_to_rhino(p_frame))
            brick_IDs.append(get_assigned_brick_id(assign_map, key))

if show == "show_until_key":
    # assumes parts_keys is ordered and counter is index, but you used key slicing before
    # keep behavior: use first counter+1 keys
    for key in parts_keys[0:counter+1]:
        if key != current_key:
            p = assembly.part(key)
            p_frame = p.frame
            parts.append(box_to_rhino(p.shape.transformed(Transformation.from_frame(p_frame))))
            parts_frame.append(frame_to_rhino(p_frame))
            brick_IDs.append(get_assigned_brick_id(assign_map, key))

# ------------------------------------------------------------
# Connections optional (kept minimal, without robot dependency)
if show_connections:
    try:
        for start, end in assembly.graph.edges():
            ps = get_part_by_key(assembly, start).frame.point
            pe = get_part_by_key(assembly, end).frame.point
            # apply same Y offset for display
            ps = Point(ps.x, ps.y, ps.z)
            pe = Point(pe.x, pe.y, pe.z)
            connections.append(line_to_rhino(Line(ps, pe)))
            try:
                connection_types.append(assembly.graph.edge_attribute((start, end), "type"))
            except:
                connection_types.append(None)

        parts_points = []
        for k in parts_keys:
            p = get_part_by_key(assembly, k)
            pt = p.frame.point
            pt = Point(pt.x, pt.y + 0.15 * safe_int(k), pt.z)
            parts_points.append(point_to_rhino(pt))
    except:
        pass

# ------------------------------------------------------------
# ------------------------------------------------------------
# Damage visualization
# Modes:
# default: only current brick (counter)
# show_all_damages: all nodes
# ------------------------------------------------------------

def _add_damages_for_node(node_key, part, part_frame_display, brick_id):
    """
    Appends damage list to 'damages' output and adds spheres to 'all_damages'.
    Uses the displayed frame so it matches exploded or in-place mode.
    """
    if brick_id is None:
        damages.append([])
        return

    dmg_list = load_brick_damage_file(str(damagesFolderPath), brick_id)
    damages.append(dmg_list)

    Tnode = Transformation.from_frame(part_frame_display)

    for i, d in enumerate(dmg_list):
        if not isinstance(d, dict):
            continue
        coords = d.get("coordinates", {})
        p = coords.get("point", None)
        if not p or not isinstance(p, (list, tuple)) or len(p) < 3:
            continue

        try:
            damage_value = int(d.get("value", 1))
        except:
            damage_value = 1

        damage_pt_local = Point(float(p[0]), float(p[1]), float(p[2]))
        damage_pt_world = damage_pt_local.transformed(Tnode)

        r = 0.002 * float(damage_value)
        damage_sphere = Sphere(r, frame=Frame(damage_pt_world))
        rh_sphere = sphere_to_rhino(damage_sphere)
        all_damages.append(rh_sphere)

        # Only set selected outputs for the CURRENT brick
        if str(node_key) == str(current_key) and safe_int(i) == safe_int(select, -1):
            global selected_damage, damage_f, damage_t, damage_d, damage_s
            selected_damage = rh_sphere
            damage_f = frame_to_rhino(Frame(damage_pt_world))
            damage_t = d.get("status", None)
            damage_d = d.get("description", None)
            damage_s = damage_value


# Decide which nodes to compute damages for
if show == "show_all_damages":
    # All nodes currently displayed
    for key in parts_keys:
        # Get assigned brick for node
        key_str = str(key)
        bid = assign_map.get(key_str, None)
        if bid is None and key_str.isdigit():
            bid = assign_map.get(str(int(key_str)), None)

        # Part and displayed frame must match how you draw parts
        p = get_part_by_key(assembly, key)
        p_frame_display = p.frame
        
        _add_damages_for_node(key, p, p_frame_display, bid)

else:
    # Only current brick (counter)
    _add_damages_for_node(current_key, current_p, current_p_frame, brick_id)


print(all_damages)
# ---------- end visualize ----------
# column_twisted assignmentJson: {"assignment":[{"nodeKey":"0","brickId":"stack1_brick26","usedDamageIdx":[],"note":"Bottommost node, assigned an undamaged brick (0)."},{"nodeKey":"1","brickId":"stack1_brick28","usedDamageIdx":[],"note":"Bottommost node, assigned an undamaged brick (0)."},{"nodeKey":"10","brickId":"stack1_brick8","usedDamageIdx":[],"note":"Mid-column, maintaining gradient with damage count 5."},{"nodeKey":"11","brickId":"stack1_brick24","usedDamageIdx":[],"note":"Mid-column, maintaining gradient with damage count 4."},{"nodeKey":"12","brickId":"stack1_brick19","usedDamageIdx":[],"note":"Upper-mid column, damage count 5."},{"nodeKey":"13","brickId":"stack1_brick27","usedDamageIdx":[],"note":"Upper-mid column, damage count 5."},{"nodeKey":"14","brickId":"stack1_brick29","usedDamageIdx":[],"note":"Upper column, high damage (7)."},{"nodeKey":"15","brickId":"stack1_brick12","usedDamageIdx":[],"note":"Upper column, continuing gradient with damage count 6."},{"nodeKey":"16","brickId":"stack1_brick1","usedDamageIdx":[],"note":"Upper column, high damage (7)."},{"nodeKey":"17","brickId":"stack1_brick9","usedDamageIdx":[],"note":"Upper column, high damage (7)."},{"nodeKey":"18","brickId":"stack1_brick11","usedDamageIdx":[],"note":"Top section, very high damage (8)."},{"nodeKey":"19","brickId":"stack1_brick23","usedDamageIdx":[],"note":"Top section, very high damage (8)."},{"nodeKey":"2","brickId":"stack1_brick13","usedDamageIdx":[],"note":"Bottom section, assigned brick with minimal damage (1)."},{"nodeKey":"20","brickId":"stack1_brick10","usedDamageIdx":[],"note":"Top section, very high damage (9)."},{"nodeKey":"21","brickId":"stack1_brick38","usedDamageIdx":[],"note":"Top section, very high damage (9)."},{"nodeKey":"22","brickId":"stack1_brick2","usedDamageIdx":[],"note":"Topmost node, assigned a brick with maximum damage (10)."},{"nodeKey":"23","brickId":"stack1_brick14","usedDamageIdx":[],"note":"Topmost node, assigned a brick with maximum damage (10)."},{"nodeKey":"3","brickId":"stack1_brick18","usedDamageIdx":[],"note":"Bottom section, assigned brick with minimal damage (1)."},{"nodeKey":"4","brickId":"stack1_brick17","usedDamageIdx":[],"note":"Lower section, low damage (2)."},{"nodeKey":"5","brickId":"stack1_brick3","usedDamageIdx":[],"note":"Lower section, low damage (2)."},{"nodeKey":"6","brickId":"stack1_brick15","usedDamageIdx":[],"note":"Lower section, damage count 3."},{"nodeKey":"7","brickId":"stack1_brick16","usedDamageIdx":[],"note":"Lower section, damage count 3."},{"nodeKey":"8","brickId":"stack1_brick32","usedDamageIdx":[],"note":"Lower-mid column, damage count 4."},{"nodeKey":"9","brickId":"stack1_brick33","usedDamageIdx":[],"note":"Lower-mid column, damage count 4."}],"notes":"A vertical gradient of damage was created by sorting nodes by height and assigning bricks with damage counts decreasing from top to bottom. The most damaged bricks (count 10) are at the top, and undamaged bricks (count 0) are at the bottom, with a smooth transition in between to create high polarity."}
panel_7 = Panel(visualize.out)
damage_2 = ControlKnob(Decimals=0, Limit=True, Maximum=10, Minimum=0, Range=10, Value=0)
text_tag = TextTag(Location=visualize.parts_frame, Text=visualize.brick_IDs)
panel_8 = Panel(visualize.current_img_path)
damages = Python3Script(current_part_frame=visualize.current_part_frame, damages=visualize.damages, select=damage_2)  # -> all_damages, selected_damage, damage_f, damage_t, damage_s, damage_d
# ---------- damages: Python ----------
from compas.geometry import Frame, Sphere, Translation
from compas_rhino.conversions import sphere_to_rhino, frame_to_rhino, plane_to_compas_frame

# damages = damages[2]
all_damages = []
current_part_frame = plane_to_compas_frame(current_part_frame)

for damage_key, damage in damages.items():
    damage_frame = Frame(damage["coordinates"]["point"])
    damage_value = damage["value"]
    damage_sphere = Sphere(0.002*damage_value, frame=damage_frame).transformed(Translation.from_vector(current_part_frame.point))
    all_damages.append(sphere_to_rhino(damage_sphere))

    if int(damage_key) == select:
        selected_damage = sphere_to_rhino(damage_sphere)
        damage_f = frame_to_rhino(damage_frame.transformed(Translation.from_vector(current_part_frame.point)))
        damage_t = damage["status"]
        damage_d = damage["description"]
        damage_s = damage_value
# ---------- end damages ----------
geometry = Geometry(visualize.current_part)
geometry_2 = Geometry(visualize.parts)
geometry_3 = Geometry(visualize.parts_frame)
move = Move(Geometry=damages.damage_f, Motion=Vector(0, 0, 0.01))  # -> Geometry, Transform
panel_9 = Panel(damages.damage_s)
colour_swatch = ColourSwatch(SwatchColor=RGB(0, 0, 0))
text_tag_2 = TextTag(Location=move.Geometry, Text=damages.damage_t, Colour=colour_swatch)
text_tag_3 = TextTag(Location=damages.damage_f, Text=damages.damage_d, Colour=colour_swatch)
custom_preview = CustomPreview(Geometry=geometry_3, Material=ColourSwatch(SwatchColor=RGB(125, 102, 57)))
number_slider = Slider(0, range=0..10)
list_item = ListItem(List=visualize.current_part_vertex_points, Index=number_slider, Wrap=True)
list_item_2 = ListItem(List=visualize.current_part_vertices, Index=number_slider, Wrap=True)
panel_10 = Panel(list_item_2)
panel_11 = Panel(list_item)
text_tag_4 = TextTag(Location=visualize.current_part_frame, Text=visualize.current_key)
text_tag_5 = TextTag(
    Location=visualize.current_part_vertex_points,
    Text=visualize.current_part_vertices,
    Colour=ColourSwatch(SwatchColor=RGB(25, 0, 255)))
custom_preview_2 = CustomPreview(Geometry=geometry, Material=ColourSwatch(SwatchColor=RGBA(252, 83, 83, 186)))
custom_preview_3 = CustomPreview(Geometry=[geometry, geometry_2], Material=ColourSwatch(SwatchColor=RGBA(255, 138, 138, 137)))
geometry_4 = Geometry(damages.selected_damage)
custom_preview_4 = CustomPreview(Geometry=geometry_4, Material=ColourSwatch(SwatchColor=RGBA(255, 23, 23, 216)))
geometry_5 = Geometry(visualize.all_damages)
python_3_script = Python3Script(planes=visualize.current_part_frame, scale=Slider(0.2, range=0..1))  # -> P, V, C, W; inputs planes: list of Plane, scale: Double
# ---------- python_3_script: Python ----------
from Rhino.Display import ColorRGBA
from ghpythonlib.components import ColourRGBf


red = ColourRGBf(255, 255, 0, 0)
green = ColourRGBf(255, 0, 255, 0)
blue = ColourRGBf(255, 0, 0, 255)

P = []
V = []
C = []

# scale = float(scale)

for plane in planes:
    if not plane:
        continue
    P += [plane.Origin] * 3
    V.append(plane.XAxis * scale)
    V.append(plane.YAxis * scale)
    V.append(plane.ZAxis * scale)
    C += [red, green, blue]

W = 3
# ---------- end python_3_script ----------
line = Line(visualize.connections)
custom_preview_5 = CustomPreview(Geometry=geometry_5, Material=ColourSwatch(SwatchColor=RGBA(255, 221, 0, 216)))
custom_curve_preview = CustomCurvePreview(Curve=line, Linetype="Continuous", Colour=ColourSwatch(SwatchColor=RGB(255, 0, 64)))
vector_display_ex = VectorDisplayEx(Point=python_3_script.P, Vector=python_3_script.V, Colour=python_3_script.C, Width=python_3_script.W)
