# Grasshopper definition 03_a_material_population_genAI_v2_built_only.ghx (Grasshopper 1.0.8)

run_generative_reassigning = Button()
new_output_assembly_name = Panel("reaassemblydesign-4")
system_prompt = Panel(""""Return ONLY valid JSON.\n"
"Required output format:\n"
"{\n"
"  \"assignments\": {\"<target_node_key>\": \"<brick_id>\", ...},\n"
"  \"unassigned_targets\": [\"<target_node_key>\", ...],\n"
"  \"unused_bricks\": [\"<brick_id>\", ...],\n"
"  \"notes\": \"short\"\n"
"}\n"
"Rules (hard):\n"
"- Every target_node_key must appear exactly once in assignments OR in unassigned_targets.\n"
"- Each brick_id may appear at most once in assignments.\n"
"- If you cannot assign uniquely, put remaining targets in unassigned_targets.\n"
"- JSON only, no markdown.\n"
""")
user_prompt = Panel("""Assign bricks to the column so damage severity forms a clear vertical gradient with high polarity between the start and end.

Top region must use the most damaged bricks available in the set.
Bottom region must use only bricks with zero or only little damages.

Between top and bottom, choose bricks so that severity decreases smoothly with height.""")
reassembly_structure = FilePath("C:\Users\Avishek\workspace\projects\workshop_iaac_2026\data\assembly\260224_new_assembly_design_2.json")
material_stack_with_damages = FilePath("C:\Users\Avishek\workspace\projects\workshop_iaac_2026\data\assembly\material_stack_4_with_damages.json")
make_a_new_json = BooleanToggle(True)
need_to_assign_all_bricks_in_target = BooleanToggle(False)
path = Python3Script(filename="GeminiKey")  # -> out, DATA
# ---------- path: Python ----------
import os
import getpass

username = getpass.getuser()
USER_FOLDER = os.path.abspath(os.path.join("C:/Users/", username))
DATA = os.path.abspath(os.path.join(USER_FOLDER,"workspace/{}.txt".format(filename)))

print(USER_FOLDER)
print(DATA)
# ---------- end path ----------
run = Button()
assembly_path = Python3Script(filename=new_output_assembly_name)  # -> out, DATA
# ---------- assembly_path: Python ----------
import os
import getpass

username = getpass.getuser()
USER_FOLDER = os.path.abspath(os.path.join("C:/Users/", username))
DATA = os.path.abspath(os.path.join(USER_FOLDER,"workspace/projects/workshop_iaac_2026/data/assembly/{}.json".format(filename)))

print(USER_FOLDER)
print(DATA)
# ---------- end assembly_path ----------
# Test the Connection by writing a Poem
connection_test_to_vlm = Python3Script(keyPath=path.DATA, run=run)  # -> log, haiku; inputs keyPath: String
# ---------- connection_test_to_vlm: Python ----------
# r: google-generativeai
import google.generativeai as genai
import time
import os
import scriptcontext as sc

KEY_TEXT = "gemini_last_text"
KEY_LOG = "gemini_last_log"
KEY_ERR = "gemini_last_error"
KEY_TIME = "gemini_last_time"

if KEY_TEXT not in sc.sticky:
    sc.sticky[KEY_TEXT] = ""
if KEY_LOG not in sc.sticky:
    sc.sticky[KEY_LOG] = []
if KEY_ERR not in sc.sticky:
    sc.sticky[KEY_ERR] = None
if KEY_TIME not in sc.sticky:
    sc.sticky[KEY_TIME] = None

# Read stored values first so outputs always show something
haiku = sc.sticky.get(KEY_TEXT, "")
log_list = sc.sticky.get(KEY_LOG, [])
error = sc.sticky.get(KEY_ERR, None)
executionTime = sc.sticky.get(KEY_TIME, None)

if not isinstance(log_list, list):
    log_list = [str(log_list)]

def _sanitize_key(raw):
    if raw is None:
        return ""
    k = raw

    # Remove UTF-8 BOM if present
    if len(k) > 0 and ord(k[0]) == 65279:
        k = k[1:]

    k = k.strip()

    # Remove wrapping quotes if file contains "AIza..." or 'AIza...'
    if (k.startswith('"') and k.endswith('"')) or (k.startswith("'") and k.endswith("'")):
        k = k[1:-1].strip()

    # If multiple lines, take first non-empty line
    if "\n" in k or "\r" in k:
        parts = [p.strip() for p in k.replace("\r", "\n").split("\n") if p.strip()]
        k = parts[0] if parts else ""

    return k.strip()

def mask_key(k):
    if not k:
        return ""
    if len(k) <= 8:
        return "*" * len(k)
    return k[:4] + "..." + k[-4:]

if run:
    startTime = time.time()
    log_list = []
    error = None
    executionTime = None

    log_list.append("Starting Gemini API connection test...")

    try:
        if not keyPath or not str(keyPath).strip():
            raise Exception("keyPath input is missing.")

        kp = str(keyPath).strip()
        log_list.append("Loading API key from: {}".format(kp))

        if not os.path.exists(kp):
            raise Exception("API key file not found at given path: {}".format(kp))

        with open(kp, "r") as file:
            raw = file.read()

        apiKey = _sanitize_key(raw)
        if not apiKey:
            log_list.append("API key file is empty or contains only whitespace.")

        log_list.append("API key loaded successfully.")
        log_list.append("API key preview: {}".format(mask_key(apiKey)))

        genai.configure(api_key=apiKey)
        log_list.append("API configured.")

        model = genai.GenerativeModel("gemini-2.5-flash-lite")
        log_list.append("Model initialized: gemini-2.5-flash-lite")

        prompt = "Write a haiku from the perspective of a robot."
        log_list.append('Sending prompt: "{}"'.format(prompt))

        response = model.generate_content(prompt)
        textOut = response.text or ""

        log_list.append("SUCCESS! Connection established.")
        log_list.append("Text received.")

    except Exception as e:
        error = "FAILED! Error: {}".format(e)
        log_list.append(error)

    executionTime = time.time() - startTime
    log_list.append("Execution finished in {:.3f}s".format(executionTime))

    # Store results so they remain after the button returns to False
    sc.sticky[KEY_TEXT] = textOut
    sc.sticky[KEY_LOG] = log_list
    sc.sticky[KEY_ERR] = error
    sc.sticky[KEY_TIME] = executionTime

# Output values every run
log = "\n".join(log_list)

# Suggested GH outputs:
# textOut -> panel
# error -> panel
# executionTime -> panel
# log -> panel
# ---------- end connection_test_to_vlm ----------
panel = Panel(connection_test_to_vlm.haiku)
panel_2 = Panel(connection_test_to_vlm.log)
ai_brick_assignment = Python3Script(
    run=run_generative_reassigning,
    api_key_path=path.DATA,
    system_prompt=system_prompt,
    user_prompt=user_prompt,
    target_path=reassembly_structure,
    source_path=material_stack_with_damages,
    output_path=assembly_path.DATA,
    write_file=make_a_new_json,
    require_full_assignment=need_to_assign_all_bricks_in_target,
    use_only_built=Toggle(True))  # -> is_running, updated_json, wrote_file, output_assembly_path, assigned_count, unassigned_count, unassigned_targets, error, log; inputs run: Boolean, require_full_assignment: Boolean, use_only_built: Boolean
# ---------- ai_brick_assignment: Python ----------
#! python 3
# r: google-genai
"""
GENAI Brick Assignment (Grasshopper Python Component)
- NO algorithmic assignment / NO local damage computation.
- Gemini decides the mapping based on system_prompt + user_prompt + provided data.
- Enforces uniqueness by asking Gemini to REPAIR its own output if duplicates appear.
- Allows PARTIAL assignment when supply is low (no error by default).
- OPTION A: If prompts are empty/unconnected, output DEFAULT prompts.
- output_assembly_path output is set ONLY after generation is done
  (it will be output_path if wrote_file=True else empty string).
- NEW: Optional filtering of supply bricks by node["built"] == True
       (robust for IronPython/.NET dictionary-like JSON objects).
- NEW DEFAULT: use_only_built defaults to TRUE if input is missing/unconnected.

============================================================
GRASSHOPPER INPUTS
============================================================
run                     : bool
api_key_path            : str
system_prompt           : str
user_prompt             : str
target_path             : str
source_path             : str
output_path             : str   (full file path incl. filename, used when write_file=True)
write_file              : bool
require_full_assignment : bool  (optional; default False)
use_only_built          : bool  (optional; default True)
                          - False: use all supply bricks from damaged stack
                          - True : use only bricks with built==True in damaged stack

============================================================
GRASSHOPPER OUTPUTS
============================================================
exposed_system_prompt : str
exposed_user_prompt   : str
is_running            : bool
updated_json          : str
wrote_file            : bool
output_assembly_path  : str   (set ONLY after run finishes; empty if not written)
assigned_count        : int
unassigned_count      : int
unassigned_targets    : list[str]
error                 : str
log                   : list[str]
"""

import scriptcontext as sc
import json
import os
import time
import threading
import re
from google import genai

# ----------------------------
# Model
# ----------------------------
MODEL_ID = "gemini-2.5-flash"

# ----------------------------
# Default prompts (OPTION A)
# ----------------------------
def _nonempty(s):
    if s is None:
        return ""
    t = str(s)
    return t if t.strip() else ""

DEFAULT_SYSTEM_PROMPT = (
    "You are an assignment engine for brick reuse.\n"
    "You will receive:\n"
    "- supply_bricks: list of bricks with brick_id and raw damages\n"
    "- target_node_keys: list of nodes that may receive a brick\n"
    "- user_prompt: objective/strategy\n\n"
    "Return ONLY valid JSON in the required format.\n"
    "Hard rules:\n"
    "1) Each brick_id may appear at most once in assignments.\n"
    "2) Every target_node_key must be accounted for: either in assignments OR in unassigned_targets.\n"
    "3) Do NOT invent brick ids. Use only those provided.\n"
    "4) If supply is insufficient or constraints prevent unique assignment, put remaining targets in unassigned_targets.\n"
    "5) JSON only. No markdown. No extra text.\n"
)

DEFAULT_USER_PROMPT = (
    "Assign available bricks to target nodes. Prefer assigning bricks that have fewer/less severe damages to more critical "
    "targets (if that concept exists), and leave remaining targets unassigned if supply is insufficient."
)

# ----------------------------
# Sticky keys
# ----------------------------
KEY_RUNNING          = "gemini_assign_running"
KEY_RESULT_JSON      = "gemini_assign_result_json"
KEY_ERROR            = "gemini_assign_error"
KEY_LOG              = "gemini_assign_log"
KEY_LAST_EDGE        = "gemini_assign_last_run_edge"
KEY_ASSIGNED_COUNT   = "gemini_assign_assigned_count"
KEY_UNASSIGNED       = "gemini_assign_unassigned_targets"
KEY_OUTPUT_ASM_PATH  = "gemini_assign_output_assembly_path"

if KEY_RUNNING not in sc.sticky:         sc.sticky[KEY_RUNNING] = False
if KEY_RESULT_JSON not in sc.sticky:     sc.sticky[KEY_RESULT_JSON] = None
if KEY_ERROR not in sc.sticky:           sc.sticky[KEY_ERROR] = None
if KEY_LOG not in sc.sticky:             sc.sticky[KEY_LOG] = []
if KEY_LAST_EDGE not in sc.sticky:       sc.sticky[KEY_LAST_EDGE] = False
if KEY_ASSIGNED_COUNT not in sc.sticky:  sc.sticky[KEY_ASSIGNED_COUNT] = 0
if KEY_UNASSIGNED not in sc.sticky:      sc.sticky[KEY_UNASSIGNED] = []
if KEY_OUTPUT_ASM_PATH not in sc.sticky: sc.sticky[KEY_OUTPUT_ASM_PATH] = ""

# ----------------------------
# Helpers (robust mapping)
# ----------------------------
def _strip_code_fences(text):
    if not text:
        return text
    t = text.strip()
    if t.startswith("```json"):
        t = t[7:].strip()
        if t.endswith("```"):
            t = t[:-3].strip()
        return t
    if t.startswith("```"):
        t = t[3:].strip()
        if t.endswith("```"):
            t = t[:-3].strip()
        return t
    return t

def _norm_key(k):
    try:
        return str(k).strip().lower()
    except:
        return ""

def _map_keys(m):
    if m is None:
        return []
    try:
        if isinstance(m, dict):
            return list(m.keys())
    except:
        pass
    try:
        if hasattr(m, "Keys"):
            return list(m.Keys)
    except:
        pass
    try:
        return list(m)
    except:
        return []

def _map_get(m, key, default=None):
    if m is None:
        return default
    try:
        if isinstance(m, dict):
            return m.get(key, default)
    except:
        pass
    try:
        if hasattr(m, "ContainsKey") and m.ContainsKey(key):
            return m[key]
    except:
        pass
    try:
        return m[key]
    except:
        return default

def _map_get_fuzzy(m, key, default=None):
    v = _map_get(m, key, None)
    if v is not None:
        return v
    want = _norm_key(key)
    for k in _map_keys(m):
        if _norm_key(k) == want:
            return _map_get(m, k, default)
    return default

def _safe_get_any(root, path, default=None):
    cur = root
    for part in path.split("."):
        if cur is None:
            return default
        nxt = _map_get_fuzzy(cur, part, None)
        if nxt is None:
            return default
        cur = nxt
    return cur

def _sanitize_key(raw):
    if raw is None:
        return ""
    k = raw
    try:
        if len(k) > 0 and ord(k[0]) == 65279:
            k = k[1:]
    except:
        pass
    k = str(k).strip()
    if (k.startswith('"') and k.endswith('"')) or (k.startswith("'") and k.endswith("'")):
        k = k[1:-1].strip()
    if "\n" in k or "\r" in k:
        parts = [p.strip() for p in k.replace("\r", "\n").split("\n") if p.strip()]
        k = parts[0] if parts else ""
    return k.strip()

def _to_bool(v):
    if v is None:
        return False
    try:
        if isinstance(v, (str, unicode)):
            s = v.strip().lower()
            if s in ("true", "t", "1", "yes", "y"):
                return True
            if s in ("false", "f", "0", "no", "n", ""):
                return False
            return True
    except:
        pass
    try:
        if isinstance(v, (int, float, long)):
            return v != 0
    except:
        pass
    try:
        return bool(v)
    except:
        return False

def load_api_key_from_path(key_path):
    if not key_path or not str(key_path).strip():
        raise ValueError("api_key_path is missing.")
    kp = str(key_path).strip()
    if not os.path.exists(kp):
        raise ValueError("API key file not found: {}".format(kp))
    with open(kp, "r") as f:
        raw = f.read()
    api_key = _sanitize_key(raw)
    if not api_key:
        raise ValueError("API key file is empty or invalid.")
    return api_key

def load_json_path(path):
    if not path or not str(path).strip():
        raise ValueError("Path is missing.")
    p = str(path).strip()
    if not os.path.exists(p):
        raise ValueError("File not found: {}".format(p))
    with open(p, "r") as f:
        return json.load(f)

def write_json_path(obj, path):
    if not path or not str(path).strip():
        raise ValueError("output_path is empty.")
    p = str(path).strip()
    out_dir = os.path.dirname(p)
    if out_dir and not os.path.exists(out_dir):
        os.makedirs(out_dir)
    with open(p, "w") as f:
        json.dump(obj, f, ensure_ascii=False, indent=2)

def read_source_stack_key(material_stack_obj, material_stack_path=None):
    candidates = [
        "data.graph.attributes.stack_key",
        "data.graph.attributes.source_stack_key",
        "data.attributes.stack_key",
        "data.attributes.source_stack_key",
        "stack_key",
        "source_stack_key",
    ]
    for p in candidates:
        v = _safe_get_any(material_stack_obj, p, None)
        if v is not None:
            try:
                return int(v)
            except:
                pass
    if material_stack_path:
        fn = os.path.basename(str(material_stack_path))
        m = re.search(r"material[_-]?stack[_-]?(\d+)", fn, re.IGNORECASE)
        if m:
            try:
                return int(m.group(1))
            except:
                pass
    return 0

def trigger_gh_update():
    gh_doc = ghenv.Component.OnPingDocument()
    if gh_doc:
        for obj in gh_doc.Objects:
            if obj.InstanceGuid == ghenv.Component.InstanceGuid:
                obj.ExpireSolution(True)
                return

def find_duplicates(assignments):
    used = {}
    for tk, bid in assignments.items():
        bid = str(bid)
        used.setdefault(bid, []).append(str(tk))
    return {bid: tks for bid, tks in used.items() if len(tks) > 1}

def build_repair_payload(payload, parsed, dup_map, available_bricks, target_node_keys):
    targets_to_reassign = []
    for bid, tks in dup_map.items():
        for t in tks[1:]:
            targets_to_reassign.append(t)
    return {
        "original_payload": payload,
        "previous_model_output": parsed,
        "duplicates": dup_map,
        "targets_to_reassign": targets_to_reassign,
        "available_bricks": sorted(list(available_bricks)),
        "all_target_node_keys": target_node_keys
    }

def _request_instruction():
    return (
        "Return ONLY valid JSON.\n"
        "Required output format:\n"
        "{\n"
        "  \"assignments\": {\"<target_node_key>\": \"<brick_id>\", ...},\n"
        "  \"unassigned_targets\": [\"<target_node_key>\", ...],\n"
        "  \"unused_bricks\": [\"<brick_id>\", ...],\n"
        "  \"notes\": \"short\"\n"
        "}\n"
        "Rules (hard):\n"
        "- Each brick_id may appear at most once in assignments.\n"
        "- Every target_node_key must appear either in assignments OR in unassigned_targets.\n"
        "- If you cannot assign uniquely, put remaining targets in unassigned_targets.\n"
        "- Do NOT invent brick ids. Use only those provided.\n"
        "- JSON only, no markdown.\n"
    )

def _repair_instruction():
    return (
        "You produced duplicate brick_id usage.\n"
        "REPAIR the JSON now.\n"
        "Return ONLY JSON in the SAME format as before.\n"
        "Rules:\n"
        "- Keep all existing assignments unchanged EXCEPT for targets_to_reassign.\n"
        "- Reassign targets_to_reassign using ONLY available_bricks.\n"
        "- Do not create duplicates.\n"
        "- Ensure every target is either assigned or listed in unassigned_targets.\n"
        "- JSON only, no markdown.\n"
    )

def _fmt_time(epoch_seconds):
    try:
        return time.strftime("%Y-%m-%d %H:%M:%S", time.localtime(epoch_seconds))
    except:
        return str(epoch_seconds)

# ----------------------------
# GenAI worker
# ----------------------------
def run_assignment(
    api_key_path,
    system_prompt,
    user_prompt,
    target_path,
    source_path,
    output_path,
    write_file,
    require_full_assignment,
    use_only_built
):
    log = []
    start_t = time.time()
    log.append("Generation started: {}".format(_fmt_time(start_t)))

    try:
        sc.sticky[KEY_ERROR] = None
        sc.sticky[KEY_RESULT_JSON] = None
        sc.sticky[KEY_LOG] = []
        sc.sticky[KEY_ASSIGNED_COUNT] = 0
        sc.sticky[KEY_UNASSIGNED] = []
        sc.sticky[KEY_OUTPUT_ASM_PATH] = ""

        api_key = load_api_key_from_path(api_key_path)
        log.append("Loaded API key from file.")

        target_asm = load_json_path(target_path)
        stack_asm  = load_json_path(source_path)

        stack_key = read_source_stack_key(stack_asm, material_stack_path=source_path)
        log.append("Read source_stack_key={} from damaged JSON.".format(stack_key))

        stack_nodes = _safe_get_any(stack_asm, "data.graph.node", {}) or {}

        supply = []
        supply_ids = []

        if bool(use_only_built):
            log.append("Supply filter: using ONLY bricks with built==True.")
        else:
            log.append("Supply filter: using ALL bricks (built True/False).")

        total_count = 0
        built_true_count = 0

        if isinstance(stack_nodes, dict):
            iterator = stack_nodes.items()
        else:
            keys = _map_keys(stack_nodes)
            iterator = [(k, _map_get(stack_nodes, k, None)) for k in keys]

        for brick_id, brick_data in iterator:
            total_count += 1

            built_raw = _map_get_fuzzy(brick_data, "built", None)
            built_val = _to_bool(built_raw)
            if built_val:
                built_true_count += 1

            if bool(use_only_built) and (not built_val):
                continue

            bid = str(brick_id)
            supply_ids.append(bid)
            damages_raw = _map_get_fuzzy(brick_data, "damages", {})
            supply.append({
                "brick_id": bid,
                "damages": damages_raw if damages_raw is not None else {}
            })

        log.append("Supply bricks: total_nodes={}, built_true={}, used_after_filter={}".format(
            total_count, built_true_count, len(supply_ids)
        ))

        if len(supply_ids) == 0:
            raise ValueError("No supply bricks available after filtering. (use_only_built={})".format(bool(use_only_built)))

        target_nodes = _safe_get_any(target_asm, "data.graph.node", {}) or {}
        if isinstance(target_nodes, dict):
            target_node_keys = [str(k) for k in target_nodes.keys()]
        else:
            target_node_keys = [str(k) for k in _map_keys(target_nodes)]

        payload = {
            "task": "Assign one unique supply brick to each target node.",
            "constraints": {
                "use_each_brick_at_most_once": True,
                "all_targets_must_be_accounted_for": True
            },
            "source_stack_key": int(stack_key),
            "supply_bricks": supply,
            "target_node_keys": target_node_keys,
            "user_prompt": "" if user_prompt is None else str(user_prompt)
        }

        client = genai.Client(api_key=api_key)
        config = {
            "temperature": 0.0,
            "response_mime_type": "application/json",
            "system_instruction": "" if system_prompt is None else str(system_prompt),
        }

        log.append("Calling Gemini model: {}".format(MODEL_ID))

        response = client.models.generate_content(
            model=MODEL_ID,
            config=config,
            contents=[_request_instruction(), json.dumps(payload)]
        )

        raw = getattr(response, "text", None)
        if raw is None:
            raise ValueError("Gemini response has no .text. Response: {}".format(str(response)))

        parsed = json.loads(_strip_code_fences(raw))

        assignments = parsed.get("assignments", {})
        if not isinstance(assignments, dict):
            raise ValueError("Model output missing 'assignments' dict.")

        unassigned = parsed.get("unassigned_targets", [])
        if unassigned is None: unassigned = []
        if not isinstance(unassigned, list): unassigned = []

        dup_map = find_duplicates(assignments)
        if dup_map:
            log.append("Duplicate brick_ids detected. Requesting model repair...")

            used_ids = set([str(b) for b in assignments.values()])
            supply_set = set([str(x) for x in supply_ids])
            available_ids = supply_set - used_ids

            repair_payload = build_repair_payload(
                payload=payload,
                parsed=parsed,
                dup_map=dup_map,
                available_bricks=available_ids,
                target_node_keys=target_node_keys
            )

            repair_resp = client.models.generate_content(
                model=MODEL_ID,
                config=config,
                contents=[_repair_instruction(), json.dumps(repair_payload)]
            )

            repair_raw = getattr(repair_resp, "text", None)
            if repair_raw is None:
                raise ValueError("Repair response has no .text. Response: {}".format(str(repair_resp)))

            repair_parsed = json.loads(_strip_code_fences(repair_raw))

            assignments = repair_parsed.get("assignments", {})
            if not isinstance(assignments, dict):
                raise ValueError("Repair output missing 'assignments' dict.")

            unassigned = repair_parsed.get("unassigned_targets", [])
            if unassigned is None: unassigned = []
            if not isinstance(unassigned, list): unassigned = []

            dup_map2 = find_duplicates(assignments)
            if dup_map2:
                raise ValueError("Repair still has duplicate brick_ids: {}".format(str(dup_map2)))

            parsed = repair_parsed
            log.append("Repair successful. Proceeding...")

        assigned_targets = set([str(k) for k in assignments.keys()])
        unassigned_targets = set([str(x) for x in unassigned])

        missing = [tk for tk in target_node_keys if (tk not in assigned_targets and tk not in unassigned_targets)]
        if missing:
            raise ValueError(
                "Model output missing targets (neither assigned nor unassigned). Example: {}".format(
                    ", ".join(missing[:10])
                )
            )

        if bool(require_full_assignment) and len(unassigned_targets) > 0:
            raise ValueError(
                "Model left {} targets unassigned. Example: {}".format(
                    len(unassigned_targets), ", ".join(list(unassigned_targets)[:10])
                )
            )

        nodes = _safe_get_any(target_asm, "data.graph.node", None)
        if nodes is None:
            raise ValueError("Target assembly has no data.graph.node.")

        used_bricks = set()
        applied = 0

        for target_key, brick_id in assignments.items():
            bid = str(brick_id)
            if bid in used_bricks:
                raise ValueError("Internal validation: duplicate brick_id '{}' remains.".format(bid))
            used_bricks.add(bid)

            tkey = str(target_key)
            if isinstance(nodes, dict):
                if tkey not in nodes:
                    continue
                if not isinstance(nodes[tkey], dict):
                    nodes[tkey] = {}
                nodes[tkey]["source_stack_key"] = int(stack_key)
                nodes[tkey]["source_brick_key"] = bid
                applied += 1

        sc.sticky[KEY_ASSIGNED_COUNT] = int(applied)
        sc.sticky[KEY_UNASSIGNED] = sorted(list(unassigned_targets))

        updated_json_str = json.dumps(target_asm, ensure_ascii=False, indent=2)
        sc.sticky[KEY_RESULT_JSON] = updated_json_str

        if bool(write_file):
            write_json_path(target_asm, output_path)
            sc.sticky[KEY_OUTPUT_ASM_PATH] = str(output_path)
            log.append("Wrote updated JSON to: {}".format(str(output_path)))
        else:
            sc.sticky[KEY_OUTPUT_ASM_PATH] = ""

        log.append("Assigned {} nodes.".format(applied))
        log.append("Unassigned {} nodes.".format(len(unassigned_targets)))

    except Exception as e:
        sc.sticky[KEY_ERROR] = str(e)
        log.append("ERROR: {}".format(str(e)))
        sc.sticky[KEY_OUTPUT_ASM_PATH] = ""

    finally:
        end_t = time.time()
        log.append("Generation ended: {}".format(_fmt_time(end_t)))
        log.append("Elapsed: {:.2f} s".format(end_t - start_t))

        sc.sticky[KEY_LOG] = log
        sc.sticky[KEY_RUNNING] = False
        try:
            trigger_gh_update()
        except:
            pass

# ----------------------------
# Grasshopper execution (edge-triggered)
# ----------------------------
run = bool(run) if 'run' in globals() and run is not None else False
write_file = bool(write_file) if 'write_file' in globals() and write_file is not None else False
require_full_assignment = bool(require_full_assignment) if 'require_full_assignment' in globals() and require_full_assignment is not None else False

# ✅ NEW DEFAULT: True when missing/unconnected
use_only_built = bool(use_only_built) if 'use_only_built' in globals() and use_only_built is not None else True

exposed_system_prompt = _nonempty(system_prompt) or DEFAULT_SYSTEM_PROMPT
exposed_user_prompt   = _nonempty(user_prompt) or DEFAULT_USER_PROMPT

last_edge = sc.sticky.get(KEY_LAST_EDGE, False)
start_now = (run is True) and (last_edge is False) and (sc.sticky.get(KEY_RUNNING) is False)
sc.sticky[KEY_LAST_EDGE] = run

if start_now:
    sc.sticky[KEY_RUNNING] = True
    sc.sticky[KEY_RESULT_JSON] = None
    sc.sticky[KEY_ERROR] = None
    sc.sticky[KEY_ASSIGNED_COUNT] = 0
    sc.sticky[KEY_UNASSIGNED] = []
    sc.sticky[KEY_OUTPUT_ASM_PATH] = ""
    sc.sticky[KEY_LOG] = ["Starting background Gemini assignment..."]

    thread = threading.Thread(
        target=run_assignment,
        args=(api_key_path, exposed_system_prompt, exposed_user_prompt,
              target_path, source_path, output_path, write_file,
              require_full_assignment, use_only_built)
    )
    thread.daemon = True
    thread.start()

# ----------------------------
# Outputs
# ----------------------------
is_running = sc.sticky.get(KEY_RUNNING, False)
updated_json = sc.sticky.get(KEY_RESULT_JSON, None)
error = sc.sticky.get(KEY_ERROR, None)
log = sc.sticky.get(KEY_LOG, [])

assigned_count = int(sc.sticky.get(KEY_ASSIGNED_COUNT, 0))
unassigned_targets = sc.sticky.get(KEY_UNASSIGNED, [])
unassigned_count = len(unassigned_targets)

wrote_file = False
if isinstance(log, list):
    wrote_file = any(("Wrote updated JSON to:" in str(x)) for x in log)

output_assembly_path = sc.sticky.get(KEY_OUTPUT_ASM_PATH, "")
if is_running:
    output_assembly_path = ""
# ---------- end ai_brick_assignment ----------
json_as_output = Panel(ai_brick_assignment.updated_json)
is_the_process_running = Panel(ai_brick_assignment.is_running)
status_and_file_writing_status = Panel(ai_brick_assignment.wrote_file)
error = Panel(ai_brick_assignment.error)
log = Panel(ai_brick_assignment.log)
json_file_output_path = Panel(ai_brick_assignment.output_assembly_path)
how_many_bricks_assigned = Panel(ai_brick_assignment.assigned_count)
how_many_bricks_unassigned = Panel(ai_brick_assignment.unassigned_count)
which_bricks_unassigned = Panel(ai_brick_assignment.unassigned_targets)

import = Button(ExpressionNormal="True", ExpressionPressed="False")
initial_assembly = Python3Script(DATA=json_file_output_path, import_from_json=import)  # -> out, assembly
# ---------- initial_assembly: Python ----------
import os
import json

from assembly_information_model import Assembly

if import_from_json:   
    PATH = DATA
    print(PATH)
    assembly = Assembly.from_json(PATH)
    print(assembly)
# ---------- end initial_assembly ----------

pln = Plane(PlaneXY(0.59901243, 0.02820264453, 0))
transform_assembly = Python3Script(assembly=initial_assembly.assembly, ref_plane=pln, transform=Toggle(False))  # -> out, assembly
# ---------- transform_assembly: Python ----------
from compas.geometry import Frame, Transformation, Rotation, Translation
from compas_rhino.conversions import plane_to_compas_frame, point_to_rhino, frame_to_rhino

center_frame = Frame.worldXY()
# center_frame_new = plane_to_compas_frame(center_plane_new)

if transform:
    copy_assembly = assembly.copy()
    # T = Transformation.from_frame_to_frame(center_frame, stack_frame)
    T = Transformation.from_frame_to_frame(center_frame, plane_to_compas_frame(ref_plane))
    
   # Here transform both the frame and planned frame of every brick.
    for key in copy_assembly.part_keys():
        p = copy_assembly.part(key)
        p.frame = p.frame.transformed(T)

    assembly = copy_assembly
# ---------- end transform_assembly ----------

start = Button()
stop = Button()
step = Button()
back = Button()
reset = Button()
full = Button()
list = ValueList({"20", "50", "100", "500", "1000", "5000"}, selected="500")
counter = Python3Script(
    my_assembly=transform_assembly.assembly,
    start=start,
    stop=stop,
    step=step,
    step_back=back,
    reset=reset,
    full=full,
    interval=list)  # -> out, counter
# ---------- counter: Python ----------
from scriptcontext import sticky as st
import Grasshopper

def update_component(ghenv, delay):
    """Schedule an update of the Grasshopper component.

    After the specified delay, the GH component will be automatically updated.

    Parameters
    ----------
    ghenv : :class:`GhPython.Component.PythonEnvironment`
        The current GHPython environment.
    delay : :obj:`int`
        Time in milliseconds until the update is performed.

    Raises
    ------
    ValueError
        If the delay is less than zero.

    """
    if delay <= 0:
        raise ValueError("Delay must be greater than zero")

    ghcomp = ghenv.Component
    ghdoc = ghcomp.OnPingDocument()

    def callback(ghdoc):
        if ghdoc.SolutionState != Grasshopper.Kernel.GH_ProcessStep.Process:
            ghcomp.ExpireSolution(False)

    ghdoc.ScheduleSolution(delay, Grasshopper.Kernel.GH_Document.GH_ScheduleDelegate(callback))

L = range(my_assembly.graph.number_of_nodes())

# store data in component
guid = str(ghenv.Component.InstanceGuid)
counter_key = "counter_" + guid
running_key = "running_" + guid

if counter_key not in st:
    st[counter_key] = 0

if running_key not in st:
    st[running_key] = False
    

if st[running_key]:
    if st[counter_key] < len(L) - 1:
        st[counter_key] += 1
        update_component(ghenv, interval)
    else:
        st[counter_key] = 0
        st[running_key] = False
    
if start:
    st[running_key] = True

if stop:
    st[running_key] = False

if step:
    if st[counter_key] < len(L) - 1:
        st[counter_key] += 1

if step_back:
    if st[counter_key] < len(L) - 1:
        st[counter_key] -= 1

if reset:
    st[counter_key] = 0
    st[running_key] = False

if full:
    st[counter_key] = len(L)-1

if len(L):
    item = L[st[counter_key]]


#st["visualisation_counter"] = st[counter_key]
counter = st[counter_key]+1
# ---------- end counter ----------
panel_3 = Panel(counter.counter)

# ----
# Visualize the Assembly
list_2 = ValueList({"show all": "show_all", "show until key": "show_until_key"}, selected="show all")
visualize = Python3Script(
    assembly=transform_assembly.assembly,
    show=list_2,
    highlight_current_part=Toggle(False),
    show_connections=Toggle(True),
    counter=counter.counter)  # -> out, parts_built, parts_not_built, parts_frame, parts_keys, connections, connection_types, current_part_geometry, current_part_frame
# ---------- visualize: Python ----------
from compas_rhino.conversions import mesh_to_rhino, box_to_rhino, frame_to_rhino, line_to_rhino, point_to_rhino
from compas.geometry import Line, Transformation, Point, Vector, Frame, Translation

#print assembly
print(assembly)
#for p in assembly.parts():
#    layer = round(robot.from_RCF_to_BCF(p.frame).point.z/0.08)-1
#    assembly.graph.node_attribute(p.key, "layer", layer)


#get parts datastructure
parts_keys = [p for p in assembly.part_keys()]
parts = [assembly.part(p) for p in parts_keys]
parts_all = []
parts_built = []
parts_not_built = []
parts_frame = []

if show == "show_all":
    for p in parts:
        p_frame = p.frame

        if assembly.graph.node_attribute(p.key, "built"):
            parts_built.append(mesh_to_rhino(p.mesh.transformed(Transformation.from_frame((p_frame)))))
        else:
            parts_not_built.append(mesh_to_rhino(p.mesh.transformed(Transformation.from_frame((p_frame)))))

        parts_frame.append(frame_to_rhino(p_frame))
   
if show == "show_until_key":
    for p in parts[0:counter]:
        p_frame = p.frame
        
        if assembly.graph.node_attribute(p.key, "built"):
            parts_built.append(mesh_to_rhino(p.mesh.transformed(Transformation.from_frame((p_frame)))))
        else:
            parts_not_built.append(mesh_to_rhino(p.mesh.transformed(Transformation.from_frame((p_frame)))))

        parts_frame.append(frame_to_rhino(p_frame))

key = counter

if highlight_current_part:
    current_part = assembly.part(key)
    print(current_part.shape)
    current_part_geometry = mesh_to_rhino(current_part.mesh)
    current_part_frame = frame_to_rhino(current_part.frame)

if show_connections:
    connections = [line_to_rhino(Line(assembly.part(start).frame.point, assembly.part(end).frame.point)) for start, end in assembly.graph.edges()]

    print(connections)
    #connections = [line_to_rhino(Line(assembly.find_by_key(start).frame).point, robot.from_RCF_to_BCF(assembly.find_by_key(end).frame).point) for start, end in assembly.graph.edges()]
    connection_types = [assembly.graph.edge_attribute(t, "type") for t in assembly.graph.edges()]
    #extract points of the frame of the parts for visulization (+ converted to rhino point)
    parts_points = [point_to_rhino(p.frame.point) for p in assembly.parts()]
# ---------- end visualize ----------
panel_4 = Panel(visualize.out)

geo = Geometry(visualize.parts_not_built)
geo_2 = Geometry(visualize.parts_frame)
geo_3 = Geometry(visualize.parts_built)
line = Line(visualize.connections)
pln_2 = Plane(visualize.current_part_frame)
py3 = Python3Script(planes=visualize.parts_frame, scale=Slider(0.2, range=0..1))  # -> P, V, C, W; inputs planes: list of Plane, scale: Double
# ---------- py3: Python ----------
from Rhino.Display import ColorRGBA
from ghpythonlib.components import ColourRGBf


red = ColourRGBf(255, 255, 0, 0)
green = ColourRGBf(255, 0, 255, 0)
blue = ColourRGBf(255, 0, 0, 255)

P = []
V = []
C = []

# scale = float(scale)

for plane in planes:
    if not plane:
        continue
    P += [plane.Origin] * 3
    V.append(plane.XAxis * scale)
    V.append(plane.YAxis * scale)
    V.append(plane.ZAxis * scale)
    C += [red, green, blue]

W = 3
# ---------- end py3 ----------
preview = CustomPreview(Geometry=geo_3, Material=ColourSwatch(SwatchColor=RGBA(252, 83, 83, 216)))
preview_2 = CustomPreview(Geometry=geo, Material=ColourSwatch(SwatchColor=RGBA(255, 138, 138, 210)))
preview_3 = CustomPreview(Geometry=geo_2, Material=ColourSwatch(SwatchColor=RGB(214, 166, 71)))
tag = TextTag(Location=visualize.parts_frame, Text=visualize.parts_keys)
curve_preview = CustomCurvePreview(Curve=line, Linetype="Continuous", Colour=ColourSwatch(SwatchColor=RGB(38, 14, 20)))
vdisex = VectorDisplayEx(Point=py3.P, Vector=py3.V, Colour=py3.C, Width=py3.W)
