# Grasshopper definition 03_b_material_population_algorithmic_only_built.ghx (Grasshopper 1.0.8)
# plug-ins: MetaHopper

assembly_path = Python3Script()  # -> DATA
# ---------- assembly_path: Python ----------
import os
import getpass

username = getpass.getuser()
USER_FOLDER = os.path.abspath(os.path.join("C:/Users/", username))
DATA = os.path.abspath(os.path.join(USER_FOLDER,"workspace/projects/workshop_iaac_2026/data/assembly"))

print(USER_FOLDER)
print(DATA)
# ---------- end assembly_path ----------

# ----
# Parse Assembly file with Damage Information
# Load the Assembly File
# with Damages
panel = Panel("material_stack_4_with_damages")
assembly_path_2 = Python3Script(filename=panel)  # -> out, DATA
# ---------- assembly_path_2: Python ----------
import os
import getpass

username = getpass.getuser()
USER_FOLDER = os.path.abspath(os.path.join("C:/Users/", username))
DATA = os.path.abspath(os.path.join(USER_FOLDER,"workspace/projects/workshop_iaac_2026/data/assembly/{}.json".format(filename)))

print(USER_FOLDER)
print(DATA)
# ---------- end assembly_path_2 ----------

panel_2 = Panel(assembly_path)

# ----
# Parse the Assembly
# and extract data
# Modify the mapping to change
# the damage assessment system
custom_damage_status_mapping = Panel("""{
  "crack": 2,
  "spalling": 3,
  "material loss": 6,
  "staining": 1,
  "chipping": 4
}""")
parse_assembly_with_damages = Python3Script(json_path=assembly_path_2.DATA, damage_map=custom_damage_status_mapping, built_only=Toggle(True))  # -> out, stack_key, T_planes, T_dims, T_ids, T_built_flag, T_damage_value, T_damage_status_int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; inputs damage_map: String, built_only: Boolean
# ---------- parse_assembly_with_damages: Python ----------
import json
import Rhino.Geometry as rg
from Grasshopper import DataTree
from Grasshopper.Kernel.Data import GH_Path

# =========================
# INPUTS (Grasshopper)
# json_path   : str
# damage_map  : dict or str (optional)
# built_only  : bool (optional)  <-- NEW (only nodes with built==True)
# =========================
#
# =========================
# OUTPUTS (Grasshopper)
# stack_key            <-- NEW (single value)
# T_planes
# T_dims              <-- 3 items per branch
# T_ids
# T_built
# T_damage_value      <-- padded
# T_damage_status_int <-- padded
# T_damage_status_txt
# T_damage_type
# T_damage_vertices
# T_damage_uv
# T_damage_desc
# =========================

def parse_damage_map(x):
    if isinstance(x, dict):
        return {str(k).strip().lower(): int(v) for k, v in x.items()}

    if x is None:
        return None

    s = str(x).strip()
    if not s:
        return None

    try:
        d = json.loads(s)
        if isinstance(d, dict):
            return {str(k).strip().lower(): int(v) for k, v in d.items()}
    except:
        pass

    return None

DEFAULT_damage_map = {
    "crack": 2,
    "spalling": 3,
    "material loss": 5,
    "staining": 1,
    "chipping": 4
}

def _norm_status(s):
    return str(s).strip().lower()

def _safe_get(dct, path, default=None):
    cur = dct
    for k in path.split("."):
        if not isinstance(cur, dict) or k not in cur:
            return default
        cur = cur[k]
    return cur

def _sort_key(k):
    try:
        return int(k)
    except:
        return str(k)

def _pt(p):
    return rg.Point3d(float(p[0]), float(p[1]), float(p[2]))

def _vec(v):
    return rg.Vector3d(float(v[0]), float(v[1]), float(v[2]))

def frame_dict_to_plane(frame_dict):
    if not frame_dict:
        return None
    p = frame_dict.get("point", None)
    x = frame_dict.get("xaxis", None)
    y = frame_dict.get("yaxis", None)
    if p is None or x is None or y is None:
        return None

    pl = rg.Plane(_pt(p), _vec(x), _vec(y))
    if not pl.IsValid:
        xv = _vec(x); yv = _vec(y)
        xv.Unitize(); yv.Unitize()
        pl = rg.Plane(_pt(p), xv, yv)
    return pl if pl.IsValid else None

def load_json(path):
    with open(path, "r") as f:
        return json.load(f)

def add_to_tree(tree, path, item):
    tree.Add(item, path)

def _is_built_true(node):
    try:
        return bool(node.get("built", False))
    except:
        return False

def main(obj, damage_map=None, built_only=False):

    if damage_map is None:
        damage_map = DEFAULT_damage_map

    nodes = _safe_get(obj, "data.graph.node", {}) or {}

    # --- filter keys (built_only) ---
    all_keys_sorted = sorted(nodes.keys(), key=_sort_key)
    if built_only:
        node_keys_sorted = [k for k in all_keys_sorted if _is_built_true(nodes.get(k, {}) or {})]
    else:
        node_keys_sorted = all_keys_sorted

    # Output trees
    T_planes = DataTree[object]()
    T_dims = DataTree[object]()
    T_ids = DataTree[object]()
    T_built = DataTree[object]()

    T_damage_value = DataTree[object]()
    T_damage_status_int = DataTree[object]()

    T_damage_status_txt = DataTree[object]()
    T_damage_type = DataTree[object]()
    T_damage_vertices = DataTree[object]()
    T_damage_uv = DataTree[object]()
    T_damage_desc = DataTree[object]()

    # ============================================================
    # PASS 1: collect damage lists per (filtered) brick (for padding)
    # ============================================================
    status_int_lists = []
    value_lists = []

    for node_key in node_keys_sorted:
        node = nodes.get(node_key, {}) or {}
        damages_dict = node.get("damages", {}) or {}

        status_list = []
        value_list = []

        for dkey in sorted(damages_dict.keys(), key=_sort_key):
            d = damages_dict.get(dkey, {}) or {}
            status_txt = d.get("status", "")
            status_int = damage_map.get(_norm_status(status_txt), 0)
            value = d.get("value", 0) or 0

            status_list.append(status_int)
            value_list.append(value)

        status_int_lists.append(status_list)
        value_lists.append(value_list)

    max_damages = max([len(lst) for lst in status_int_lists] + [0])

    # ============================================================
    # PASS 2: build trees
    # ============================================================
    for i, node_key in enumerate(node_keys_sorted):

        node = nodes.get(node_key, {}) or {}
        part = node.get("part", {}) or {}
        part_data = part.get("data", {}) or {}
        part_attrs = part_data.get("attributes", {}) or {}

        path = GH_Path(i)

        # ---- Plane ----
        frame = part_data.get("frame", None) or {}
        plane = frame_dict_to_plane(frame)
        add_to_tree(T_planes, path, plane)

        # ---- Dimensions (x,y,z) as 3 items ----
        shape = part_attrs.get("shape", None) or {}
        shape_data = shape.get("data", None) or {}
        xsize = shape_data.get("xsize", None)
        ysize = shape_data.get("ysize", None)
        zsize = shape_data.get("zsize", None)

        add_to_tree(T_dims, path, xsize)
        add_to_tree(T_dims, path, ysize)
        add_to_tree(T_dims, path, zsize)

        # ---- IDs ----
        part_key = part_data.get("key", None)
        add_to_tree(T_ids, path, part_key)

        # ---- Built flag ----
        built_flag = node.get("built", None)
        add_to_tree(T_built, path, built_flag)

        # ---- Raw damage info (existing only) ----
        damages_dict = node.get("damages", {}) or {}
        for dkey in sorted(damages_dict.keys(), key=_sort_key):
            d = damages_dict.get(dkey, {}) or {}
            add_to_tree(T_damage_status_txt, path, d.get("status", ""))
            add_to_tree(T_damage_type, path, d.get("type", None))
            add_to_tree(T_damage_vertices, path, d.get("vertices", None))
            add_to_tree(T_damage_uv, path, d.get("uv", None))
            add_to_tree(T_damage_desc, path, d.get("description", None))

        # ---- PADDED damage vectors ----
        padded_status = status_int_lists[i] + [0] * (max_damages - len(status_int_lists[i]))
        padded_values = value_lists[i] + [0] * (max_damages - len(value_lists[i]))

        for val in padded_status:
            add_to_tree(T_damage_status_int, path, val)

        for val in padded_values:
            add_to_tree(T_damage_value, path, val)

    return (
        T_planes, T_dims, T_ids, T_built,
        T_damage_value, T_damage_status_int,
        T_damage_status_txt, T_damage_type,
        T_damage_vertices, T_damage_uv, T_damage_desc
    )

# -------- run --------
obj = load_json(json_path)

# NEW: single output value (make sure you created an output param named "stack_key" in GH)
stack_key = _safe_get(obj, "data.graph.attributes.stack_key", None)

custom_map = parse_damage_map(damage_map)
if custom_map is None:
    custom_map = DEFAULT_damage_map

try:
    built_only_flag = bool(built_only)
except:
    built_only_flag = False

(T_planes, T_dims, T_ids, T_built_flag,
 T_damage_value, T_damage_status_int,
 T_damage_status_txt, T_damage_type,
 T_damage_vertices, T_damage_uv, T_damage_desc) = main(
    obj,
    damage_map=custom_map,
    built_only=built_only_flag
)
# ---------- end parse_assembly_with_damages ----------

# ----
# Display the extracted data
source_brick_key = Panel(parse_assembly_with_damages.T_ids)
source_brick_built_flags = Panel(parse_assembly_with_damages.T_built_flag)
source_brick_damage_list = Panel(parse_assembly_with_damages.T_damage_status_txt)
source_brick_damage_amount = Panel(parse_assembly_with_damages.T_damage_status_int)
source_brick_damage_value = Panel(parse_assembly_with_damages.T_damage_value)

panel_3 = Panel(parse_assembly_with_damages.stack_key)

# ----
# Create a damage score for
# each brick and store in the path of every brick
multiplication = Multiplication(A=parse_assembly_with_damages.T_damage_value, B=parse_assembly_with_damages.T_damage_status_int)
ma = MassAddition(Input=multiplication)  # -> Result, PartialResults

# ----
# Sort the bricks and plane
# according to damage score.
brick_planes = FlattenTree(Tree=parse_assembly_with_damages.T_planes, Path="{0}")
damage_score = FlattenTree(Tree=ma.Result, Path="{0}")
brick_id = FlattenTree(Tree=parse_assembly_with_damages.T_ids, Path="{0}")
sort = SortList(Keys=damage_score, ValuesA=brick_planes)  # -> Keys, ValuesA
sort_2 = SortList(Keys=damage_score, ValuesA=brick_id)  # -> Keys, ValuesA

# ----
# YOUR REASSEMBLY DESIGN as JSON
panel_4 = Panel("260224_new_assembly_design_2")
assembly_path_3 = Python3Script(filename=panel_4)  # -> out, DATA; same code as assembly_path_2

# ----
# Name for the new Assembly file that
# will have remapped bricks
panel_5 = Panel("populated_reassembly_design")
assembly_path_4 = Python3Script(name=panel_5)  # -> out, DATA
# ---------- assembly_path_4: Python ----------
import os
import getpass
from datetime import datetime

username = getpass.getuser()

USER_FOLDER = os.path.abspath(os.path.join("C:/Users/", username))

time_as_string = datetime.now().strftime("%H%M%S")
date_as_string = datetime.now().strftime("%y%m%d")
filename = date_as_string + "_"+ time_as_string +"_" + name

DATA = os.path.abspath(os.path.join(USER_FOLDER,"workspace/projects/workshop_iaac_2026/data/assembly/{}.json".format(filename)))

print(USER_FOLDER)
print(DATA)
# ---------- end assembly_path_4 ----------

# ----
# Preview the brick Geometry
item = ListItem(List=parse_assembly_with_damages.T_dims, Index=0, Wrap=True)  # -> Item, Item1, Item2
flatten = FlattenTree(Tree=item.Item, Path="{0}")
flatten_2 = FlattenTree(Tree=item.Item1, Path="{0}")
flatten_3 = FlattenTree(Tree=item.Item2, Path="{0}")
cset = CreateSet(List=flatten)  # -> Set, Map
cset_2 = CreateSet(List=flatten_2)  # -> Set, Map
cset_3 = CreateSet(List=flatten_3)  # -> Set, Map
cluster = Cluster(planes_of_brick=parse_assembly_with_damages.T_planes, length=cset.Set, breadth=cset_2.Set, height=cset_3.Set)
flatten_4 = FlattenTree(Tree=cluster, Path="{0}")
flatten_5 = FlattenTree(Tree=ma.Result, Path="{0}")
gradient = Gradient(
    LowerLimit="0",
    UpperLimit="350",
    Parameter=flatten_5,
    stops=[0: RGB(255, 255, 255), 0.32: RGB(255, 130, 160), 0.855: RGB(128, 64, 0)])
toggle = GroupToggle(ToggleActive=False, ToggleVisible=True)  # disabled
preview = CustomPreview(Geometry=flatten_4, Material=gradient)

# ----
# Display the damage scores
panel_6 = Panel("Damage_Score: ")
concat = Concatenate(FragmentD="Brick:", FragmentC=parse_assembly_with_damages.T_ids, FragmentA=panel_6, FragmentB=ma.Result)
deplane = DeconstructPlane(Plane=parse_assembly_with_damages.T_planes)  # -> Origin, XAxis, YAxis, ZAxis
move = Move(Geometry=deplane.Origin, Motion=expr("-x*.05", deplane.ZAxis))  # -> Geometry, Transform
toggle_2 = GroupToggle(ToggleActive=False, ToggleVisible=True)  # disabled
tag = TextTag3D(Location=move.Geometry, Text=concat, Size=".015", Colour=RGB(0, 0, 0), Justification=8)

# ----
# Remap damaged bricks to new assembly
# assembly.graph.node_atrribute(key,"source_stack_key", stack_key)
# assembly.graph.node_atrribute(key,"source_brick_key", brick_key)
create_new_json = BooleanToggle(True)
write_json = Button()
py3 = Python3Script(
    write_file=write_json,
    assembly_path=assembly_path_3.DATA,
    output_path=assembly_path_4.DATA,
    source_stack_key=parse_assembly_with_damages.stack_key,
    supply_brick_ids=flatten(parse_assembly_with_damages.T_ids),
    supply_damage_scores=flatten(ma.Result),
    write_to_node=create_new_json)  # -> out, assigned_count, target_node_keys, assigned_supply_ids, assigned_scores, assignements, updated_json, wrote_file; inputs write_file: Boolean, assembly_path: String, output_path: String, source_stack_key: Int32, supply_brick_ids: list of Int32, supply_damage_scores: list of Int32
# ---------- py3: Python ----------
import json
import os

# =========================
# INPUTS (Grasshopper)
# assembly_path         : str   (path to target/new assembly JSON)
# output_path           : str   (path to write updated JSON)
# source_stack_key      : int   (single integer applied to all assigned nodes)
# supply_brick_ids      : list[int] or list[str]
# supply_damage_scores  : list[float]
# write_to_node         : bool
# write_file            : bool   (ONLY when True the file is written to disk)
# =========================

# =========================
# OUTPUTS (Grasshopper)
# assigned_count
# target_node_keys
# assigned_supply_ids
# assigned_scores
# assignments
# updated_json
# wrote_file
# =========================


def _safe_get(dct, path, default=None):
    cur = dct
    for k in path.split("."):
        if not isinstance(cur, dict) or k not in cur:
            return default
        cur = cur[k]
    return cur


def _sort_key(k):
    try:
        return int(k)
    except Exception:
        return str(k)


def to_float(x, default=0.0):
    try:
        return float(x)
    except Exception:
        return default


def to_int(x):
    try:
        return int(x)
    except Exception:
        return None


def load_json(path):
    if path is None or not str(path).strip():
        raise ValueError("assembly_path is empty.")
    path = str(path).strip()
    if not os.path.exists(path):
        raise FileNotFoundError("File not found: {}".format(path))
    with open(path, "r", encoding="utf-8") as f:
        return json.load(f)


def write_json(obj, path):
    if path is None or not str(path).strip():
        raise ValueError("output_path is empty.")
    path = str(path).strip()

    out_dir = os.path.dirname(path)
    if out_dir and not os.path.exists(out_dir):
        os.makedirs(out_dir, exist_ok=True)

    with open(path, "w", encoding="utf-8") as f:
        json.dump(obj, f, ensure_ascii=False, indent=2)


def get_node_z(node):
    try:
        return float(node.get("z", 0.0))
    except Exception:
        return 0.0


# -------------------------
# Main
# -------------------------
try:
    # defaults / guards
    if write_to_node is None:
        write_to_node = True
    else:
        write_to_node = bool(write_to_node)

    # force single integer stack key
    source_stack_key_int = to_int(source_stack_key)
    if source_stack_key_int is None:
        raise ValueError("source_stack_key must be an integer (e.g., 1).")

    supply_brick_ids = supply_brick_ids or []
    supply_damage_scores = supply_damage_scores or []

    # Build supply list: (brick_id:int, score:float)
    n_supply = min(len(supply_brick_ids), len(supply_damage_scores))
    supply = []
    for i in range(n_supply):
        bid = to_int(supply_brick_ids[i])
        if bid is None:
            continue  # skip invalid id
        score = to_float(supply_damage_scores[i])
        supply.append((bid, score))

    # Sort supply by damage score (least damaged first)
    supply.sort(key=lambda t: t[1])

    # Load target assembly
    obj = load_json(assembly_path)

    # Nodes dict: obj["data"]["graph"]["node"]
    nodes = _safe_get(obj, "data.graph.node", {}) or {}
    node_keys_sorted = sorted(nodes.keys(), key=_sort_key)

    # Sort target nodes by Z ascending (lowest first)
    targets = []
    for nk in node_keys_sorted:
        node = nodes.get(nk, {}) or {}
        targets.append((nk, get_node_z(node)))
    targets.sort(key=lambda t: t[1])

    # Assign up to supply limit
    assigned_count = min(len(targets), len(supply))

    target_node_keys = []
    assigned_supply_ids = []
    assigned_scores = []
    assignments = []

    for i in range(assigned_count):
        target_key, tz = targets[i]
        brick_id, score = supply[i]

        target_node_keys.append(str(target_key))
        assigned_supply_ids.append(int(brick_id))
        assigned_scores.append(float(score))

        assignments.append(
            "{} (z={:.4f}) -> brick={} (score={:.4f}), source_stack_key={}".format(
                str(target_key), float(tz), int(brick_id), float(score), int(source_stack_key_int)
            )
        )

        if write_to_node:
            node = nodes.get(target_key, {}) or {}

            # Equivalent intent to:
            # assembly.graph.node_attribute(target_key, "source_stack_key", source_stack_key_int)
            # assembly.graph.node_attribute(target_key, "source_brick_key", brick_id)
            node["source_stack_key"] = int(source_stack_key_int)
            node["source_brick_key"] = int(brick_id)

            # optional: keep the score too (handy for debugging/filtering)
            node["source_damage_score"] = float(score)

            nodes[target_key] = node

    wrote_file = False

    if write_to_node:
        obj["data"]["graph"]["node"] = nodes
        updated_json = json.dumps(obj, ensure_ascii=False, indent=2)
    else:
        updated_json = None

    # -------- WRITE TO DISK ONLY IF BOOLEAN IS TRUE --------
    if write_file:
        if updated_json is None:
            # ensure JSON is up-to-date even if write_to_node was False
            updated_json = json.dumps(obj, ensure_ascii=False, indent=2)

        write_json(obj, output_path)
        wrote_file = True

except Exception as e:
    print("ERROR:", e)

    assigned_count = 0
    target_node_keys = []
    assigned_supply_ids = []
    assigned_scores = []
    assignments = []
    updated_json = None
    wrote_file = False
# ---------- end py3 ----------
file_exported = Panel(py3.wrote_file)

panel_7 = Panel("1")
panel_8 = Panel(py3.assigned_count)
panel_9 = Panel(py3.assigned_scores)
lng = ListLength(List=py3.assigned_scores)

assembly_path_5 = Python3Script(filename="260224_134121_damage_remapped_assembly")  # -> out, DATA; same code as assembly_path_2
import = Button(ExpressionNormal="True", ExpressionPressed="False")
initial_assembly = Python3Script(DATA=assembly_path_5.DATA, import_from_json=import)  # -> out, assembly
# ---------- initial_assembly: Python ----------
import os
import json

from assembly_information_model import Assembly

if import_from_json:   
    PATH = DATA
    print(PATH)
    assembly = Assembly.from_json(PATH)
    print(assembly)
# ---------- end initial_assembly ----------

pln = Plane(PlaneXY(0.59901243, 0.02820264453, 0))
transform_assembly = Python3Script(assembly=initial_assembly.assembly, ref_plane=pln, transform=Toggle(True))  # -> out, assembly
# ---------- transform_assembly: Python ----------
from compas.geometry import Frame, Transformation, Rotation, Translation
from compas_rhino.conversions import plane_to_compas_frame, point_to_rhino, frame_to_rhino

center_frame = Frame.worldXY()
# center_frame_new = plane_to_compas_frame(center_plane_new)

if transform:
    copy_assembly = assembly.copy()
    # T = Transformation.from_frame_to_frame(center_frame, stack_frame)
    T = Transformation.from_frame_to_frame(center_frame, plane_to_compas_frame(ref_plane))
    
   # Here transform both the frame and planned frame of every brick.
    for key in copy_assembly.part_keys():
        p = copy_assembly.part(key)
        p.frame = p.frame.transformed(T)

    assembly = copy_assembly
# ---------- end transform_assembly ----------

start = Button()
stop = Button()
step = Button()
back = Button()
reset = Button()
full = Button()
list = ValueList({"20", "50", "100", "500", "1000", "5000"}, selected="500")
counter = Python3Script(
    my_assembly=transform_assembly.assembly,
    start=start,
    stop=stop,
    step=step,
    step_back=back,
    reset=reset,
    full=full,
    interval=list)  # -> out, counter
# ---------- counter: Python ----------
from scriptcontext import sticky as st
import Grasshopper

def update_component(ghenv, delay):
    """Schedule an update of the Grasshopper component.

    After the specified delay, the GH component will be automatically updated.

    Parameters
    ----------
    ghenv : :class:`GhPython.Component.PythonEnvironment`
        The current GHPython environment.
    delay : :obj:`int`
        Time in milliseconds until the update is performed.

    Raises
    ------
    ValueError
        If the delay is less than zero.

    """
    if delay <= 0:
        raise ValueError("Delay must be greater than zero")

    ghcomp = ghenv.Component
    ghdoc = ghcomp.OnPingDocument()

    def callback(ghdoc):
        if ghdoc.SolutionState != Grasshopper.Kernel.GH_ProcessStep.Process:
            ghcomp.ExpireSolution(False)

    ghdoc.ScheduleSolution(delay, Grasshopper.Kernel.GH_Document.GH_ScheduleDelegate(callback))

L = range(my_assembly.graph.number_of_nodes())

# store data in component
guid = str(ghenv.Component.InstanceGuid)
counter_key = "counter_" + guid
running_key = "running_" + guid

if counter_key not in st:
    st[counter_key] = 0

if running_key not in st:
    st[running_key] = False
    

if st[running_key]:
    if st[counter_key] < len(L) - 1:
        st[counter_key] += 1
        update_component(ghenv, interval)
    else:
        st[counter_key] = 0
        st[running_key] = False
    
if start:
    st[running_key] = True

if stop:
    st[running_key] = False

if step:
    if st[counter_key] < len(L) - 1:
        st[counter_key] += 1

if step_back:
    if st[counter_key] < len(L) - 1:
        st[counter_key] -= 1

if reset:
    st[counter_key] = 0
    st[running_key] = False

if full:
    st[counter_key] = len(L)-1

if len(L):
    item = L[st[counter_key]]


#st["visualisation_counter"] = st[counter_key]
counter = st[counter_key]+1
# ---------- end counter ----------
panel_10 = Panel(counter.counter)

# ----
# Visualize the Assembly
list_2 = ValueList({"show all": "show_all", "show until key": "show_until_key"}, selected="show all")
visualize = Python3Script(
    assembly=transform_assembly.assembly,
    show=list_2,
    highlight_current_part=Toggle(False),
    show_connections=Toggle(True),
    counter=counter.counter)  # -> out, parts_built, parts_not_built, parts_frame, parts_keys, connections, connection_types, current_part_geometry, current_part_frame
# ---------- visualize: Python ----------
from compas_rhino.conversions import mesh_to_rhino, box_to_rhino, frame_to_rhino, line_to_rhino, point_to_rhino
from compas.geometry import Line, Transformation, Point, Vector, Frame, Translation

#print assembly
print(assembly)
#for p in assembly.parts():
#    layer = round(robot.from_RCF_to_BCF(p.frame).point.z/0.08)-1
#    assembly.graph.node_attribute(p.key, "layer", layer)


#get parts datastructure
parts_keys = [p for p in assembly.part_keys()]
parts = [assembly.part(p) for p in parts_keys]
parts_all = []
parts_built = []
parts_not_built = []
parts_frame = []

if show == "show_all":
    for p in parts:
        p_frame = p.frame

        if assembly.graph.node_attribute(p.key, "built"):
            parts_built.append(mesh_to_rhino(p.mesh.transformed(Transformation.from_frame((p_frame)))))
        else:
            parts_not_built.append(mesh_to_rhino(p.mesh.transformed(Transformation.from_frame((p_frame)))))

        parts_frame.append(frame_to_rhino(p_frame))
   
if show == "show_until_key":
    for p in parts[0:counter]:
        p_frame = p.frame
        
        if assembly.graph.node_attribute(p.key, "built"):
            parts_built.append(mesh_to_rhino(p.mesh.transformed(Transformation.from_frame((p_frame)))))
        else:
            parts_not_built.append(mesh_to_rhino(p.mesh.transformed(Transformation.from_frame((p_frame)))))

        parts_frame.append(frame_to_rhino(p_frame))

key = counter

if highlight_current_part:
    current_part = assembly.part(key)
    print(current_part.shape)
    current_part_geometry = mesh_to_rhino(current_part.mesh)
    current_part_frame = frame_to_rhino(current_part.frame)

if show_connections:
    connections = [line_to_rhino(Line(assembly.part(start).frame.point, assembly.part(end).frame.point)) for start, end in assembly.graph.edges()]

    print(connections)
    #connections = [line_to_rhino(Line(assembly.find_by_key(start).frame).point, robot.from_RCF_to_BCF(assembly.find_by_key(end).frame).point) for start, end in assembly.graph.edges()]
    connection_types = [assembly.graph.edge_attribute(t, "type") for t in assembly.graph.edges()]
    #extract points of the frame of the parts for visulization (+ converted to rhino point)
    parts_points = [point_to_rhino(p.frame.point) for p in assembly.parts()]
# ---------- end visualize ----------
panel_11 = Panel(visualize.out)

geo = Geometry(visualize.parts_built)
geo_2 = Geometry(visualize.parts_not_built)
geo_3 = Geometry(visualize.parts_frame)
line = Line(visualize.connections)
pln_2 = Plane(visualize.current_part_frame)
py3_2 = Python3Script(planes=visualize.parts_frame, scale=Slider(0.2, range=0..1))  # -> P, V, C, W; inputs planes: list of Plane, scale: Double
# ---------- py3_2: Python ----------
from Rhino.Display import ColorRGBA
from ghpythonlib.components import ColourRGBf


red = ColourRGBf(255, 255, 0, 0)
green = ColourRGBf(255, 0, 255, 0)
blue = ColourRGBf(255, 0, 0, 255)

P = []
V = []
C = []

# scale = float(scale)

for plane in planes:
    if not plane:
        continue
    P += [plane.Origin] * 3
    V.append(plane.XAxis * scale)
    V.append(plane.YAxis * scale)
    V.append(plane.ZAxis * scale)
    C += [red, green, blue]

W = 3
# ---------- end py3_2 ----------
preview_2 = CustomPreview(Geometry=geo, Material=ColourSwatch(SwatchColor=RGBA(252, 83, 83, 216)))
preview_3 = CustomPreview(Geometry=geo_2, Material=ColourSwatch(SwatchColor=RGBA(255, 138, 138, 210)))
preview_4 = CustomPreview(Geometry=geo_3, Material=ColourSwatch(SwatchColor=RGB(214, 166, 71)))
tag_2 = TextTag(Location=visualize.parts_frame, Text=visualize.parts_keys)
curve_preview = CustomCurvePreview(Curve=line, Linetype="Continuous", Colour=ColourSwatch(SwatchColor=RGB(38, 14, 20)))
vdisex = VectorDisplayEx(Point=py3_2.P, Vector=py3_2.V, Colour=py3_2.C, Width=py3_2.W)

split = SplitList(List=geo_2, Index=lng)  # -> ListA, ListB
geo_4 = Geometry(split.ListA)
geo_5 = Geometry(split.ListB)
medges = MeshEdges(Mesh=geo_5)  # -> NakedEdges, InteriorEdges, NonManifoldEdges
gradient_2 = Gradient(
    LowerLimit="0",
    UpperLimit="350",
    Parameter=[flatten_5, py3.assigned_scores],
    stops=[0: RGB(255, 255, 255), 0.32: RGB(255, 130, 160), 0.855: RGB(128, 64, 0)])
preview_5 = CustomPreview(
    Geometry=flatten([medges.NakedEdges, medges.InteriorEdges, medges.NonManifoldEdges]),
    Material=ColourSwatch(SwatchColor=RGB(0, 0, 0)))
preview_6 = CustomPreview(Geometry=geo_4, Material=gradient_2)

# ==== cluster Cluster
length = ClusterInput()  # Length of Brick
breadth = ClusterInput()  # Breadth of Brick
height = ClusterInput()  # Height of the Brick
planes_of_brick = ClusterInput()  # Planes for the Brick Visualization
dom = ConstructDomain(DomainStart=expr("-x/2", length), DomainEnd=expr("x/2", length))
dom_2 = ConstructDomain(DomainStart=expr("-x/2", breadth), DomainEnd=expr("x/2", breadth))
rectangle = Rectangle(Plane=planes_of_brick, XSize=dom, YSize=dom_2, Radius=0)  # -> Rectangle, Length
Z = UnitZ(Factor=height)
extr = Extrude(Base=rectangle.Rectangle, Direction=Z)
cap = CapHoles(Brep=extr)
bricks = ClusterOutput(cap)  # Visualized Brick
