# Grasshopper definition 02_iaac_damage_evaluation_am.gh (Grasshopper 1.0.8)
# plug-ins: MetaHopper

panel = Panel("stack1_brick23")
concat = Concatenate(FragmentA="stack", FragmentB=Slider(1, range=1..2), FragmentC="_brick", FragmentD=Slider(25, range=0..49))
custom_damage_mapping = Panel("""{
  "crack": 2,
  "spalling": 3,
  "material loss": 5,
  "staining": 1,
  "chipping": 4
}""")
assembly_path = Python3Script(filename="material_stack_1_with_damages")  # -> out, DATA
# ---------- assembly_path: Python ----------
import os
import getpass

username = getpass.getuser()
USER_FOLDER = os.path.abspath(os.path.join("C:/Users/", username))
DATA = os.path.abspath(os.path.join(USER_FOLDER,"workspace/projects/workshop_iaac_2026/data/assembly/{}.json".format(filename)))

print(USER_FOLDER)
print(DATA)
# ---------- end assembly_path ----------
damaged_brick_path = Python3Script(filename=concat)  # -> out, DATA
# ---------- damaged_brick_path: Python ----------
import os
import getpass

username = getpass.getuser()
USER_FOLDER = os.path.abspath(os.path.join("C:/Users/", username))
DATA = os.path.abspath(os.path.join(USER_FOLDER,"workspace/projects/workshop_iaac_2026/data/stacked_brick_dataset_for_testing/brick_dataset/{}.json".format(filename)))

print(USER_FOLDER)
print(DATA)
# ---------- end damaged_brick_path ----------
panel_2 = Panel(concat)
py3 = Python3Script(json_path=assembly_path.DATA, damage_map=custom_damage_mapping)  # -> out, T_planes, T_dims, T_ids, T_damage_value, T_damage_status_int, T_damage_status_txt, T_damage_vertices, T_damage_uv, T_damage_desc; inputs damage_map: String
# ---------- py3: Python ----------
import json
import Rhino.Geometry as rg
from Grasshopper import DataTree
from Grasshopper.Kernel.Data import GH_Path

# =========================
# INPUTS
# json_path : str
# damage_map : dict (optional)
# =========================

# =========================
# OUTPUTS
# T_planes
# T_dims              <-- now 3 items per branch
# T_ids
# T_damage_value      <-- padded
# T_damage_status_int <-- padded
# T_damage_status_txt
# T_damage_type
# T_damage_vertices
# T_damage_uv
# T_damage_desc
# =========================

def parse_damage_map(x):
    # x can be dict already (if you pass it as a dict), or a string from Panel
    if isinstance(x, dict):
        return {str(k).strip().lower(): int(v) for k, v in x.items()}

    if x is None:
        return None

    s = str(x).strip()
    if not s:
        return None

    # try JSON first
    try:
        d = json.loads(s)
        if isinstance(d, dict):
            return {str(k).strip().lower(): int(v) for k, v in d.items()}
    except:
        pass

    return None

DEFAULT_damage_map = {
    "crack": 2,
    "spalling": 3,
    "material loss": 5,
    "staining": 1,
    "chipping": 4
}

def _norm_status(s):
    return str(s).strip().lower()

def _safe_get(dct, path, default=None):
    cur = dct
    for k in path.split("."):
        if not isinstance(cur, dict) or k not in cur:
            return default
        cur = cur[k]
    return cur

def _sort_key(k):
    try:
        return int(k)
    except:
        return str(k)

def _pt(p):
    return rg.Point3d(float(p[0]), float(p[1]), float(p[2]))

def _vec(v):
    return rg.Vector3d(float(v[0]), float(v[1]), float(v[2]))

def frame_dict_to_plane(frame_dict):
    if not frame_dict:
        return None
    p = frame_dict.get("point", None)
    x = frame_dict.get("xaxis", None)
    y = frame_dict.get("yaxis", None)
    if p is None or x is None or y is None:
        return None

    pl = rg.Plane(_pt(p), _vec(x), _vec(y))
    if not pl.IsValid:
        xv = _vec(x); yv = _vec(y)
        xv.Unitize(); yv.Unitize()
        pl = rg.Plane(_pt(p), xv, yv)
    return pl if pl.IsValid else None

def load_json(path):
    with open(path, "r") as f:
        return json.load(f)

def add_to_tree(tree, path, item):
    tree.Add(item, path)

def main(obj, damage_map=None):

    if damage_map is None:
        damage_map = DEFAULT_damage_map

    nodes = _safe_get(obj, "data.graph.node", {}) or {}
    node_keys_sorted = sorted(nodes.keys(), key=_sort_key)

    # Output trees
    T_planes = DataTree[object]()
    T_dims = DataTree[object]()                 # 3 items per branch
    T_ids = DataTree[object]()

    T_damage_value = DataTree[object]()         # padded
    T_damage_status_int = DataTree[object]()    # padded

    T_damage_status_txt = DataTree[object]()
    T_damage_type = DataTree[object]()
    T_damage_vertices = DataTree[object]()
    T_damage_uv = DataTree[object]()
    T_damage_desc = DataTree[object]()

    # ============================================================
    # PASS 1: collect damage lists per brick (for padding)
    # ============================================================
    status_int_lists = []
    value_lists = []

    for node_key in node_keys_sorted:
        node = nodes[node_key] or {}
        damages_dict = node.get("damages", {}) or {}

        status_list = []
        value_list = []

        for dkey in sorted(damages_dict.keys(), key=_sort_key):
            d = damages_dict[dkey] or {}
            status_txt = d.get("status", "")
            status_int = damage_map.get(_norm_status(status_txt), 0)
            value = d.get("value", 0) or 0

            status_list.append(status_int)
            value_list.append(value)

        status_int_lists.append(status_list)
        value_lists.append(value_list)

    max_damages = max([len(lst) for lst in status_int_lists] + [0])

    # ============================================================
    # PASS 2: build trees
    # ============================================================
    for i, node_key in enumerate(node_keys_sorted):

        node = nodes[node_key] or {}
        part = node.get("part", {}) or {}
        part_data = part.get("data", {}) or {}
        part_attrs = part_data.get("attributes", {}) or {}

        path = GH_Path(i)

        # ---- Plane ----
        frame = part_data.get("frame", None) or {}
        plane = frame_dict_to_plane(frame)
        add_to_tree(T_planes, path, plane)

        # ---- Dimensions: ADD AS 3 ITEMS (x, y, z) ----
        shape = part_attrs.get("shape", None) or {}
        shape_data = shape.get("data", None) or {}
        xsize = shape_data.get("xsize", None)
        ysize = shape_data.get("ysize", None)
        zsize = shape_data.get("zsize", None)

        # Add each dimension as separate item in the same branch
        add_to_tree(T_dims, path, xsize)
        add_to_tree(T_dims, path, ysize)
        add_to_tree(T_dims, path, zsize)

        # ---- IDs (one tuple item per branch) ----
        part_key = part_data.get("key", None)
        part_guid = part.get("guid", None)
        qcode = node.get("qcode", None)
        add_to_tree(T_ids, path, (str(node_key), part_key, part_guid, qcode))

        # ---- Raw damage info (existing only) ----
        damages_dict = node.get("damages", {}) or {}
        for dkey in sorted(damages_dict.keys(), key=_sort_key):
            d = damages_dict[dkey] or {}
            add_to_tree(T_damage_status_txt, path, d.get("status", ""))
            add_to_tree(T_damage_type, path, d.get("type", None))
            add_to_tree(T_damage_vertices, path, d.get("vertices", None))
            add_to_tree(T_damage_uv, path, d.get("uv", None))
            add_to_tree(T_damage_desc, path, d.get("description", None))

        # ---- PADDED damage vectors ----
        padded_status = status_int_lists[i] + [0] * (max_damages - len(status_int_lists[i]))
        padded_values = value_lists[i] + [0] * (max_damages - len(value_lists[i]))

        for val in padded_status:
            add_to_tree(T_damage_status_int, path, val)

        for val in padded_values:
            add_to_tree(T_damage_value, path, val)

    return (
        T_planes, T_dims, T_ids,
        T_damage_value, T_damage_status_int,
        T_damage_status_txt, T_damage_type,
        T_damage_vertices, T_damage_uv, T_damage_desc
    )

# -------- run --------
obj = load_json(json_path)

custom_map = parse_damage_map(damage_map)
(T_planes, T_dims, T_ids,
 T_damage_value, T_damage_status_int,
 T_damage_status_txt, T_damage_type,
 T_damage_vertices, T_damage_uv, T_damage_desc) = main(obj, damage_map=custom_map)
# ---------- end py3 ----------
path = FilePath(damaged_brick_path.DATA)
decode_damage = Python3Script(json_path=path, as_points=Toggle(True))  # -> out, brick_id, node_key, brick_size_xyz, stack_id, brick_index, damage_count, damage_types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; inputs json_path: String, as_points: Boolean
# ---------- decode_damage: Python ----------
"""
Grasshopper Python 3 (Rhino) - Brick Damage JSON Parser (file path only)

Inputs:
  json_path : str  - path to a .json file
  as_points : bool - True => Rhino Point3d output, False => raw xyz lists

Outputs:
  brick_id, node_key, brick_size_xyz, stack_id, brick_index
  damage_count
  damage_types, damage_status, damage_values, damage_vertices, damage_uv, damage_desc
  damage_points, damage_xaxis, damage_yaxis
"""

import json
import os
import re

from Rhino.Geometry import Point3d, Vector3d


def _to_point(xyz):
    if xyz is None:
        return None
    return Point3d(float(xyz[0]), float(xyz[1]), float(xyz[2]))

def _to_vec(xyz):
    if xyz is None:
        return None
    return Vector3d(float(xyz[0]), float(xyz[1]), float(xyz[2]))

def _parse_stack_and_index(brick_id_str):
    """
    Expects patterns like 'stack1_brick23'.
    Returns (stack_id:int|None, brick_index:int|None)
    """
    if not brick_id_str:
        return (None, None)
    m = re.match(r"^stack(\d+)_brick(\d+)$", str(brick_id_str).strip())
    if not m:
        return (None, None)
    return (int(m.group(1)), int(m.group(2)))

def _load_json_from_path(path):
    if path is None or not str(path).strip():
        raise ValueError("json_path is empty. Provide a valid file path.")
    path = str(path).strip()

    if not os.path.exists(path):
        raise FileNotFoundError("JSON file not found: {}".format(path))

    with open(path, "r") as f:
        return json.load(f)


# ---- main ----
try:
    data = _load_json_from_path(json_path)

    # Brick-level
    node_key = data.get("nodeKey", None)
    brick_id = data.get("brickId", None)

    bs = data.get("brickSize", {}) or {}
    brick_size_xyz = [bs.get("x", None), bs.get("y", None), bs.get("z", None)]

    stack_id, brick_index = _parse_stack_and_index(brick_id)

    # Damage-level
    damages = data.get("appendDamages", []) or []
    damage_count = len(damages)

    damage_types = []
    damage_status = []
    damage_values = []
    damage_vertices = []
    damage_uv = []
    damage_desc = []

    damage_points = []
    damage_xaxis = []
    damage_yaxis = []

    # Default True if as_points is not wired
    as_points_local = True if as_points is None else bool(as_points)

    for d in damages:
        damage_types.append(d.get("type", None))
        damage_status.append(d.get("status", None))
        damage_values.append(d.get("value", None))
        damage_vertices.append(d.get("vertices", None))
        damage_desc.append(d.get("description", None))

        # uv only exists for face damages
        if "uv" in d and d.get("uv", None) is not None:
            uv = d["uv"]
            damage_uv.append((float(uv[0]), float(uv[1])))
        else:
            damage_uv.append(None)

        coords = d.get("coordinates", {}) or {}
        p = coords.get("point", None)
        xa = coords.get("xaxis", None)
        ya = coords.get("yaxis", None)

        if as_points_local:
            damage_points.append(_to_point(p))
        else:
            damage_points.append(None if p is None else [float(p[0]), float(p[1]), float(p[2])])

        damage_xaxis.append(_to_vec(xa))
        damage_yaxis.append(_to_vec(ya))
        STATUS_MAP = {
    "crack": 2,
    "spalling": 3,
    "material loss": 5,
    "staining": 1,
    "chipping": 4
}

        damage_status_int = []

        for status in damage_status:
            key = str(status).strip().lower()
            damage_status_int.append(STATUS_MAP.get(key, 0))

        

except Exception as e:
    # Fail gracefully in GH: set outputs to safe defaults
    print("ERROR:", e)

    brick_id = None
    node_key = None
    brick_size_xyz = None
    stack_id = None
    brick_index = None

    damage_count = 0
    damage_types = []
    damage_status = []
    damage_values = []
    damage_vertices = []
    damage_uv = []
    damage_desc = []
    damage_points = []
    damage_xaxis = []
    damage_yaxis = []
    damage_status_int= []
# ---------- end decode_damage ----------

item = ListItem(List=decode_damage.brick_size_xyz, Index=0, Wrap=True)  # -> Item, Item1, Item2
toggle = GroupToggle(ToggleActive=True, ToggleVisible=False)  # disabled
sph = Sphere(Base=decode_damage.damage_points, Radius=expr("x*.005", decode_damage.damage_values))
box = CenterBox(Base=PlaneXY(0, 0, 0), X=expr("x/2", item.Item), Y=expr("x/2", item.Item1), Z=expr("x/2", item.Item2))

item_2 = ListItem(List=py3.T_dims, Index=0, Wrap=True)  # -> Item, Item1, Item2

multiplication = Multiplication(A=decode_damage.damage_status_int, B=decode_damage.damage_values)
ma = MassAddition(Input=multiplication)  # -> Result, PartialResults

box_2 = CenterBox(Base=py3.T_planes, X=expr("x/2", item_2.Item), Y=expr("x/2", item_2.Item1), Z=expr("x/2", item_2.Item2))
damage_score = Panel(ma.Result)
deplane = DeconstructPlane(Plane=py3.T_planes)  # -> Origin, XAxis, YAxis, ZAxis
preview = CustomPreview(Geometry=box, Material=ColourSwatch(SwatchColor=RGB(222, 89, 0)))

multiplication_2 = Multiplication(A=py3.T_damage_value, B=py3.T_damage_status_int)
ma_2 = MassAddition(Input=multiplication_2)  # -> Result, PartialResults

move = Move(Geometry=deplane.Origin, Motion=expr("-x*.05", deplane.ZAxis))  # -> Geometry, Transform
concat_2 = Concatenate(FragmentA="Damage_Score: ", FragmentB=ma_2.Result)
flatten = FlattenTree(Tree=py3.T_planes, Path="{0}")
flatten_2 = FlattenTree(Tree=ma_2.Result, Path="{0}")
tag = TextTag(Location=move.Geometry, Text=concat_2, Colour=RGB(0, 0, 0))
sort = SortList(Keys=flatten_2, ValuesA=flatten)  # -> Keys, ValuesA
panel_3 = Panel("90")

rotation_angle = Slider(3.8, range=0..90)
gap = Slider(0.219, range=0..1)
layer_count = Slider(6, range=0..15)

# ----
# Create the assembly geometry
dom = ConstructDomain(DomainStart=expr("-x/2", gap), DomainEnd=expr("x/2", gap))
rectangle = Rectangle(Plane=PlaneXY(0, 0, 0), XSize=dom, YSize=dom, Radius=0)  # -> Rectangle, Length
disc = Discontinuity(Curve=rectangle.Rectangle, Level=1)  # -> Points, Parameters
xy = XYPlane(Origin=disc.Points)
lng = ListLength(List=xy)
series = Series(Start=0, Step=1, Count=lng)
pi = Pi(Factor=expr("x/2", series))
rotate = Rotate(Geometry=xy, Angle=pi, Plane=xy)  # -> Geometry, Transform

# ----
# Create a brick part
part = Python3Script()  # -> out, brick_full
# ---------- part: Python ----------
from compas.geometry import Frame
from compas.geometry import Vector
from compas.geometry import Box

from assembly_information_model import Part

# dimensions full brick
width = 0.115
length = 0.240
height = 0.045

# create bricks
tool_frame = Frame([0, 0, 0], [1, 0, 0], [0, -1, 0])
brick_full_geometry = Box(length, width, height, tool_frame, 'box')
brick_full = Part.from_shape(brick_full_geometry, name="brick_full", frame=tool_frame)
# ---------- end part ----------

# ----
# Generate a brickwall assembly
generate_assembly = Python3Script(brick_full=part.brick_full, planes=rotate.Geometry, angle=rotation_angle, course=layer_count)  # -> out, assembly, course; inputs planes: list of Plane, course: Int32
# ---------- generate_assembly: Python ----------
import math

from compas.geometry import Frame, Point, Vector
from compas.geometry import Transformation, Rotation, Translation
from compas.geometry import distance_point_point
from compas_rhino.conversions import plane_to_compas_frame, frame_to_rhino_plane, point_to_compas

from assembly_information_model.assembly import Assembly

#create empty assembly
assembly = Assembly()

qcode = "Q40089"
brick_shape = brick_full.shape
length, width, height = [brick_shape.xsize, brick_shape.ysize, brick_shape.zsize]

for c in range(course): 
    for plane in planes:
        frame = plane_to_compas_frame(plane).transformed(Translation.from_vector(Vector.Zaxis()*height*c))
        frame = frame.transformed(Rotation.from_axis_and_angle(Vector.Zaxis(), math.radians(angle*c)))
        part = brick_full.copy()
        part.frame = frame
        assembly.add_part(part, course=c, built=False, available=True, qcode=qcode)
# ---------- end generate_assembly ----------

# ----
# Export the brickwall assembly
path_2 = Python3Script()  # -> out, DATA
# ---------- path_2: Python ----------
import os
import getpass

username = getpass.getuser()
USER_FOLDER = os.path.abspath(os.path.join("C:/Users/", username))
DATA = os.path.abspath(os.path.join(USER_FOLDER,"workspace/projects/workshop_iaac_2026/data/assembly"))

print(USER_FOLDER)
print(DATA)
# ---------- end path_2 ----------
export = Button()
date = Python3Script()  # -> date
# ---------- date: Python ----------
import time
date = (
    str(time.localtime().tm_year)[2:] +
    f"{time.localtime().tm_mon:02d}" +
    f"{time.localtime().tm_mday:02d}"
)

print(date)
# ---------- end date ----------
panel_4 = Panel(date)
export_2 = Python3Script(DATA=path_2.DATA, material_stack=generate_assembly.assembly, export=export, name="_new_assembly_", date=panel_4)  # -> out; inputs name: String, date: String
# ---------- export_2: Python ----------
import os

if export: 
    stack_filename = date + name + ".json"
    PATH = os.path.join(DATA, stack_filename)
    print(PATH)

    # the assembly has to be serialized such that it can be called from CPython
    material_stack.to_json(PATH)
# ---------- end export_2 ----------

reset = Button()
back = Button()
start = Button()
stop = Button()
step = Button()
full = Button()
list = ValueList({"20", "50", "100", "500", "1000", "5000"}, selected="500")
counter = Python3Script(
    my_assembly=generate_assembly.assembly,
    start=start,
    stop=stop,
    step=step,
    step_back=back,
    reset=reset,
    full=full,
    interval=list)  # -> out, counter
# ---------- counter: Python ----------
from scriptcontext import sticky as st
import Grasshopper

def update_component(ghenv, delay):
    """Schedule an update of the Grasshopper component.

    After the specified delay, the GH component will be automatically updated.

    Parameters
    ----------
    ghenv : :class:`GhPython.Component.PythonEnvironment`
        The current GHPython environment.
    delay : :obj:`int`
        Time in milliseconds until the update is performed.

    Raises
    ------
    ValueError
        If the delay is less than zero.

    """
    if delay <= 0:
        raise ValueError("Delay must be greater than zero")

    ghcomp = ghenv.Component
    ghdoc = ghcomp.OnPingDocument()

    def callback(ghdoc):
        if ghdoc.SolutionState != Grasshopper.Kernel.GH_ProcessStep.Process:
            ghcomp.ExpireSolution(False)

    ghdoc.ScheduleSolution(delay, Grasshopper.Kernel.GH_Document.GH_ScheduleDelegate(callback))

L = range(my_assembly.graph.number_of_nodes())

# store data in component
guid = str(ghenv.Component.InstanceGuid)
counter_key = "counter_" + guid
running_key = "running_" + guid

if counter_key not in st:
    st[counter_key] = 0

if running_key not in st:
    st[running_key] = False
    

if st[running_key]:
    if st[counter_key] < len(L) - 1:
        st[counter_key] += 1
        update_component(ghenv, interval)
    else:
        st[counter_key] = 0
        st[running_key] = False
    
if start:
    st[running_key] = True

if stop:
    st[running_key] = False

if step:
    if st[counter_key] < len(L) - 1:
        st[counter_key] += 1

if step_back:
    if st[counter_key] < len(L) - 1:
        st[counter_key] -= 1

if reset:
    st[counter_key] = 0
    st[running_key] = False

if full:
    st[counter_key] = len(L)-1

if len(L):
    item = L[st[counter_key]]


#st["visualisation_counter"] = st[counter_key]
counter = st[counter_key]+1
# ---------- end counter ----------
panel_5 = Panel(counter.counter)

# ----
# Draw
list_2 = ValueList({"show all": "show_all", "show until key": "show_until_key"}, selected="show all")

visualize = Python3Script(
    assembly=generate_assembly.assembly,
    show=list_2,
    highlight_current_part=Toggle(False),
    show_connections=Toggle(True),
    counter=counter.counter)  # -> out, parts_built, parts_not_built, parts_frame, parts_keys, connections, connection_types, current_part_geometry, current_part_frame
# ---------- visualize: Python ----------
from compas_rhino.conversions import mesh_to_rhino, box_to_rhino, frame_to_rhino, line_to_rhino, point_to_rhino
from compas.geometry import Line, Transformation, Point, Vector, Frame, Translation

#print assembly
print(assembly)
#for p in assembly.parts():
#    layer = round(robot.from_RCF_to_BCF(p.frame).point.z/0.08)-1
#    assembly.graph.node_attribute(p.key, "layer", layer)


#get parts datastructure
parts_keys = [p for p in assembly.part_keys()]
parts = [assembly.part(p) for p in parts_keys]
parts_all = []
parts_built = []
parts_not_built = []
parts_frame = []

if show == "show_all":
    for p in parts:
        p_frame = p.frame

        if assembly.graph.node_attribute(p.key, "built"):
            parts_built.append(mesh_to_rhino(p.mesh.transformed(Transformation.from_frame((p_frame)))))
        else:
            parts_not_built.append(mesh_to_rhino(p.mesh.transformed(Transformation.from_frame((p_frame)))))

        parts_frame.append(frame_to_rhino(p_frame))
   
if show == "show_until_key":
    for p in parts[0:counter]:
        p_frame = p.frame
        
        if assembly.graph.node_attribute(p.key, "built"):
            parts_built.append(mesh_to_rhino(p.mesh.transformed(Transformation.from_frame((p_frame)))))
        else:
            parts_not_built.append(mesh_to_rhino(p.mesh.transformed(Transformation.from_frame((p_frame)))))

        parts_frame.append(frame_to_rhino(p_frame))

key = counter

if highlight_current_part:
    current_part = assembly.part(key)
    print(current_part.shape)
    current_part_geometry = mesh_to_rhino(current_part.mesh)
    current_part_frame = frame_to_rhino(current_part.frame)

if show_connections:
    connections = [line_to_rhino(Line(assembly.part(start).frame.point, assembly.part(end).frame.point)) for start, end in assembly.graph.edges()]

    print(connections)
    #connections = [line_to_rhino(Line(assembly.find_by_key(start).frame).point, robot.from_RCF_to_BCF(assembly.find_by_key(end).frame).point) for start, end in assembly.graph.edges()]
    connection_types = [assembly.graph.edge_attribute(t, "type") for t in assembly.graph.edges()]
    #extract points of the frame of the parts for visulization (+ converted to rhino point)
    parts_points = [point_to_rhino(p.frame.point) for p in assembly.parts()]
# ---------- end visualize ----------

panel_6 = Panel(visualize.out)

geo = Geometry(visualize.parts_built)
geo_2 = Geometry(visualize.parts_frame)
line = Line(visualize.connections)
pln = Plane(visualize.current_part_frame)
geo_3 = Geometry(visualize.parts_not_built)
preview_2 = CustomPreview(Geometry=geo, Material=ColourSwatch(SwatchColor=RGBA(252, 83, 83, 216)))
preview_3 = CustomPreview(Geometry=geo_3, Material=ColourSwatch(SwatchColor=RGBA(255, 138, 138, 210)))
preview_4 = CustomPreview(Geometry=geo_2, Material=ColourSwatch(SwatchColor=RGB(214, 166, 71)))
py3_2 = Python3Script(planes=visualize.parts_frame, scale=Slider(0.1, range=0..1))  # -> P, V, C, W; inputs planes: list of Plane, scale: Double
# ---------- py3_2: Python ----------
from Rhino.Display import ColorRGBA
from ghpythonlib.components import ColourRGBf


red = ColourRGBf(255, 255, 0, 0)
green = ColourRGBf(255, 0, 255, 0)
blue = ColourRGBf(255, 0, 0, 255)

P = []
V = []
C = []

# scale = float(scale)

for plane in planes:
    if not plane:
        continue
    P += [plane.Origin] * 3
    V.append(plane.XAxis * scale)
    V.append(plane.YAxis * scale)
    V.append(plane.ZAxis * scale)
    C += [red, green, blue]

W = 3
# ---------- end py3_2 ----------
curve_preview = CustomCurvePreview(Curve=line, Linetype="Continuous", Colour=ColourSwatch(SwatchColor=RGB(38, 14, 20)))
tag_2 = TextTag(Location=visualize.parts_frame, Text=visualize.parts_keys)
vdisex = VectorDisplayEx(Point=py3_2.P, Vector=py3_2.V, Colour=py3_2.C, Width=py3_2.W)
