# Grasshopper definition Assembly_Model_example.gh (Grasshopper 1.0.8)
# plug-ins: MetaHopper

# ----
# Disassembly
# or Reassembly
disassembly = BooleanToggle(False)
import = Button()
path = Python3Script()  # -> out, DATA
# ---------- path: Python ----------
import os
import getpass

username = getpass.getuser()
USER_FOLDER = os.path.abspath(os.path.join("C:/Users/", username))
DATA = os.path.abspath(os.path.join(USER_FOLDER,"workspace/projects/workshop_iaac_2026/data/assembly"))

print(USER_FOLDER)
print(DATA)
# ---------- end path ----------

new = BooleanToggle(False)

# ----
# Import Assembly
panel = Panel("material_stack_0")
import_2 = Python3Script(disassembly=disassembly, new=new, DATA=path.DATA, import=import, disassembly_name="material_stack", assembly_name=panel)  # -> out, assembly; inputs DATA: String
# ---------- import_2: Python ----------
import os
import json
from assembly_information_model.assembly import Assembly
from scriptcontext import sticky as st

if _import:
    if disassembly:
        if new:
            filename = "material_stack.json"
            PATH = os.path.join(DATA, filename)
            assembly = Assembly.from_json(PATH)
        else:
            filename = disassembly_name + ".json"
            PATH = os.path.join(DATA, filename)
            assembly = Assembly.from_json(PATH)
    else:
        filename = assembly_name + ".json"
        PATH = os.path.join(DATA, filename)
        assembly = Assembly.from_json(PATH)
    
    st['material_stack'] = assembly

assembly = st.get('material_stack')
# ---------- end import_2 ----------

# ----
# Import Assembly
panel_2 = Panel("material_stack_1")
import_3 = Python3Script(disassembly=disassembly, new=new, DATA=path.DATA, import=import, assembly_name=panel_2)  # -> out, assembly; inputs DATA: String
# ---------- import_3: Python ----------
import os
import json
from assembly_information_model.assembly import Assembly
from scriptcontext import sticky as st

if _import:
    if not disassembly:
        filename = assembly_name + ".json"
        PATH = os.path.join(DATA, filename)
        assembly = Assembly.from_json(PATH)  
    st['material_stack_2'] = assembly

assembly = st.get('material_stack_2')
# ---------- end import_3 ----------

# ----
# Transform
toggle = BooleanToggle(False)
pln = Plane(PlaneXY(0.02907808638, -1.103271318, 0))
transform_assembly = Python3Script(assembly=import_3.assembly, ref_plane=pln, transform=toggle)  # -> out, assembly
# ---------- transform_assembly: Python ----------
from compas.geometry import Frame, Transformation, Rotation, Translation
from compas_rhino.conversions import plane_to_compas_frame, point_to_rhino, frame_to_rhino

center_frame = Frame.worldXY()
# center_frame_new = plane_to_compas_frame(center_plane_new)

if transform:
    copy_assembly = assembly.copy()
    # stack_frame = Frame.from_quaternion([0.9659258262, 0,0,-0.2588190], [12.53473,8.91922,0.17])
    stack_frame = Frame.from_quaternion([0.9659258262, 0,0,-0.2588190], [15.7,10.15,0.17])

    # T = Transformation.from_frame_to_frame(center_frame, stack_frame)
    T = Transformation.from_frame_to_frame(center_frame, plane_to_compas_frame(ref_plane))
    

    # Here transform both the frame and planned frame of every brick.
    for key in copy_assembly.part_keys():
        p = copy_assembly.part(key)
        p.frame = p.frame.transformed(T)
        copy_assembly.graph.node_attribute(key, "planned_frame", p.frame)
        print(copy_assembly.graph.node_attribute(key, "planned_frame"))

    assembly = copy_assembly
# ---------- end transform_assembly ----------

# ----
# Import Assembly
panel_3 = Panel("column_twisted")
import_4 = Python3Script(
    disassembly=disassembly,
    new=new,
    DATA=path.DATA,
    import=import,
    disassembly_name="260219_disassembly_v1_structure",
    assembly_name=panel_3)  # -> out, assembly; inputs DATA: String
# ---------- import_4: Python ----------
import os
import json
from assembly_information_model.assembly import Assembly
from scriptcontext import sticky as st

if _import:
    if disassembly:
        if new:
            assembly = Assembly()
        else:
            filename = disassembly_name + ".json"
            PATH = os.path.join(DATA, filename)
            print(PATH)
            assembly = Assembly.from_json(PATH)
    else:
        filename = assembly_name + ".json"
        PATH = os.path.join(DATA, filename)
        print(PATH)
        assembly = Assembly.from_json(PATH)

    st['building_structure'] = assembly

assembly = st.get('building_structure')
# ---------- end import_4 ----------

# ----
# Transform
toggle_2 = BooleanToggle(False)
pln_2 = Plane(PlaneXY(0.02907808638, -1.103271318, 0))
transform_assembly_2 = Python3Script(assembly=import_2.assembly, ref_plane=pln_2, transform=toggle_2)  # -> out, assembly; same code as transform_assembly

# ----
# Transform
toggle_3 = BooleanToggle(False)
pln_3 = Plane(PlaneXY(-15.78717208, -10.61613919, 0))
transform_assembly_3 = Python3Script(assembly=import_4.assembly, ref_plane=pln_3, transform=toggle_3)  # -> out, assembly
# ---------- transform_assembly_3: Python ----------
from compas.geometry import Frame, Transformation, Rotation, Translation
from compas_rhino.conversions import plane_to_compas_frame, point_to_rhino, frame_to_rhino

center_frame = Frame.worldXY()
# center_frame_new = plane_to_compas_frame(center_plane_new)

if transform:
    copy_assembly = assembly.copy()
    #T = Transformation.from_frame_to_frame(center_frame, Frame([1.0,0,0.05],[1,0,0],[0,1,0]))
    T = Transformation.from_frame_to_frame(center_frame, plane_to_compas_frame(ref_plane))

    # Here transform both the frame and planned frame of every brick.
    for key in copy_assembly.part_keys():
        p = copy_assembly.part(key)
        p.frame = p.frame.transformed(T)
        copy_assembly.graph.node_attribute(key, "planned_frame", p.frame)
        print(copy_assembly.graph.node_attribute(key, "planned_frame"))

    assembly = copy_assembly
# ---------- end transform_assembly_3 ----------

# ----
# Export to JSON
panel_4 = Panel("v1")
export = Button()
date = Python3Script()  # -> date
# ---------- date: Python ----------
import time
date = (
    str(time.localtime().tm_year)[2:] +
    f"{time.localtime().tm_mon:02d}" +
    f"{time.localtime().tm_mday:02d}"
)

print(date)
# ---------- end date ----------
panel_5 = Panel(date)
export_2 = Python3Script(
    DATA=path.DATA,
    disassembly=disassembly,
    building_structure=transform_assembly_3.assembly,
    material_stack=transform_assembly_2.assembly,
    export=export,
    name=panel_4,
    date=panel_5)  # -> out; inputs name: String, date: String
# ---------- export_2: Python ----------
import os

if export: 
    if disassembly:
        type_as = "_disassembly_"
    else:
        type_as = "_assembly_"

    stack_filename = date + type_as + name + "_stack.json"
    PATH = os.path.join(DATA, stack_filename)

    # the assembly has to be serialized such that it can be called from CPython
    material_stack.to_json(PATH)

    bench_filename = date + type_as + name + "_structure.json"
    PATH = os.path.join(DATA, bench_filename)

    # the assembly has to be serialized such that it can be called from CPython
    building_structure.to_json(PATH)
# ---------- end export_2 ----------
exportbcflogs = Python3Script(DATA=path.DATA, export=export, name=panel_5, add=panel_4)  # -> out; disabled
# ---------- exportbcflogs: Python ----------
import os
from compas.geometry import Frame

print(robot._frame_log)

if export:
    filename = name + add + "_BCF.json"
    PATH = os.path.join(DATA, filename)
    
    robot.export_log(PATH)
# ---------- end exportbcflogs ----------

# ----
# Draw assembly
start = Button()
stop = Button()
step = Button()
back = Button()
reset = Button()
full = Button()
list = ValueList({"20", "50", "100", "500", "1000", "5000"}, selected="500")
list_2 = ValueList({"show all": "show_all", "show until key": "show_until_key"}, selected="show all")
counter = Python3Script(
    my_assembly=transform_assembly.assembly,
    start=start,
    stop=stop,
    step=step,
    step_back=back,
    reset=reset,
    full=full,
    interval=list)  # -> out, counter
# ---------- counter: Python ----------
from scriptcontext import sticky as st
import Grasshopper

def update_component(ghenv, delay):
    """Schedule an update of the Grasshopper component.

    After the specified delay, the GH component will be automatically updated.

    Parameters
    ----------
    ghenv : :class:`GhPython.Component.PythonEnvironment`
        The current GHPython environment.
    delay : :obj:`int`
        Time in milliseconds until the update is performed.

    Raises
    ------
    ValueError
        If the delay is less than zero.

    """
    if delay <= 0:
        raise ValueError("Delay must be greater than zero")

    ghcomp = ghenv.Component
    ghdoc = ghcomp.OnPingDocument()

    def callback(ghdoc):
        if ghdoc.SolutionState != Grasshopper.Kernel.GH_ProcessStep.Process:
            ghcomp.ExpireSolution(False)

    ghdoc.ScheduleSolution(delay, Grasshopper.Kernel.GH_Document.GH_ScheduleDelegate(callback))

L = range(my_assembly.graph.number_of_nodes())

# store data in component
guid = str(ghenv.Component.InstanceGuid)
counter_key = "counter_" + guid
running_key = "running_" + guid

if counter_key not in st:
    st[counter_key] = 0

if running_key not in st:
    st[running_key] = False
    

if st[running_key]:
    if st[counter_key] < len(L) - 1:
        st[counter_key] += 1
        update_component(ghenv, interval)
    else:
        st[counter_key] = 0
        st[running_key] = False
    
if start:
    st[running_key] = True

if stop:
    st[running_key] = False

if step:
    if st[counter_key] < len(L) - 1:
        st[counter_key] += 1

if step_back:
    if st[counter_key] > 0:
        st[counter_key] -= 1

if reset:
    st[counter_key] = 0
    st[running_key] = False

if full:
    st[counter_key] = len(L)-1

if len(L):
    item = L[st[counter_key]]


#st["visualisation_counter"] = st[counter_key]
counter = st[counter_key] +1
# ---------- end counter ----------
visualize = Python3Script(
    assembly=transform_assembly.assembly,
    show=list_2,
    highlight_current_part=Toggle(False),
    show_connections=Toggle(False),
    counter=counter.counter)  # -> out, stack_key, parts_not_built, parts_built, parts_frame, parts_keys, connections, connection_types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; inputs bang_2: list
# ---------- visualize: Python ----------
from compas_rhino.conversions import mesh_to_rhino, box_to_rhino, frame_to_rhino, line_to_rhino, point_to_rhino
from compas.geometry import Line, Transformation, Point, Vector, Frame, Translation

print(assembly)

s = set([p for p in assembly.part_keys()])
i = 1
while i in s:
    i += 1
# assembly.graph.delete_node(74)

#for p in assembly.parts():
#    layer = round(robot.from_RCF_to_BCF(p.frame).point.z/0.08)-1
#    assembly.graph.node_attribute(p.key, "layer", layer)

#get parts datastructure
parts_keys = [p for p in assembly.part_keys()]
parts = [assembly.part(p) for p in parts_keys]
parts_all = []
parts_not_built = []
parts_built = []
parts_frame = []
last_marker_frame = None

if "stack_key" in assembly.graph.attributes.keys():
    stack_key = assembly.graph.attributes["stack_key"]

if "marker_frames_WCF" in assembly.graph.attributes.keys():
    marker_frames_WCF = assembly.graph.attributes["marker_frames_WCF"]
    last_frame_key = max(marker_frames_WCF.keys())
    last_marker_frame = marker_frames_WCF[last_frame_key]
    last_marker_plane = frame_to_rhino(last_marker_frame)

if show == "show_all":
    for key in parts_keys:
        p = assembly.part(key)
        p_frame = p.frame
        if last_marker_frame is not None:
            p_frame = p_frame.transformed(Transformation.from_change_of_basis(last_marker_frame, Frame.worldXY()))
        parts_frame.append(frame_to_rhino(p_frame))
        if assembly.graph.node_attribute(p.key, "built"):
            parts_built.append(mesh_to_rhino(p.mesh.transformed(Transformation.from_frame((p_frame)))))
        else:
            parts_not_built.append(mesh_to_rhino(p.mesh.transformed(Transformation.from_frame((p_frame)))))
   
if show == "show_until_key":
    for p in parts[0:counter]:
        p_frame = p.frame
        if assembly.graph.node_attribute(p.key, "built"):
            parts_built.append(mesh_to_rhino(p.mesh.transformed(Transformation.from_frame((p_frame)))))
        else:
            parts_not_built.append(mesh_to_rhino(p.mesh.transformed(Transformation.from_frame((p_frame)))))
        parts_frame.append(frame_to_rhino(p_frame))

key = counter

if highlight_current_part:
    current_part = assembly.part(key)
    current_part_geometry = mesh_to_rhino(current_part.mesh)
    current_part_frame = frame_to_rhino(current_part.frame)

if show_connections:
    connections = [line_to_rhino(Line(assembly.find_by_key(start).frame).point, robot.from_RCF_to_BCF(assembly.find_by_key(end).frame).point) for start, end in assembly.graph.edges()]
    connection_types = [assembly.graph.edge_attribute(t, "type") for t in assembly.graph.edges()]
    #extract points of the frame of the parts for visulization (+ converted to rhino point)
    parts_points = [point_to_rhino(p.frame.point) for p in assembly.parts()]

parts_keys = [p for p in parts_keys if assembly.graph.node_attribute(p, "available")]
# ---------- end visualize ----------
panel_6 = Panel(visualize.out)
panel_7 = Panel(counter.counter)
geo = Geometry(visualize.parts_not_built)
line = Line(visualize.connections)
geo_2 = Geometry(visualize.parts_built)
pln_4 = Plane(visualize.parts_frame)
pln_5 = Plane(visualize.last_marker_plane)
preview = CustomPreview(Geometry=geo, Material=ColourSwatch(SwatchColor=RGBA(242, 204, 255, 160)))
preview_2 = CustomPreview(Geometry=geo_2, Material=ColourSwatch(SwatchColor=RGBA(210, 83, 252, 216)))
tag = TextTag(Location=visualize.parts_frame, Text=visualize.parts_keys)
py3 = Python3Script(planes=[visualize.parts_frame, visualize.last_marker_plane], scale=Slider(0.1, range=0..1))  # -> P, V, C, W; inputs planes: list of Plane, scale: Double
# ---------- py3: Python ----------
from Rhino.Display import ColorRGBA
from ghpythonlib.components import ColourRGBf


red = ColourRGBf(255, 255, 0, 0)
green = ColourRGBf(255, 0, 255, 0)
blue = ColourRGBf(255, 0, 0, 255)

P = []
V = []
C = []

# scale = float(scale)

for plane in planes:
    if not plane:
        continue
    P += [plane.Origin] * 3
    V.append(plane.XAxis * scale)
    V.append(plane.YAxis * scale)
    V.append(plane.ZAxis * scale)
    C += [red, green, blue]

W = 3
# ---------- end py3 ----------
stack_key = Panel(visualize.stack_key)
curve_preview = CustomCurvePreview(Curve=line, Linetype="Continuous", Colour=ColourSwatch(SwatchColor=RGB(255, 125, 157)))
vdisex = VectorDisplayEx(Point=py3.P, Vector=py3.V, Colour=py3.C, Width=py3.W)

# ----
# Material
# Stack.2
toggle_4 = GroupToggle(ToggleActive=True, ToggleVisible=False)  # disabled

# ----
# Material
# Stack.1
toggle_5 = GroupToggle(ToggleActive=True, ToggleVisible=False)  # disabled

# ----
# Draw assembly
start_2 = Button()
stop_2 = Button()
step_2 = Button()
back_2 = Button()
reset_2 = Button()
full_2 = Button()
list_3 = ValueList({"20", "50", "100", "500", "1000", "5000"}, selected="500")
list_4 = ValueList({"show all": "show_all", "show until key": "show_until_key"}, selected="show all")
counter_2 = Python3Script(
    my_assembly=transform_assembly_2.assembly,
    start=start_2,
    stop=stop_2,
    step=step_2,
    step_back=back_2,
    reset=reset_2,
    full=full_2,
    interval=list_3)  # -> out, counter; same code as counter
visualize_2 = Python3Script(
    assembly=transform_assembly_2.assembly,
    show=list_4,
    highlight_current_part=Toggle(False),
    show_connections=Toggle(False),
    counter=counter_2.counter)  # -> out, stack_key, parts_not_built, parts_built, parts_frame, parts_keys, connections, connection_types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; inputs bang_2: list; same code as visualize
panel_8 = Panel(visualize_2.out)
geo_3 = Geometry(visualize_2.parts_not_built)
geo_4 = Geometry(visualize_2.parts_built)
line_2 = Line(visualize_2.connections)
preview_3 = CustomPreview(Geometry=geo_4, Material=ColourSwatch(SwatchColor=RGBA(210, 83, 252, 216)))
tag_2 = TextTag(Location=visualize_2.parts_frame, Text=visualize_2.parts_keys)
py3_2 = Python3Script(planes=[visualize_2.parts_frame, visualize_2.last_marker_plane], scale=Slider(0.1, range=0..1))  # -> P, V, C, W; inputs planes: list of Plane, scale: Double; same code as py3
curve_preview_2 = CustomCurvePreview(Curve=line_2, Linetype="Continuous", Colour=ColourSwatch(SwatchColor=RGB(255, 125, 157)))
vdisex_2 = VectorDisplayEx(Point=py3_2.P, Vector=py3_2.V, Colour=py3_2.C, Width=py3_2.W)

# ----
# Assembly
# Models
panel_9 = Panel(counter_2.counter)

pln_6 = Plane(visualize_2.last_marker_plane)
pln_7 = Plane(visualize_2.parts_frame)
stack_key_2 = Panel(visualize_2.stack_key)

preview_4 = CustomPreview(Geometry=geo_3, Material=ColourSwatch(SwatchColor=RGBA(242, 204, 255, 160)))

# ----
# Building
# Structure
# Draw assembly
start_3 = Button()  # disabled
stop_3 = Button()  # disabled
step_3 = Button()  # disabled
back_3 = Button()  # disabled
reset_3 = Button()  # disabled
full_3 = Button()  # disabled
list_5 = ValueList({"20", "50", "100", "500", "1000", "5000"}, selected="500")  # disabled
list_6 = ValueList({"show all": "show_all", "show until key": "show_until_key"}, selected="show all")  # disabled
toggle_6 = BooleanToggle(False)  # disabled
toggle_7 = BooleanToggle(False)  # disabled
counter_3 = Python3Script(
    my_assembly=transform_assembly_3.assembly,
    start=start_3,
    stop=stop_3,
    step=step_3,
    step_back=back_3,
    reset=reset_3,
    full=full_3,
    interval=list_5)  # -> out, counter; disabled; same code as counter
visualize_3 = Python3Script(
    assembly=transform_assembly_3.assembly,
    show=list_6,
    highlight_current_part=toggle_6,
    show_connections=toggle_7,
    counter=counter_3.counter)  # -> out, parts_built, parts_not_built, parts_frame, parts_keys, connections, connection_types, current_part_geometry, current_part_frame; inputs bang_2: list; disabled
# ---------- visualize_3: Python ----------
from compas_rhino.conversions import mesh_to_rhino, box_to_rhino, frame_to_rhino, line_to_rhino, point_to_rhino
from compas.geometry import Line, Transformation, Point, Vector, Frame, Translation, Rotation
import numpy as np

print(assembly)
#get parts datastructure
parts_keys = [p for p in assembly.part_keys()]
parts = [assembly.part(p) for p in parts_keys]
parts_all = []
parts_built = []
parts_not_built = []
parts_anchor = []
parts_frame = []
if show == "show_all":
    for key in parts_keys:
        p = assembly.part(key)
        p_frame = p.frame
        planned_frame = assembly.graph.node_attribute(key, "planned_frame")

        # print(planned_frame)
        if assembly.graph.node_attribute(key, "built"):
            parts_built.append(mesh_to_rhino(p.mesh.transformed(Transformation.from_frame((p_frame)))))
            parts_frame.append(frame_to_rhino(p_frame))
        elif not assembly.graph.node_attribute(key, "built"):
            parts_not_built.append(mesh_to_rhino(p.mesh.transformed(Transformation.from_frame((p_frame)))))
            parts_frame.append(frame_to_rhino(p_frame))
        
        elif planned_frame is not None:
            parts_not_built.append(mesh_to_rhino(p.mesh.transformed(Transformation.from_frame((planned_frame)))))
   
if show == "show_until_key":
    for p in parts[0:counter]:
        p_frame = p.frame
        
        if assembly.graph.node_attribute(p.key, "built"):
            parts_built.append(mesh_to_rhino(p.mesh.transformed(Transformation.from_frame((p_frame)))))
        else:
            parts_not_built.append(mesh_to_rhino(p.mesh.transformed(Transformation.from_frame((p_frame)))))

        parts_frame.append(frame_to_rhino(p_frame))

key = counter

if highlight_current_part:
    current_part = assembly.part(key)
    # print(current_part.shape)
    current_part_geometry = mesh_to_rhino(current_part.mesh)
    current_part_frame = frame_to_rhino(current_part.frame)

if show_connections:
    connections = [line_to_rhino(Line(assembly.find_by_key(start).frame).point, robot.from_RCF_to_BCF(assembly.find_by_key(end).frame).point) for start, end in assembly.graph.edges()]
    connection_types = [assembly.graph.edge_attribute(t, "type") for t in assembly.graph.edges()]
    #extract points of the frame of the parts for visulization (+ converted to rhino point)
    parts_points = [point_to_rhino(p.frame.point) for p in assembly.parts()]

# parts_keys = [p for p in parts_keys if assembly.graph.node_attribute(p, "built")]
# ---------- end visualize_3 ----------
panel_10 = Panel(visualize_3.out)  # disabled
geo_5 = Geometry(visualize_3.parts_built)  # disabled
colour_swatch = ColourSwatch(SwatchColor=RGBA(242, 145, 145, 155))  # disabled
geo_6 = Geometry(visualize_3.parts_not_built)  # disabled
colour_swatch_2 = ColourSwatch(SwatchColor=RGB(255, 125, 157))  # disabled
line_3 = Line(visualize_3.connections)  # disabled
preview_5 = CustomPreview(Geometry=geo_6, Material=colour_swatch)  # disabled
curve_preview_3 = CustomCurvePreview(Curve=line_3, Linetype="Continuous", Colour=colour_swatch_2)  # disabled
tag_3 = TextTag(Location=visualize_3.parts_frame, Text=visualize_3.parts_keys)  # disabled
toggle_8 = GroupToggle(ToggleActive=True, ToggleVisible=False)  # disabled

panel_11 = Panel(counter_3.counter)
pln_8 = Plane(visualize_3.current_part_frame)
py3_3 = Python3Script(planes=visualize_3.parts_frame, scale=Slider(0.1, range=0..1))  # -> P, V, C, W; inputs planes: list of Plane, scale: Double; same code as py3
vdisex_3 = VectorDisplayEx(Point=py3_3.P, Vector=py3_3.V, Colour=py3_3.C, Width=py3_3.W)

preview_6 = CustomPreview(Geometry=geo_5, Material=ColourSwatch(SwatchColor=RGBA(252, 45, 45, 216)))  # disabled
