# Grasshopper definition parse_single_brick_damage.ghx (Grasshopper 1.0.8)
# plug-ins: MetaHopper

# ----
# Load the Synthetic Brick Damage Files
panel = Panel("_brick")
# Parse Single Brick damage Information
panel_2 = Panel("stack")
concat = Concatenate(FragmentA=panel_2, FragmentB=Slider(1, range=1..2), FragmentC=panel, FragmentD=Slider(25, range=0..49))
panel_3 = Panel("stack1_brick23")
panel_4 = Panel(concat)
damaged_brick_path = Python3Script(filename=concat)  # -> out, DATA
# ---------- damaged_brick_path: Python ----------
import os
import getpass

username = getpass.getuser()
USER_FOLDER = os.path.abspath(os.path.join("C:/Users/", username))
DATA = os.path.abspath(os.path.join(USER_FOLDER,"workspace/projects/workshop_iaac_2026/data/stacked_brick_dataset_for_testing/brick_dataset/{}.json".format(filename)))

print(USER_FOLDER)
print(DATA)
# ---------- end damaged_brick_path ----------

# ----
# Parse the Damage Data
toggle = BooleanToggle(True)
decode_damage = Python3Script(json_path=damaged_brick_path.DATA, as_points=toggle)  # -> out, brick_id, node_key, brick_size_xyz, stack_id, brick_index, damage_count, damage_types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; inputs json_path: String, as_points: Boolean
# ---------- decode_damage: Python ----------
"""
Grasshopper Python 3 (Rhino) - Brick Damage JSON Parser (file path only)

Inputs:
  json_path : str  - path to a .json file
  as_points : bool - True => Rhino Point3d output, False => raw xyz lists

Outputs:
  brick_id, node_key, brick_size_xyz, stack_id, brick_index
  damage_count
  damage_types, damage_status, damage_values, damage_vertices, damage_uv, damage_desc
  damage_points, damage_xaxis, damage_yaxis
"""

import json
import os
import re

from Rhino.Geometry import Point3d, Vector3d


def _to_point(xyz):
    if xyz is None:
        return None
    return Point3d(float(xyz[0]), float(xyz[1]), float(xyz[2]))

def _to_vec(xyz):
    if xyz is None:
        return None
    return Vector3d(float(xyz[0]), float(xyz[1]), float(xyz[2]))

def _parse_stack_and_index(brick_id_str):
    """
    Expects patterns like 'stack1_brick23'.
    Returns (stack_id:int|None, brick_index:int|None)
    """
    if not brick_id_str:
        return (None, None)
    m = re.match(r"^stack(\d+)_brick(\d+)$", str(brick_id_str).strip())
    if not m:
        return (None, None)
    return (int(m.group(1)), int(m.group(2)))

def _load_json_from_path(path):
    if path is None or not str(path).strip():
        raise ValueError("json_path is empty. Provide a valid file path.")
    path = str(path).strip()

    if not os.path.exists(path):
        raise FileNotFoundError("JSON file not found: {}".format(path))

    with open(path, "r") as f:
        return json.load(f)


# ---- main ----
try:
    data = _load_json_from_path(json_path)

    # Brick-level
    node_key = data.get("nodeKey", None)
    brick_id = data.get("brickId", None)

    bs = data.get("brickSize", {}) or {}
    brick_size_xyz = [bs.get("x", None), bs.get("y", None), bs.get("z", None)]

    stack_id, brick_index = _parse_stack_and_index(brick_id)

    # Damage-level
    damages = data.get("appendDamages", []) or []
    damage_count = len(damages)

    damage_types = []
    damage_status = []
    damage_values = []
    damage_vertices = []
    damage_uv = []
    damage_desc = []

    damage_points = []
    damage_xaxis = []
    damage_yaxis = []

    # Default True if as_points is not wired
    as_points_local = True if as_points is None else bool(as_points)

    for d in damages:
        damage_types.append(d.get("type", None))
        damage_status.append(d.get("status", None))
        damage_values.append(d.get("value", None))
        damage_vertices.append(d.get("vertices", None))
        damage_desc.append(d.get("description", None))

        # uv only exists for face damages
        if "uv" in d and d.get("uv", None) is not None:
            uv = d["uv"]
            damage_uv.append((float(uv[0]), float(uv[1])))
        else:
            damage_uv.append(None)

        coords = d.get("coordinates", {}) or {}
        p = coords.get("point", None)
        xa = coords.get("xaxis", None)
        ya = coords.get("yaxis", None)

        if as_points_local:
            damage_points.append(_to_point(p))
        else:
            damage_points.append(None if p is None else [float(p[0]), float(p[1]), float(p[2])])

        damage_xaxis.append(_to_vec(xa))
        damage_yaxis.append(_to_vec(ya))
        STATUS_MAP = {
    "crack": 2,
    "spalling": 3,
    "material loss": 5,
    "staining": 1,
    "chipping": 4
}

        damage_status_int = []

        for status in damage_status:
            key = str(status).strip().lower()
            damage_status_int.append(STATUS_MAP.get(key, 0))

        

except Exception as e:
    # Fail gracefully in GH: set outputs to safe defaults
    print("ERROR:", e)

    brick_id = None
    node_key = None
    brick_size_xyz = None
    stack_id = None
    brick_index = None

    damage_count = 0
    damage_types = []
    damage_status = []
    damage_values = []
    damage_vertices = []
    damage_uv = []
    damage_desc = []
    damage_points = []
    damage_xaxis = []
    damage_yaxis = []
    damage_status_int= []
# ---------- end decode_damage ----------

# ----
# Visualize the Brick and Damage Locations
item = ListItem(List=decode_damage.brick_size_xyz, Index=0, Wrap=True)  # -> Item, Item1, Item2; disabled
toggle_2 = GroupToggle(ToggleActive=True, ToggleVisible=False)  # disabled
sph = Sphere(Base=decode_damage.damage_points, Radius=expr("x*.005", decode_damage.damage_values))  # disabled
box = CenterBox(Base=PlaneXY(0, 0, 0), X=expr("x/2", item.Item), Y=expr("x/2", item.Item1), Z=expr("x/2", item.Item2))  # disabled
swatch = ColourSwatch(SwatchColor=RGB(222, 89, 0))  # disabled
preview = CustomPreview(Geometry=box, Material=swatch)  # disabled

# ----
# Create a damage Score
multiplication = Multiplication(A=decode_damage.damage_status_int, B=decode_damage.damage_values)
ma = MassAddition(Input=multiplication)  # -> Result, PartialResults
damage_score = Panel(ma.Result)
